# Grasshopper definition Kybele_Workflow_Master_File.gh (Grasshopper 1.0.8)
# plug-ins: ClimateStudioGH, Kybele.Components

# Material Names
panel = Panel("concrete")
spectrum_name = Python3Script(material_name=panel)  # -> spectrum_name
# ---------- spectrum_name: Python ----------
_spectrum_name = str(_material_name) + ("_spectrum")
print(_spectrum_name)
# ---------- end spectrum_name ----------
spectrum_name_2 = Python3Script(material_name="aluminum_frames")  # -> spectrum_name; same code as spectrum_name
spectrum_name_3 = Python3Script(material_name="ground")  # -> spectrum_name; same code as spectrum_name
spectrum_name_4 = Python3Script(material_name="glazing1")  # -> spectrum_name; same code as spectrum_name
geometry_pipeline = GeometryPipeline(
    GroupByLayer=False,
    GroupByType=False,
    IncludeHidden=True,
    IncludeLocked=True,
    LayerFilter="Floor",
    NameFilter="*",
    SublayerFiltering=True,
    TypeFilter=1073741848)
geometry_pipeline_2 = GeometryPipeline(
    GroupByLayer=False,
    GroupByType=False,
    IncludeHidden=True,
    IncludeLocked=True,
    LayerFilter="Glazing",
    NameFilter="*",
    SublayerFiltering=True,
    TypeFilter=1073741848)
geometry_pipeline_3 = GeometryPipeline(
    GroupByLayer=False,
    GroupByType=False,
    IncludeHidden=True,
    IncludeLocked=True,
    LayerFilter="Mullions",
    NameFilter="*",
    SublayerFiltering=True,
    TypeFilter=1073741848)  # disabled
geometry_pipeline_4 = GeometryPipeline(
    GroupByLayer=False,
    GroupByType=False,
    IncludeHidden=True,
    IncludeLocked=True,
    LayerFilter="Structure",
    NameFilter="*",
    SublayerFiltering=True,
    TypeFilter=1073741848)
geometry_pipeline_5 = GeometryPipeline(
    GroupByLayer=False,
    GroupByType=False,
    IncludeHidden=True,
    IncludeLocked=True,
    LayerFilter="Ground",
    NameFilter="*",
    SublayerFiltering=True,
    TypeFilter=1073741848)
# Site North
# Define true north direction and align the model
# accordingly for accurate solar positioning.
number_slider = Slider(10, range=-100..100)
# Materials (Option 02)
# Select materials from kybele library
select_materials = BooleanToggle(False)
select_materials_2 = BooleanToggle(False)
radiance_check = Radiance_Check(_radiance=Toggle(True))
# Materials (Option 03)
# Create a custom material library
python_3_script = Python3Script(rad_folder="C:\RadMaterials", selected_material="aluminum")  # -> out, rad_data
# ---------- python_3_script: Python ----------
import os


rad_path = os.path.join(rad_folder, selected_material + ".rad")
if os.path.exists(rad_path):
    with open(rad_path, 'r') as f:
        rad_data = f.read()
else:
    rad_data = "File not found."
# ---------- end python_3_script ----------
construct_point = ConstructPoint(XCoordinate=number_slider, YCoordinate=Slider(-6, range=-100..100), ZCoordinate=Slider(1, range=0..1))
panel_2 = Panel(radiance_check)
kybele_modifiers = Python3Script(run=select_materials)  # -> out, modifier; disabled
# ---------- kybele_modifiers: Python ----------
import os
import System.Windows.Forms as WinForms
import System.Drawing
from System.Collections.Generic import List


rad_folder = r"C:\RadMaterials"

def parse_rad_file(filepath):
    with open(filepath, 'r') as file:
        lines = [line.strip() for line in file if line.strip() and not line.startswith('#')]

    name = os.path.splitext(os.path.basename(filepath))[0]
    r = g = b = spec = rough = vlr = vlt = 0.0

    for line in lines:
        if line.startswith("void"):
            parts = line.split()
            if len(parts) >= 3:
                name = parts[2]
        elif line.startswith("5"):
            parts = line.split()
            if len(parts) >= 6:
                r = float(parts[1])
                g = float(parts[2])
                b = float(parts[3])
                spec = float(parts[4])
                rough = float(parts[5])
                vlr = round((0.265 * r) + (0.670 * g) + (0.065 * b), 1)
                vlt = vlr if "glass" in lines[0].lower() else 0.0
            break
    return [name, f"{r:.3f}", f"{g:.3f}", f"{b:.3f}", f"{spec:.2f}", f"{rough:.2f}", f"{vlr:.1f}%", f"{vlt:.1f}%"]

# materials
materials = []
for filename in os.listdir(rad_folder):
    if filename.endswith(".rad"):
        full_path = os.path.join(rad_folder, filename)
        materials.append(parse_rad_file(full_path))

# Sort
materials.sort(key=lambda row: (row[0][0].isdigit(), row[0].lower()))

columns = ["Material", "R", "G", "B", "Specularity", "Roughness", "VLR", "VLT"]


def name_case_display(material_id):
    return material_id.replace("_", " ").title()


def show_material_selector():
    form = WinForms.Form()
    form.Text = "Kybele Radiance Material"
    form.Size = System.Drawing.Size(1500, 1000)
    form.StartPosition = WinForms.FormStartPosition.CenterScreen


    # Table layout
    layout = WinForms.TableLayoutPanel()
    layout.Dock = WinForms.DockStyle.Fill
    layout.RowCount = 3
    layout.ColumnCount = 1
    layout.RowStyles.Add(WinForms.RowStyle(WinForms.SizeType.Absolute, 300))
    layout.RowStyles.Add(WinForms.RowStyle(WinForms.SizeType.Percent, 100))
    layout.RowStyles.Add(WinForms.RowStyle(WinForms.SizeType.Absolute, 40))
    layout.BackColor = System.Drawing.Color.White


    # TOP PANEL
    topPanel = WinForms.TableLayoutPanel()
    topPanel.Dock = WinForms.DockStyle.Fill
    topPanel.ColumnCount = 2
    topPanel.RowCount = 2
    topPanel.ColumnStyles.Add(WinForms.ColumnStyle(WinForms.SizeType.Absolute, 300))
    topPanel.ColumnStyles.Add(WinForms.ColumnStyle(WinForms.SizeType.Percent, 100))
    topPanel.RowStyles.Add(WinForms.ColumnStyle(WinForms.SizeType.Percent, 80))
    topPanel.RowStyles.Add(WinForms.ColumnStyle(WinForms.SizeType.Percent, 20))
    topPanel.BackColor = System.Drawing.Color.White


    # Name label
    nameLabel = WinForms.Label()
    nameLabel.Text = "Select a material!"
    nameLabel.Dock = WinForms.DockStyle.Fill
    nameLabel.TextAlign = System.Drawing.ContentAlignment.BottomLeft
    nameLabel.Font = System.Drawing.Font("Segoe UI", 20, System.Drawing.FontStyle.Bold)
    topPanel.Controls.Add(nameLabel, 1, 0)


    # Info label
    infoLabel = WinForms.Label()
    infoLabel.Text = "RGB(0.00, 0.00, 0.00) | VLR: 0.0% | VLT: 0.0%"
    infoLabel.Dock = WinForms.DockStyle.Fill
    infoLabel.TextAlign = System.Drawing.ContentAlignment.TopLeft
    infoLabel.Font = System.Drawing.Font("Segoe UI", 10)
    topPanel.Controls.Add(infoLabel, 1, 1)


    # Image box
    imageBox = WinForms.PictureBox()
    imageBox.SizeMode = WinForms.PictureBoxSizeMode.Zoom
    imageBox.Width = 300
    imageBox.Height = 300
    imageBox.Dock = WinForms.DockStyle.Fill
    imageBox.BackColor = System.Drawing.Color.White
    topPanel.Controls.Add(imageBox, 0, 0)


    # MATERIALS TABLE
    grid = WinForms.DataGridView()
    grid.Dock = WinForms.DockStyle.Fill
    grid.ReadOnly = True
    grid.SelectionMode = WinForms.DataGridViewSelectionMode.FullRowSelect
    grid.AllowUserToAddRows = False
    grid.AllowUserToResizeRows = False
    grid.RowHeadersVisible = False
    grid.AutoSizeColumnsMode = WinForms.DataGridViewAutoSizeColumnsMode.Fill
    grid.BackgroundColor = System.Drawing.Color.White
    grid.ColumnHeadersDefaultCellStyle.Font = System.Drawing.Font("Segoe UI", 10, System.Drawing.FontStyle.Bold)
    grid.CellBorderStyle = WinForms.DataGridViewCellBorderStyle.SingleHorizontal
    grid.GridColor = System.Drawing.Color.LightGray


    for col in columns:
        grid.Columns.Add(col, col)

    for row in materials:
        display_row = row[:]
        display_row[0] = name_case_display(row[0])
        grid.Rows.Add(display_row)
    
    
    
    grid.Columns[0].Width = 80

    # Select button
    button = WinForms.Button()
    button.Text = "Select"
    button.Height = 30
    button.Margin = System.Windows.Forms.Padding(0, 5, 0, 5)
    button.Dock = WinForms.DockStyle.Fill


    selected = [None]
    def on_click(sender, args):
        if grid.SelectedRows.Count > 0:
            selected_display = grid.SelectedRows[0].Cells[0].Value


            for row in materials:
                if name_case_display(row[0]) == selected_display:
                    selected[0] = row[0]
                    break

            form.Close()

    button.Click += on_click


    # Add listener
    def update_image(sender, args):
        if grid.SelectedRows.Count > 0:
            row_index = grid.SelectedRows[0].Index
            original_name = materials[row_index][0]

            bmp_path = os.path.join(rad_folder, original_name + "_b.bmp")
            if os.path.exists(bmp_path):
                imageBox.Image = System.Drawing.Bitmap.FromFile(bmp_path)
            else:
                imageBox.Image = None

            # Update labels
            display_name = name_case_display(original_name)
            r = grid.SelectedRows[0].Cells[1].Value
            g = grid.SelectedRows[0].Cells[2].Value
            b = grid.SelectedRows[0].Cells[3].Value
            vlr = grid.SelectedRows[0].Cells[6].Value
            vlt = grid.SelectedRows[0].Cells[7].Value

            nameLabel.Text = display_name
            infoLabel.Text = f"RGB({r}, {g}, {b}) | VLR: {vlr} | VLT: {vlt}"
            
    grid.SelectionChanged += update_image


    # Layout
    layout.BackColor = System.Drawing.Color.White
    form.BackColor = System.Drawing.Color.White


    # Add image
    topPanel.Controls.Add(imageBox, 0, 0)
    topPanel.SetRowSpan(imageBox, 2)
    topPanel.Controls.Add(nameLabel, 1, 0)
    topPanel.Controls.Add(infoLabel, 1, 1) 

    # Three Items
    layout.Controls.Add(topPanel, 0, 0)
    layout.Controls.Add(grid, 0, 1)      
    layout.Controls.Add(button, 0, 2)     


    # Show the form
    form.Controls.Add(layout)
    form.ShowDialog()

    return selected[0]

# Main trigger
if run:
    _modifier = show_material_selector()
else:
    _modifier = None
# ---------- end kybele_modifiers ----------
kybele_modifiers_2 = Python3Script(run=select_materials_2)  # -> out, modifier; disabled
# ---------- kybele_modifiers_2: Python ----------
import os
import System.Windows.Forms as WinForms
import System.Drawing
from System.Collections.Generic import List

rad_folder = r"C:\RadMaterials"

def parse_rad_file(filepath):
    with open(filepath, 'r') as file:
        lines = [line.strip() for line in file if line.strip() and not line.startswith('#')]

    name = os.path.splitext(os.path.basename(filepath))[0]
    r = g = b = spec = rough = vlr = 0.0

    for line in lines:
        if line.startswith("void"):
            parts = line.split()
            if len(parts) >= 3:
                name = parts[2]
        elif line.startswith("5"):
            parts = line.split()
            if len(parts) >= 6:
                r = float(parts[1])
                g = float(parts[2])
                b = float(parts[3])
                spec = float(parts[4])
                rough = float(parts[5])
                vlr = round((0.265 * r) + (0.670 * g) + (0.065 * b), 1)
            break
    return [name, f"{r:.3f}", f"{g:.3f}", f"{b:.3f}", f"{spec:.2f}", f"{rough:.2f}", f"{vlr}"]

def load_materials():
    materials = []
    for filename in os.listdir(rad_folder):
        if filename.endswith(".rad"):
            full_path = os.path.join(rad_folder, filename)
            materials.append(parse_rad_file(full_path))
    materials.sort(key=lambda row: (row[0][0].isdigit(), row[0].lower()))
    return materials

columns = ["Material", "R", "G", "B", "Specularity", "Roughness", "VLR"]

def name_case_display(material_id):
    return material_id.replace("_", " ").title()

def show_material_selector():
    selected = [None]
    reload_flag = [True]

    while reload_flag[0]:
        reload_flag[0] = False

        form = WinForms.Form()
        form.Text = "Kybele Radiance Material"
        form.Size = System.Drawing.Size(1500, 1000)
        form.StartPosition = WinForms.FormStartPosition.CenterScreen

        layout = WinForms.TableLayoutPanel()
        layout.Dock = WinForms.DockStyle.Fill
        layout.RowCount = 3
        layout.ColumnCount = 1
        layout.RowStyles.Add(WinForms.RowStyle(WinForms.SizeType.Absolute, 300))
        layout.RowStyles.Add(WinForms.RowStyle(WinForms.SizeType.Percent, 100))
        layout.RowStyles.Add(WinForms.RowStyle(WinForms.SizeType.Absolute, 40))
        layout.BackColor = System.Drawing.Color.White

        topPanel = WinForms.TableLayoutPanel()
        topPanel.Dock = WinForms.DockStyle.Fill
        topPanel.ColumnCount = 2
        topPanel.RowCount = 2
        topPanel.ColumnStyles.Add(WinForms.ColumnStyle(WinForms.SizeType.Absolute, 300))
        topPanel.ColumnStyles.Add(WinForms.ColumnStyle(WinForms.SizeType.Percent, 100))
        topPanel.RowStyles.Add(WinForms.ColumnStyle(WinForms.SizeType.Percent, 80))
        topPanel.RowStyles.Add(WinForms.ColumnStyle(WinForms.SizeType.Percent, 20))
        topPanel.BackColor = System.Drawing.Color.White

        nameLabel = WinForms.Label()
        nameLabel.Text = "Select a material!"
        nameLabel.Dock = WinForms.DockStyle.Fill
        nameLabel.TextAlign = System.Drawing.ContentAlignment.BottomLeft
        nameLabel.Font = System.Drawing.Font("Segoe UI", 20, System.Drawing.FontStyle.Bold)
        topPanel.Controls.Add(nameLabel, 1, 0)

        infoLabel = WinForms.Label()
        infoLabel.Text = "RGB(0.00, 0.00, 0.00) | VLR: 0.0%"
        infoLabel.Dock = WinForms.DockStyle.Fill
        infoLabel.TextAlign = System.Drawing.ContentAlignment.TopLeft
        infoLabel.Font = System.Drawing.Font("Segoe UI", 10)
        topPanel.Controls.Add(infoLabel, 1, 1)

        imageBox = WinForms.PictureBox()
        imageBox.SizeMode = WinForms.PictureBoxSizeMode.Zoom
        imageBox.Dock = WinForms.DockStyle.Fill
        imageBox.BackColor = System.Drawing.Color.White
        topPanel.Controls.Add(imageBox, 0, 0)

        grid = WinForms.DataGridView()
        grid.Dock = WinForms.DockStyle.Fill
        grid.ReadOnly = True
        grid.SelectionMode = WinForms.DataGridViewSelectionMode.FullRowSelect
        grid.AllowUserToAddRows = False
        grid.AllowUserToResizeRows = False
        grid.RowHeadersVisible = False
        grid.AutoSizeColumnsMode = WinForms.DataGridViewAutoSizeColumnsMode.Fill
        grid.BackgroundColor = System.Drawing.Color.White
        grid.ColumnHeadersDefaultCellStyle.Font = System.Drawing.Font("Segoe UI", 10, System.Drawing.FontStyle.Bold)
        grid.CellBorderStyle = WinForms.DataGridViewCellBorderStyle.SingleHorizontal
        grid.GridColor = System.Drawing.Color.LightGray

        for col in columns:
            grid.Columns.Add(col, col)

        materials = load_materials()
        for row in materials:
            row[0] = name_case_display(row[0])
            grid.Rows.Add(row)

        grid.Columns[0].Width = 80

        buttonPanel = WinForms.FlowLayoutPanel()
        buttonPanel.Dock = WinForms.DockStyle.Fill

        def on_select(sender, args):
            if grid.SelectedRows.Count > 0:
                selected_display = grid.SelectedRows[0].Cells[0].Value
                for row in materials:
                    if name_case_display(row[0]) == selected_display:
                        selected[0] = row[0]
                        break
                form.Close()

        def on_reload(sender, args):
            reload_flag[0] = True
            form.Close()

        selectBtn = WinForms.Button()
        selectBtn.Text = "Select"
        selectBtn.Width = 100
        selectBtn.Click += on_select
        buttonPanel.Controls.Add(selectBtn)

        reloadBtn = WinForms.Button()
        reloadBtn.Text = "Reload"
        reloadBtn.Width = 100
        reloadBtn.Click += on_reload
        buttonPanel.Controls.Add(reloadBtn)

        def update_image(sender, args):
            if grid.SelectedRows.Count > 0:
                row_index = grid.SelectedRows[0].Index
                original_name = materials[row_index][0]
                bmp_path = os.path.join(rad_folder, original_name + "_b.bmp")
                imageBox.Image = System.Drawing.Bitmap.FromFile(bmp_path) if os.path.exists(bmp_path) else None
                display_name = name_case_display(original_name)
                r = grid.SelectedRows[0].Cells[1].Value
                g = grid.SelectedRows[0].Cells[2].Value
                b = grid.SelectedRows[0].Cells[3].Value
                vlr = grid.SelectedRows[0].Cells[6].Value
                nameLabel.Text = display_name
                infoLabel.Text = f"RGB({r}, {g}, {b}) | VLR: {vlr}%"

        grid.SelectionChanged += update_image

        layout.Controls.Add(topPanel, 0, 0)
        layout.Controls.Add(grid, 0, 1)
        layout.Controls.Add(buttonPanel, 0, 2)
        form.Controls.Add(layout)
        form.ShowDialog()

    return selected[0]

# Main trigger
if run:
    _modifier = show_material_selector()
else:
    _modifier = None
# ---------- end kybele_modifiers_2 ----------
compass = LBCompass(center=construct_point, scale=Slider(0.02, range=0.01..4))  # -> compass; plug-in component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
opaquemod3 = HBOpaqueModifier3(
    name=panel,
    r_ref=Slider(0.3, range=0..1),
    g_ref=Slider(0.28, range=0..1),
    b_ref=Slider(0.231, range=0..1),
    spec=Slider(0.0065, range=0..1),
    rough=Slider(0.2, range=0..1))  # -> modifier; plug-in component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
glassmod3 = HBGlassModifier3(
    name="glazing1",
    r_trans=Slider(0.9, range=0..1),
    g_trans=Slider(0.9, range=0..1),
    b_trans=Slider(0.9, range=0..1),
    refract=Slider(1.52, range=0..10))  # -> modifier; plug-in component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
metalmod3 = HBMetalModifier3(
    name="aluminum_frames",
    r_diff=Slider(0.48, range=0..1),
    g_diff=Slider(0.489, range=0..1),
    b_diff=Slider(0.479, range=0..1),
    spec=Slider(0.03, range=0..1),
    rough=Slider(0.1, range=0..1))  # -> modifier; disabled; plug-in component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
opaquemod3_2 = HBOpaqueModifier3(
    name="ground",
    r_ref=Slider(0.2, range=0..1),
    g_ref=Slider(0.2, range=0..1),
    b_ref=Slider(0.2, range=0..1),
    spec=Slider(0, range=0..1),
    rough=Slider(0, range=0..1))  # -> modifier; plug-in component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
# Materials (Option 01)
# Create material with r,g,b, values.
panel_3 = Panel("floor")
metalmod3_2 = HBMetalModifier3(
    name="aluminum_frames",
    r_diff=Slider(0.05, range=0..1),
    g_diff=Slider(0.05, range=0..1),
    b_diff=Slider(0.05, range=0..1),
    spec=Slider(0.95, range=0..1),
    rough=Slider(0.08, range=0..1))  # -> modifier; plug-in component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
panel_4 = Panel("structure")
panel_6 = Panel("ground")
panel_7 = Panel(python_3_script.rad_data)
custom_preview = CustomPreview(Geometry=compass, Material=ColourSwatch(SwatchColor=RGB(61, 61, 61)))
face = HBFace(geo=geometry_pipeline, name=panel_3, rad_mod=opaquemod3)  # -> out, faces; plug-in component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
face_2 = HBFace(geo=geometry_pipeline_4, rad_mod=metalmod3_2)  # -> out, faces; plug-in component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
face_3 = HBFace(geo=geometry_pipeline_3, rad_mod=metalmod3_2)  # -> out, faces; disabled; plug-in component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
face_4 = HBFace(geo=geometry_pipeline_5, rad_mod=opaquemod3_2)  # -> out, faces; plug-in component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
face_5 = HBFace(geo=geometry_pipeline_2, name="win", rad_mod=glassmod3)  # -> out, faces; plug-in component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
panel_8 = Panel(kybele_modifiers.modifier)
panel_9 = Panel(kybele_modifiers_2.modifier)
panel_10 = Panel(opaquemod3)
panel_11 = Panel(metalmod3_2)
panel_12 = Panel(metalmod3)
panel_13 = Panel(opaquemod3_2)
panel_14 = Panel(glassmod3)
# Model Preparation
# Create HB-compatible geometry in Rhino. Assign
# modifiers and apertures using Honeybee components.
model = HBModel(faces=flatten([face.faces, face_5.faces, face_2.faces, face_4.faces]), name="greenhouse")  # -> out, model; plug-in component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

# ----
# Electric Lighting (Option 02)
# lighting from IES file
panel_15 = Panel("C:\RadIES\area-light.ies")
panel_16 = Panel("D:\University of Wasington\04. Summer GRSA 2025\Other\lighting_test")
panel_17 = Panel("D:\University of Wasington\04. Summer GRSA 2025\Other\lighting_test")
python_3_script_2 = Python3Script(ies_path=panel_15, out_dir=panel_16, name="ies_test")  # -> out, rad_files, dat_files, cmdline, log; disabled
# ---------- python_3_script_2: Python ----------
"""IES → Radiance converter using ies2rad

Requires Radiance installed. On Windows, make sure ies2rad.exe is on PATH
or pass its folder via 'radiance_bin'.

Inputs:
    ies_path: str - path to .ies
    out_dir: str - output directory
    name: str|None - base name for output (optional)
    multiplier: float|None - ies2rad -m
    rgb: str|None - e.g. "1,1,1" for ies2rad -c r g b
    radiance_bin: str|None - directory containing ies2rad(.exe)
Outputs:
    _rad_files: list[str]
    _dat_files: list[str]
    _cmdline: str
    _log: str
"""

import os, shlex, subprocess, time, glob


def fail(msg):
    raise ValueError(msg)

if not ies_path or not os.path.isfile(ies_path):
    fail("Provide a valid IES file path for 'ies_path'.")

out_dir = out_dir or os.path.join(os.path.expanduser("~"), "radiance_out")
if not os.path.isdir(out_dir):
    os.makedirs(out_dir)


exe = "ies2rad.exe" if os.name == "nt" else "ies2rad"
ies2rad_path = exe
if radiance_bin:
    cand = os.path.join(radiance_bin, exe)
    if os.path.isfile(cand):
        ies2rad_path = cand


try:
    subprocess.run([ies2rad_path, "-?"],
                   stdout=subprocess.PIPE, stderr=subprocess.PIPE, check=False)
except Exception as e:
    fail("Could not execute ies2rad. Ensure Radiance is installed and ies2rad is on PATH or provide 'radiance_bin'.")


stem = name.strip() if name else os.path.splitext(os.path.basename(ies_path))[0]
cmd = [ies2rad_path, "-o", stem]


if isinstance(multiplier, (int, float)) and multiplier not in (None, 0):
    cmd += ["-m", str(float(multiplier))]


if rgb:
    try:
        r, g, b = [str(float(x)) for x in rgb.split(",")]
        cmd += ["-c", r, g, b]
    except:
        fail("rgb must be like '1,1,1' (three numbers).")


cmd += [ies_path]


before = set(os.listdir(out_dir))


proc = subprocess.run(cmd, cwd=out_dir,
                      stdout=subprocess.PIPE, stderr=subprocess.PIPE, text=True)
_log = (proc.stdout or "") + ("\n" + proc.stderr if proc.stderr else "")
_cmdline = " ".join(shlex.quote(c) for c in cmd)

if proc.returncode != 0:
    fail("ies2rad failed.\nCommand:\n{}\n\nLog:\n{}".format(_cmdline, _log))


after = set(os.listdir(out_dir))
new = list(after - before)


_rad_files = [os.path.join(out_dir, f) for f in new if f.lower().endswith(".rad")]
_dat_files = [os.path.join(out_dir, f) for f in new if f.lower().endswith(".dat")]


if not _rad_files:
    _rad_files = glob.glob(os.path.join(out_dir, stem + "*.rad"))
if not _dat_files:
    _dat_files = glob.glob(os.path.join(out_dir, stem + "*.dat"))
# ---------- end python_3_script_2 ----------
python_3_script_3 = Python3Script(ies_path="C:\RadIES\area-light.ies", out_dir=panel_17, name="ies_test")  # -> out, rad_files, dat_files, cmdline, log; disabled
# ---------- python_3_script_3: Python ----------
"""IES → Radiance converter using ies2rad

Requires Radiance installed. On Windows, make sure ies2rad.exe is on PATH
or pass its folder via 'radiance_bin'.

Inputs:
    ies_path: str - path to .ies
    out_dir: str - output directory
    name: str|None - base name for output (optional)
    multiplier: float|None - ies2rad -m
    rgb: str|None - e.g. "1,1,1" for ies2rad -c r g b
    radiance_bin: str|None - directory containing ies2rad(.exe)
Outputs:
    _rad_files: list[str]
    _dat_files: list[str]
    _cmdline: str
    _log: str
"""

import os, shlex, subprocess, time, glob


def fail(msg):
    raise ValueError(msg)

if not ies_path or not os.path.isfile(ies_path):
    fail("Provide a valid IES file path for 'ies_path'.")

out_dir = out_dir or os.path.join(os.path.expanduser("~"), "radiance_out")
if not os.path.isdir(out_dir):
    os.makedirs(out_dir)


exe = "ies2rad.exe" if os.name == "nt" else "ies2rad"
ies2rad_path = exe 
if radiance_bin:
    cand = os.path.join(radiance_bin, exe)
    if os.path.isfile(cand):
        ies2rad_path = cand


try:
    subprocess.run([ies2rad_path, "-?"],
                   stdout=subprocess.PIPE, stderr=subprocess.PIPE, check=False)
except Exception as e:
    fail("Could not execute ies2rad. Ensure Radiance is installed and ies2rad is on PATH or provide 'radiance_bin'.")


stem = name.strip() if name else os.path.splitext(os.path.basename(ies_path))[0]
cmd = [ies2rad_path, "-o", stem]  


if isinstance(multiplier, (int, float)) and multiplier not in (None, 0):
    cmd += ["-m", str(float(multiplier))]


if rgb:
    try:
        r, g, b = [str(float(x)) for x in rgb.split(",")]
        cmd += ["-c", r, g, b]
    except:
        fail("rgb must be like '1,1,1' (three numbers).")



cmd += [ies_path]


before = set(os.listdir(out_dir))


proc = subprocess.run(cmd, cwd=out_dir,
                      stdout=subprocess.PIPE, stderr=subprocess.PIPE, text=True)
_log = (proc.stdout or "") + ("\n" + proc.stderr if proc.stderr else "")
_cmdline = " ".join(shlex.quote(c) for c in cmd)

if proc.returncode != 0:
    fail("ies2rad failed.\nCommand:\n{}\n\nLog:\n{}".format(_cmdline, _log))


after = set(os.listdir(out_dir))
new = list(after - before)


_rad_files = [os.path.join(out_dir, f) for f in new if f.lower().endswith(".rad")]
_dat_files = [os.path.join(out_dir, f) for f in new if f.lower().endswith(".dat")]


if not _rad_files:
    _rad_files = glob.glob(os.path.join(out_dir, stem + "*.rad"))
if not _dat_files:
    _dat_files = glob.glob(os.path.join(out_dir, stem + "*.dat"))
# ---------- end python_3_script_3 ----------
panel_18 = Panel(python_3_script_2.log)
panel_19 = Panel(python_3_script_3.log)
panel_20 = Panel("D:\University of Wasington\04. Summer GRSA 2025\Other\lighting_test")
python_3_script_4 = Python3Script(ies_path="C:\RadIES\area-light.ies", out_dir=panel_20, name="ies_test")  # -> out, rad_files, dat_files, cmdline, log
# ---------- python_3_script_4: Python ----------
import os, shlex, subprocess, time, glob

# validate inputs
def fail(msg):
    raise ValueError(msg)

if not ies_path or not os.path.isfile(ies_path):
    fail("Provide a valid IES file path for 'ies_path'.")

out_dir = out_dir or os.path.join(os.path.expanduser("~"), "radiance_out")
if not os.path.isdir(out_dir):
    os.makedirs(out_dir)

# locate
exe = "ies2rad.exe" if os.name == "nt" else "ies2rad"
ies2rad_path = exe
if radiance_bin:
    cand = os.path.join(radiance_bin, exe)
    if os.path.isfile(cand):
        ies2rad_path = cand

# path_check
try:
    subprocess.run([ies2rad_path, "-?"],
                   stdout=subprocess.PIPE, stderr=subprocess.PIPE, check=False)
except Exception as e:
    fail("Could not execute ies2rad. Ensure Radiance is installed and ies2rad is on PATH or provide 'radiance_bin'.")

# build command
stem = name.strip() if name else os.path.splitext(os.path.basename(ies_path))[0]
cmd = [ies2rad_path, "-o", stem]

# multiplier
if isinstance(multiplier, (int, float)) and multiplier not in (None, 0):
    cmd += ["-m", str(float(multiplier))]

# rgb color
if rgb:
    try:
        r, g, b = [str(float(x)) for x in rgb.split(",")]
        cmd += ["-c", r, g, b]
    except:
        fail("rgb must be like '1,1,1' (three numbers).")


cmd += [ies_path]

# new outputs
before = set(os.listdir(out_dir))

# run
proc = subprocess.run(cmd, cwd=out_dir,
                      stdout=subprocess.PIPE, stderr=subprocess.PIPE, text=True)
_log = (proc.stdout or "") + ("\n" + proc.stderr if proc.stderr else "")
_cmdline = " ".join(shlex.quote(c) for c in cmd)

if proc.returncode != 0:
    fail("ies2rad failed.\nCommand:\n{}\n\nLog:\n{}".format(_cmdline, _log))

# detect 
after = set(os.listdir(out_dir))
new = list(after - before)

# ies2rad writes:
_rad_files = [os.path.join(out_dir, f) for f in new if f.lower().endswith(".rad")]
_dat_files = [os.path.join(out_dir, f) for f in new if f.lower().endswith(".dat")]


if not _rad_files:
    _rad_files = glob.glob(os.path.join(out_dir, stem + "*.rad"))
if not _dat_files:
    _dat_files = glob.glob(os.path.join(out_dir, stem + "*.dat"))
# ---------- end python_3_script_4 ----------
panel_21 = Panel(python_3_script_4.rad_files)

python_3_script_5 = Python3Script()  # -> out, a; disabled
# Electric Lighting (Option 01)
# lighting from scratch
python_3_script_6 = Python3Script()  # -> out, a; unedited script template

vizwiref = HBVisualizeWireframe(hb_objs=flatten(model.model))  # -> geo; plug-in component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
panel_22 = Panel(model.model)
python_3_script_7 = Python3Script()  # -> out, a
custom_preview_2 = CustomPreview(Geometry=vizwiref, Material=ColourSwatch(SwatchColor=RGB(168, 168, 168)))

# ----
# Weather Data
# Download and assign the EPW weather file for the simulation.
panel_23 = Panel("D:\University of Wasington\04. Summer GRSA 2025\Other\Weather File\USA_WA_Seattle-Tacoma.Intl_.AP_.727930_TMY3.epw")
downloadepw = LBDownloadWeather()  # -> epw_file, stat_file, ddy_file; disabled; plug-in component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
wea = HBWeaFromEPW(epw_file=panel_23)  # -> wea; plug-in component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

# ----
# Analysis Grid
# Define the sensor grid resolution and height for daylight analysis.
number_slider_2 = Slider(0.6, range=0..20)
genpts = LBGeneratePointGrid(geometry=geometry_pipeline, grid_size=number_slider_2, offset_dist=Slider(1.2, range=0..20))  # -> points, vectors, face_areas, mesh; plug-in component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
sensorgrid = HBSensorGrid(positions=genpts.points)  # -> grid; plug-in component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
panel_24 = Panel(sensorgrid)
assigngridsviews = HBAssignGridsAndViews(model=model.model, grids=flatten(sensorgrid))  # -> model; plug-in component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

panel_25 = Panel(genpts.points)
panel_26 = Panel(wea)

# ----
# Annual Daylight Simulation
# Run the annual daylight simulation using Radiance via Honeybee.
# Outputs hourly illuminance (lux) values for each sensor point.
boolean_toggle = BooleanToggle(False)
panel_28 = Panel("D:\University of Wasington\04. Summer GRSA 2025\Other\Draft_Folders\Debug_folder2")
panel_29 = Panel("D:\University of Wasington\04. Summer GRSA 2025\Other\Draft_Folders\Debug_folder2")
number_slider_3 = Slider(1, range=0..2)
radpar = HBRadianceParameter(recipe_type="annual", detail_level=number_slider_3)  # -> rad_par; plug-in component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
annualdaylight = HBAnnualDaylight(model=assigngridsviews, wea=wea, radiance_par=radpar, run=boolean_toggle)  # -> out, results, DA, cDA, UDI, UDI_low, UDI_up; plug-in component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
recipesettings = HBRecipeSettings(folder=panel_28, reload_old=Toggle(False), debug_folder=panel_29)  # -> settings; disabled; plug-in component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
annualtodata = HBAnnualResultsToData(results=flatten(annualdaylight.results), sel_pts=flatten(genpts.points), all_pts=genpts.points)  # -> out, data; plug-in component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
heatmap = LBSpatialHeatmap(values=annualdaylight.DA, mesh=genpts.mesh)  # -> mesh, legend, title, colors, legend_par, vis_set; plug-in component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
xdata = LBDeconstructData(data=annualtodata.data)  # -> header, values; plug-in component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

# ----
# Climate-based Sky
# Irradiance Input Sky option (3)
# CIE Sky option (2)
importepw = LBImportEPW(epw_file=panel_23)  # -> location; plug-in component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
# Spectral Data Selection
number_slider_4 = Slider(2, range=0..10)
# Honeybee Point In Time
# Honeybee Point-In-Time for cross check
number_slider_5 = Slider(9, range=0..100)
number_slider_6 = Slider(21, range=0..100)
number_slider_7 = Slider(12, range=0..100)
ciesky = HBCIEStandardSky(location=importepw, month=number_slider_5, day=number_slider_6, hour=number_slider_7, type=number_slider_4)  # -> sky; plug-in component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
radpar_2 = HBRadianceParameter(recipe_type=Slider(0, range=0..100), detail_level=Slider(1, range=0..1))  # -> rad_par; plug-in component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
climatebased = HBClimatebasedSky(wea=wea, month=number_slider_5, day=number_slider_6, hour=number_slider_7)  # -> sky; plug-in component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
recipesettings_2 = HBRecipeSettings(folder="C:\radiance_folders\pit_folder1", reload_old=Toggle(False), debug_folder="C:\radiance_folders\pit_debug_folder1")  # -> settings; plug-in component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
dir_rad = _dir_rad(474)
diff_rad = _diff_rad(221.5)
customsky = HBCustomSky(location=importepw, dir_rad=dir_rad, diff_rad=diff_rad, month=number_slider_5, day=number_slider_6, hour=number_slider_7)  # -> sky; plug-in component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
pitgrid = HBPointInTimeGridBased(
    model=assigngridsviews,
    sky=customsky,
    metric=Slider(0, range=0..100),
    radiance_par=radpar_2,
    run_settings=recipesettings_2,
    run=Toggle(False))  # -> out, results; plug-in component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
colrange = LBColorRange(index=Slider(2, range=0..26))  # -> colors; plug-in component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
panel_31 = Panel(customsky)
legendpar = LBLegendParameters(
    min=Slider(3000, range=0..10000),
    max=Slider(25000, range=0..120000),
    colors=colrange,
    continuous_leg=Toggle(False),
    num_decimals=Toggle(False),
    text_height=Slider(0.193, range=0..1))  # -> leg_par; plug-in component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
heatmap_2 = LBSpatialHeatmap(values=pitgrid.results, mesh=genpts.mesh, legend_par=legendpar)  # -> mesh, legend, title, colors, legend_par, vis_set; disabled; plug-in component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

radpar_3 = HBRadianceParameter(recipe_type="annual", detail_level=number_slider_3)  # -> rad_par; plug-in component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
# Annual Irradiance Simulation
# Run the annual irradiance simulation using Radiance via Honeybee.
# Outputs hourly irradiance (W/m2) values for each sensor point.
boolean_toggle_2 = BooleanToggle(False)
annualirradiance = HBAnnualIrradiance(model=assigngridsviews, wea=wea, visible=boolean_toggle_2, radiance_par=radpar_3, run=Toggle(False))  # -> out, results, res_direct, avg_irr, peak_irr, radiation; plug-in component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
panel_32 = Panel(annualirradiance.results)
daylightmetrics = HBAnnualDaylightMetrics(results=flatten(annualirradiance.results))  # -> out, DA, cDA, UDI, UDI_low, UDI_up; disabled; plug-in component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
heatmap_3 = LBSpatialHeatmap(values=daylightmetrics.UDI)  # -> mesh, legend, title, colors, legend_par, vis_set; disabled; plug-in component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
annualtodata_2 = HBAnnualResultsToData(results=flatten(annualirradiance.results))  # -> out, data; disabled; plug-in component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
xdata_2 = LBDeconstructData(data=annualtodata_2.data)  # -> header, values; disabled; plug-in component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

# ----
# Spectral data to get factor of conversion
# Select Conversion Factors
# Load Spectral Data
# Updated_Select Conversion Factors
panel_33 = Panel("C:\Conversion_factor_csv\conversion_factor.csv")
load_spectral_data = Python3Script(csv_file_path=panel_33, run=Button())  # -> out, conversion_factor; disabled
# ---------- load_spectral_data: Python ----------
import os
import csv
import clr

clr.AddReference("System.Windows.Forms")
clr.AddReference("System.Drawing")

from System.Windows.Forms import (
    Form, DataGridView, DockStyle, 
    DataGridViewAutoSizeColumnsMode, 
    DataGridViewCellBorderStyle, 
    DataGridViewAdvancedCellBorderStyle,
    FormStartPosition
)
from System.Drawing import Size, Color, Font, FontStyle

# Inputs
csv_path = _csv_file_path
trigger_ui = _run

# Output
_conversion_factor = -1.0

# Columns
keep_columns = ["PAR spectral", "OPN1", "D65", "Calculated PAR", "Calculated Lx", "Conversion"]
must_keep_index_0 = True

headers = []
rows = []

# Read CSV
if os.path.exists(csv_path):
    with open(csv_path, "r", encoding="utf-8-sig") as file:
        reader = csv.reader(file)
        for i, row in enumerate(reader):
            if i == 2:
                headers = row
            elif i > 2 and any(cell.strip() for cell in row):
                rows.append(row)
else:
    raise Exception("CSV file not found: " + str(csv_path))

# conversion factor
try:
    conv_idx = headers.index("Conversion")
    for row in reversed(rows):
        if conv_idx < len(row):
            try:
                val = float(row[conv_idx])
                _conversion_factor = val
                break
            except:
                continue
except:
    _conversion_factor = -1.0

# Filter
filtered_indices = [0] if must_keep_index_0 else []
for i, h in enumerate(headers):
    if h in keep_columns and i not in filtered_indices:
        filtered_indices.append(i)

filtered_headers = [headers[i] if i < len(headers) else "" for i in filtered_indices]
filtered_rows = []
for row in rows[:401]:
    row_fixed = [(row[i] if i < len(row) else "") for i in filtered_indices]
    filtered_rows.append(row_fixed)

# Show Form
if trigger_ui:
    class CSVTableForm(Form):
        def __init__(self):
            super(CSVTableForm, self).__init__()
            self.Text = "CSV Table Preview"
            self.Size = Size(1500, 850)
            self.StartPosition = FormStartPosition.CenterScreen
            self.BackColor = Color.White

            grid = DataGridView()
            grid.Dock = DockStyle.Fill
            grid.AutoSizeColumnsMode = DataGridViewAutoSizeColumnsMode.Fill
            grid.BackgroundColor = Color.White
            grid.AllowUserToResizeRows = False
            grid.RowHeadersVisible = False
            grid.AutoSizeColumnsMode = DataGridViewAutoSizeColumnsMode.Fill
            grid.BackgroundColor = Color.White
            grid.ColumnHeadersDefaultCellStyle.Font = Font("Segoe UI", 10, FontStyle.Bold)
            grid.CellBorderStyle = DataGridViewCellBorderStyle.SingleHorizontal
            grid.GridColor = Color.LightGray

            grid.ColumnCount = len(filtered_headers)
            for i, header in enumerate(filtered_headers):
                grid.Columns[i].Name = header

            for row in filtered_rows:
                grid.Rows.Add(row)

            self.Controls.Add(grid)

    form = CSVTableForm()
    form.ShowDialog()
# ---------- end load_spectral_data ----------
conversion_factors = Python3Script(run=Toggle(True))  # -> out, conversion_factor; disabled
# ---------- conversion_factors: Python ----------
import os
import csv
from System.Windows.Forms import (
    Form, Button, Label, Panel, TextBox, OpenFileDialog,
    DataGridView, DockStyle, DialogResult,
    FlowLayoutPanel, Padding, FlowDirection
)
from System.Drawing import Point, Size, Color

# VARIABLES
_conversion_factor = None

class LightingUI(Form):
    def __init__(self):
        Form.__init__(self)
        self.Text = "Lighting Options"
        self.StartPosition = self.StartPosition.CenterScreen
        self.BackColor = Color.White
        self.MinimumSize = Size(600, 400)
        self.Size = Size(800, 600)

        self.selected_source = None
        self.custom_factor_value = None

        # Button panel
        self.button_panel = FlowLayoutPanel()
        self.button_panel.Dock = DockStyle.Top
        self.button_panel.Height = 300
        self.button_panel.FlowDirection = FlowDirection.TopDown
        self.button_panel.WrapContents = False
        self.button_panel.AutoScroll = True
        self.Controls.Add(self.button_panel)

        # Content panel
        self.content_panel = Panel()
        self.content_panel.BackColor = Color.LightGray
        self.content_panel.Dock = DockStyle.Fill
        self.Controls.Add(self.content_panel)

        # Select button
        self.select_button = Button()
        self.select_button.Text = "Select"
        self.select_button.Height = 40
        self.select_button.Dock = DockStyle.Bottom
        self.select_button.Click += self.return_conversion_factor
        self.Controls.Add(self.select_button)

        # Button actions
        self.buttons = [
            ("D65", self.show_d65_csv),
            ("Electric Lighting", self.show_lighting_info),
            ("Factor = 0.0185", self.show_factor),
            ("Custom File", self.load_custom_csv),
            ("Custom Factor", self.custom_factor_input)
        ]

        self.create_buttons()
        self.Resize += self.update_button_widths

    def create_buttons(self):
        for text, callback in self.buttons:
            btn = Button()
            btn.Text = text
            btn.Height = 50
            btn.Margin = Padding(10, 5, 10, 5)
            btn.Click += lambda sender, e, cb=callback: cb(sender, e)
            self.button_panel.Controls.Add(btn)
        self.update_button_widths()

    def update_button_widths(self, sender=None, e=None):
        width = self.button_panel.ClientSize.Width - 20
        for btn in self.button_panel.Controls:
            btn.Width = width

    def clear_content(self):
        for control in self.content_panel.Controls:
            control.Dispose()
        self.content_panel.Controls.Clear()

    def show_d65_csv(self, sender, e):
        print("Reading file...")
        self.clear_content()
        self.selected_source = "D65"
        self.d65_factor = None

        path = r"C:\Conversion_factor_csv\conversion_factor.csv"
        if not os.path.exists(path):
            lbl = Label()
            lbl.Text = "File not found: " + path
            lbl.Location = Point(10, 10)
            lbl.AutoSize = True
            self.content_panel.Controls.Add(lbl)
            return

        try:
            with open(path, "r", encoding="utf-8-sig") as file:
                reader = csv.reader(file)
                rows = list(reader)

            print("Total rows read:", len(rows))
            if len(rows) < 4:
                raise Exception("Not enough rows in CSV.")

            for i, row in enumerate(rows[:5]):
                print("Row", i, ":", row)

            total_cols = max(len(row) for row in rows)
            keep_indices = [i for i in range(total_cols) if i < 1 or i > 7]
            raw_headers = rows[2] if len(rows) > 2 else []
            headers = [raw_headers[i] if i < len(raw_headers) else "" for i in keep_indices]

            data_rows = []
            count = 0
            for row in rows[3:]:
                if any(cell.strip() for cell in row):
                    filtered = [row[i] if i < len(row) else "" for i in keep_indices]
                    data_rows.append(filtered)
                    count += 1
                    if count >= 10:
                        break

            print("Calling display_table with", len(data_rows), "rows")
            self.display_table(headers, data_rows, scroll_x=True)

            # Extract D65
            for row in rows:
                if len(row) > 13 and row[0].strip() == "385":
                    try:
                        self.d65_factor = float(row[13])
                    except:
                        self.d65_factor = 0.0185
                    break

            if self.d65_factor is None:
                self.d65_factor = 0.0185

        except Exception as ex:
            lbl = Label()
            lbl.Text = "Error reading CSV: " + str(ex)
            lbl.Location = Point(10, 10)
            lbl.AutoSize = True
            self.content_panel.Controls.Add(lbl)

    def show_lighting_info(self, sender, e):
        self.clear_content()
        self.selected_source = "Electric"
        headers = ["Type", "Wattage", "Lumens", "Color Temp"]
        data = [["T8", "32W", "2900", "4100K"]]
        self.display_table(headers, data)

    def show_factor(self, sender, e):
        self.clear_content()
        self.selected_source = "FixedFactor"
        lbl = Label()
        lbl.Text = "Conversion Factor: 0.0185"
        lbl.Location = Point(10, 10)
        lbl.AutoSize = True
        self.content_panel.Controls.Add(lbl)

    def load_custom_csv(self, sender, e):
        self.clear_content()
        self.selected_source = "CustomCSV"
        dialog = OpenFileDialog()
        dialog.Filter = "CSV Files (*.csv)|*.csv"
        if dialog.ShowDialog() == DialogResult.OK:
            self.display_csv(dialog.FileName)

    def custom_factor_input(self, sender, e):
        self.clear_content()
        self.selected_source = "CustomFactor"

        lbl = Label()
        lbl.Text = "Enter custom conversion factor:"
        lbl.Location = Point(10, 10)
        lbl.AutoSize = True
        self.content_panel.Controls.Add(lbl)

        self.custom_input = TextBox()
        self.custom_input.Location = Point(10, 40)
        self.custom_input.Width = 200
        self.content_panel.Controls.Add(self.custom_input)

    def display_csv(self, path):
        try:
            with open(path, "r") as file:
                reader = csv.reader(file)
                headers = next(reader)
                first_rows = [next(reader, []) for _ in range(3)]
            self.display_table(headers, first_rows)
        except Exception as ex:
            lbl = Label()
            lbl.Text = "Error loading CSV: " + str(ex)
            lbl.Location = Point(10, 10)
            lbl.AutoSize = True
            self.content_panel.Controls.Add(lbl)

    def display_table(self, headers, rows, scroll_x=False):
        from System.Windows.Forms import DataGridView, DataGridViewAutoSizeColumnsMode, ScrollBars

        grid = DataGridView()
        grid.Dock = DockStyle.Fill
        grid.ColumnCount = len(headers)
        grid.RowHeadersVisible = False

        for i, header in enumerate(headers):
            grid.Columns[i].Name = header

        for row in rows:
            if row:
                row_fixed = (row + [""] * len(headers))[:len(headers)]
                grid.Rows.Add(row_fixed)

        if scroll_x:
            grid.AutoSizeColumnsMode = DataGridViewAutoSizeColumnsMode.NotSet
            for i in range(grid.ColumnCount):
                grid.Columns[i].Width = 100
            grid.ScrollBars = ScrollBars.Both
        else:
            grid.AutoSizeColumnsMode = DataGridViewAutoSizeColumnsMode.Fill

        self.content_panel.SuspendLayout()
        self.content_panel.Controls.Clear()
        self.content_panel.Controls.Add(grid)
        grid.Height = 300
        grid.BringToFront()
        self.content_panel.ResumeLayout()
        self.content_panel.Refresh()

    def return_conversion_factor(self, sender, e):
        global _conversion_factor
        if self.selected_source == "CustomFactor":
            try:
                val = float(self.custom_input.Text)
                _conversion_factor = val
            except:
                _conversion_factor = None
        elif self.selected_source == "D65":
            _conversion_factor = getattr(self, 'd65_factor', 0.0185)
        else:
            _conversion_factor = 0.0185
        self.Close()


# LAUNCH UI
form = LightingUI()
form.ShowDialog()
# ---------- end conversion_factors ----------
python_3_script_8 = Python3Script(run=Button())  # -> out, conversion_factor; disabled
# ---------- python_3_script_8: Python ----------
import os, csv
from System.Windows.Forms import (
    Application, Form, Panel, Label, Button, TextBox, OpenFileDialog, LinkArea,  
    FlowLayoutPanel, DockStyle, DialogResult, Padding, FlowDirection,
    FormStartPosition, Screen, AutoScaleMode, LinkLabel
)
from System.Drawing import Size, Point, Color, SizeF
try:
    _LAST_FACTOR
    _LAST_LABEL
except NameError:
    _LAST_FACTOR = None
    _LAST_LABEL  = None


# constants
STANDARD_SOURCES = [
    ("CIE-D55",     0.017833),
    ("CIE-D65",     0.018043),
    ("CIE-D75",     0.018345),
    ("CIE-HPS-1",   0.011640),
    ("CIE-HPS-5",   0.016180),
    ("CIE-LED-BH1", 0.013633),
    ("CIE-LED-V2",  0.017691)
]

DEFAULT_FACTOR = 0.018043

# UI
class ConversionFactorUI(Form):
    def __init__(self, last_factor=None, last_label=None):
        Form.__init__(self)
        self.SuspendLayout()
        self.AutoScaleMode = AutoScaleMode.Dpi
        self.AutoScaleDimensions = SizeF(96.0, 96.0)
        self.ClientSize = Size(740, 540)
        self.MinimumSize = Size(560, 420)
          


        self.Text = "Select Conversion Factor"
        self.StartPosition = FormStartPosition.CenterScreen
        self.BackColor = Color.White
        # self.MinimumSize = Size(560, 420)
        # self.Size = Size(740, 540)

        self.selected_label = last_label
        self.selected_factor = last_factor if last_factor is not None else DEFAULT_FACTOR

        # Header
        self.header = LinkLabel()
        self.header.Text = "Choose a source for the illuminance→PAR conversion factor"
        self.header.AutoSize = True
        self.header.Dock = DockStyle.Top
        self.header.Padding = Padding(10, 10, 10, 0)
        self.header.LinkArea = LinkArea(0, 0)   # <- now valid, renders like plain text
        self.Controls.Add(self.header)

        # Wrapper
        self.wrapper = FlowLayoutPanel()
        self.wrapper.Dock = DockStyle.Fill
        self.wrapper.FlowDirection = FlowDirection.TopDown
        self.wrapper.WrapContents = False
        self.wrapper.AutoScroll = True
        self.wrapper.Padding = Padding(10, 5, 10, 10)
        self.Controls.Add(self.wrapper)

        # Sources group
        self.add_group_title("Standard Sources")
        self.std_panel = FlowLayoutPanel()
        self.std_panel.FlowDirection = FlowDirection.TopDown
        self.std_panel.WrapContents = False
        self.std_panel.Width = self.ClientSize.Width - 40
        self.std_panel.AutoSize = True
        self.wrapper.Controls.Add(self.std_panel)

        for name, val in STANDARD_SOURCES:
            btn = Button()
            btn.Text = f"{name}   =   {val:.6f}"
            btn.Height = 44
            btn.Width = self.std_panel.Width - 20
            btn.Margin = Padding(5, 4, 5, 4)
            btn.Tag = (name, val)
            btn.Click += self.pick_standard
            self.std_panel.Controls.Add(btn)

        # Spectra group
        self.add_group_title("Custom Spectra (CSV)")
        self.custom_panel = FlowLayoutPanel()
        self.custom_panel.FlowDirection = FlowDirection.TopDown
        self.custom_panel.WrapContents = False
        self.custom_panel.Width = self.ClientSize.Width - 40
        self.custom_panel.AutoSize = True
        self.wrapper.Controls.Add(self.custom_panel)
        self.wrapper.AutoScrollMinSize = Size(0, 1)

        self.custom_hint = Label()
        self.custom_hint.Text = (
            "Load a CSV and enter the factor you want to use.\n"
            "Tip: if your CSV contains the factor, open it to view, then paste the value here."
        )
        self.custom_hint.AutoSize = True
        self.custom_hint.Margin = Padding(5, 0, 5, 6)
        self.custom_panel.Controls.Add(self.custom_hint)

        self.open_btn = Button()
        self.open_btn.Text = "Open CSV…"
        self.open_btn.Height = 40
        self.open_btn.Width = self.custom_panel.Width - 20
        self.open_btn.Click += self.open_csv
        self.custom_panel.Controls.Add(self.open_btn)

        self.factor_row = FlowLayoutPanel()
        self.factor_row.FlowDirection = FlowDirection.LeftToRight
        self.factor_row.AutoSize = True
        self.factor_row.Margin = Padding(5, 6, 5, 6)
        self.custom_panel.Controls.Add(self.factor_row)

        self.factor_lbl = Label()
        self.factor_lbl.Text = "Factor:"
        self.factor_lbl.Width = 60
        self.factor_lbl.AutoSize = False
        self.factor_row.Controls.Add(self.factor_lbl)

        self.factor_box = TextBox()
        self.factor_box.Width = 140
        self.factor_box.Text = f"{self.selected_factor:.6f}"
        self.factor_row.Controls.Add(self.factor_box)

        self.use_custom_btn = Button()
        self.use_custom_btn.Text = "Use this factor"
        self.use_custom_btn.Height = 32
        self.use_custom_btn.Click += self.use_custom
        self.factor_row.Controls.Add(self.use_custom_btn)

        # Footer
        self.selection_lbl = Label()
        self.selection_lbl.AutoSize = True
        self.selection_lbl.Padding = Padding(10, 6, 10, 6)
        self.update_selection_label()
        self.wrapper.Controls.Add(self.selection_lbl)

        self.ok_btn = Button()
        self.ok_btn.Text = "Set Factor and Close"
        self.ok_btn.Height = 44
        self.ok_btn.Width = self.ClientSize.Width - 40
        self.ok_btn.Margin = Padding(5, 8, 5, 10)
        self.ok_btn.Click += self.confirm_and_close
        self.wrapper.Controls.Add(self.ok_btn)

        # resize buttons
        self.Resize += self.resize_fullwidth
        self.Resize += self.fit_header_width

        # finalize initial layout
        self.fit_header_width()
        self.resize_fullwidth(None, None)
        self.ResumeLayout(False)
        self.PerformLayout()
        self.Shown += lambda *_: self.CenterToScreen()
        self.Shown += lambda *_: self.Invalidate(True)


    def fit_header_width(self, *args):
        w = max(200, self.ClientSize.Width - 20)
        self.header.MaximumSize = Size(w, 0)

    # helpers
    def add_group_title(self, text):
        lbl = Label()
        lbl.Text = text
        lbl.AutoSize = True
        lbl.Font = lbl.Font
        lbl.Padding = Padding(5, 10, 5, 6)
        self.wrapper.Controls.Add(lbl)

    def resize_fullwidth(self, s, e):
        width = self.ClientSize.Width - 40
        for pnl in (self.std_panel, self.custom_panel):
            pnl.Width = width
            for c in pnl.Controls:
                if isinstance(c, Button) and c is not self.use_custom_btn:
                    c.Width = width - 20
        self.ok_btn.Width = width
        # header wrapped
        self.fit_header_width()

    def update_selection_label(self):
        name = self.selected_label if self.selected_label else "Selected"
        self.selection_lbl.Text = f"{name}:  {self.selected_factor:.6f}"

    # events
    def pick_standard(self, sender, e):
        name, val = sender.Tag
        self.selected_label = name
        self.selected_factor = float(val)
        self.factor_box.Text = f"{self.selected_factor:.6f}"
        self.update_selection_label()

    def open_csv(self, sender, e):
        dlg = OpenFileDialog()
        dlg.Filter = "CSV files (*.csv)|*.csv|All files (*.*)|*.*"
        if dlg.ShowDialog() == DialogResult.OK:
            try:
                with open(dlg.FileName, "r", encoding="utf-8-sig") as f:
                    r = csv.reader(f)
                    first = next(r, [])
                    second = next(r, [])
                print("CSV preview:", first)
                print("CSV preview:", second)
            except Exception as ex:
                print("CSV read error:", ex)
            self.selected_label = os.path.basename(dlg.FileName)
            self.update_selection_label()

    def use_custom(self, sender, e):
        try:
            val = float(self.factor_box.Text)
            self.selected_factor = val
            self.selected_label = "Custom (CSV)"
            self.update_selection_label()
        except:
            pass

    def confirm_and_close(self, sender, e):
        self.DialogResult = DialogResult.OK
        self.Close()

# launcher
_conversion_factor = _LAST_FACTOR if _LAST_FACTOR is not None else None

if _run:
    ui = ConversionFactorUI(last_factor=_LAST_FACTOR, last_label=_LAST_LABEL)
    res = ui.ShowDialog()
    if res == DialogResult.OK:
        _conversion_factor = ui.selected_factor
        _LAST_FACTOR = ui.selected_factor
        _LAST_LABEL  = ui.selected_label
else:
    _conversion_factor = _LAST_FACTOR
# ---------- end python_3_script_8 ----------
python_3_script_9 = Python3Script(run=Button())  # -> out, conversion_factor
# ---------- python_3_script_9: Python ----------
import os, csv
from System.Windows.Forms import (
    Application, Form, Panel, Label, Button, TextBox, OpenFileDialog,
    FlowLayoutPanel, DockStyle, DialogResult, Padding, FlowDirection
)
from System.Drawing import Size, Point, Color
try:
    _LAST_FACTOR
    _LAST_LABEL
except NameError:
    _LAST_FACTOR = None
    _LAST_LABEL  = None


# constants
STANDARD_SOURCES = [
    ("CIE-D55",     0.017833),
    ("CIE-D65",     0.018043),
    ("CIE-D75",     0.018345),
    ("CIE-HPS-1",   0.011640),
    ("CIE-HPS-5",   0.016180),
    ("CIE-LED-BH1", 0.013633),
    ("CIE-LED-V2",  0.017691)
]

DEFAULT_FACTOR = 0.018043

# UI
class ConversionFactorUI(Form):
    def __init__(self, last_factor=None, last_label=None):
        Form.__init__(self)
        self.Text = "Select Conversion Factor"
        self.StartPosition = self.StartPosition.CenterScreen
        self.BackColor = Color.White
        self.MinimumSize = Size(560, 420)
        self.Size = Size(720, 520)

        self.selected_label = last_label
        self.selected_factor = last_factor if last_factor is not None else DEFAULT_FACTOR

        # Header
        self.header = Label()
        self.header.Text = "Choose a source for the illuminance→PAR conversion factor"
        self.header.AutoSize = False
        self.header.Height = 32
        self.header.Dock = DockStyle.Top
        self.header.Padding = Padding(10, 10, 10, 0)
        self.Controls.Add(self.header)

        # Wrapper
        self.wrapper = FlowLayoutPanel()
        self.wrapper.Dock = DockStyle.Fill
        self.wrapper.FlowDirection = FlowDirection.TopDown
        self.wrapper.WrapContents = False
        self.wrapper.AutoScroll = True
        self.wrapper.Padding = Padding(10, 5, 10, 10)
        self.Controls.Add(self.wrapper)

        # Sources group
        self.add_group_title("Standard Sources")
        self.std_panel = FlowLayoutPanel()
        self.std_panel.FlowDirection = FlowDirection.TopDown
        self.std_panel.WrapContents = False
        self.std_panel.Width = self.ClientSize.Width - 40
        self.std_panel.AutoSize = True
        self.wrapper.Controls.Add(self.std_panel)

        for name, val in STANDARD_SOURCES:
            btn = Button()
            btn.Text = f"{name}   =   {val:.6f}"
            btn.Height = 44
            btn.Width = self.std_panel.Width - 20
            btn.Margin = Padding(5, 4, 5, 4)
            btn.Tag = (name, val)
            btn.Click += self.pick_standard
            self.std_panel.Controls.Add(btn)

        # Spectra group
        self.add_group_title("Custom Spectra (CSV)")
        self.custom_panel = FlowLayoutPanel()
        self.custom_panel.FlowDirection = FlowDirection.TopDown
        self.custom_panel.WrapContents = False
        self.custom_panel.Width = self.ClientSize.Width - 40
        self.custom_panel.AutoSize = True
        self.wrapper.Controls.Add(self.custom_panel)

        self.custom_hint = Label()
        self.custom_hint.Text = (
            "Load a CSV and enter the factor you want to use.\n"
            "Tip: if your CSV contains the factor, open it to view, then paste the value here."
        )
        self.custom_hint.AutoSize = True
        self.custom_hint.Margin = Padding(5, 0, 5, 6)
        self.custom_panel.Controls.Add(self.custom_hint)

        self.open_btn = Button()
        self.open_btn.Text = "Open CSV…"
        self.open_btn.Height = 40
        self.open_btn.Width = self.custom_panel.Width - 20
        self.open_btn.Click += self.open_csv
        self.custom_panel.Controls.Add(self.open_btn)

        self.factor_row = FlowLayoutPanel()
        self.factor_row.FlowDirection = FlowDirection.LeftToRight
        self.factor_row.AutoSize = True
        self.factor_row.Margin = Padding(5, 6, 5, 6)
        self.custom_panel.Controls.Add(self.factor_row)

        self.factor_lbl = Label()
        self.factor_lbl.Text = "Factor:"
        self.factor_lbl.Width = 60
        self.factor_lbl.AutoSize = False
        self.factor_row.Controls.Add(self.factor_lbl)

        self.factor_box = TextBox()
        self.factor_box.Width = 140
        self.factor_box.Text = f"{self.selected_factor:.6f}"
        self.factor_row.Controls.Add(self.factor_box)

        self.use_custom_btn = Button()
        self.use_custom_btn.Text = "Use this factor"
        self.use_custom_btn.Height = 32
        self.use_custom_btn.Click += self.use_custom
        self.factor_row.Controls.Add(self.use_custom_btn)

        # Footer
        self.selection_lbl = Label()
        self.selection_lbl.AutoSize = True
        self.selection_lbl.Padding = Padding(10, 6, 10, 6)
        self.update_selection_label()
        self.wrapper.Controls.Add(self.selection_lbl)

        self.ok_btn = Button()
        self.ok_btn.Text = "Set Factor and Close"
        self.ok_btn.Height = 44
        self.ok_btn.Width = self.ClientSize.Width - 40
        self.ok_btn.Margin = Padding(5, 8, 5, 10)
        self.ok_btn.Click += self.confirm_and_close
        self.wrapper.Controls.Add(self.ok_btn)

        # resize buttons
        self.Resize += self.resize_fullwidth

    # helpers
    def add_group_title(self, text):
        lbl = Label()
        lbl.Text = text
        lbl.AutoSize = True
        lbl.Font = lbl.Font
        lbl.Padding = Padding(5, 10, 5, 6)
        self.wrapper.Controls.Add(lbl)

    def resize_fullwidth(self, s, e):
        width = self.ClientSize.Width - 40
        for pnl in (self.std_panel, self.custom_panel):
            pnl.Width = width
            for c in pnl.Controls:
                if isinstance(c, Button) and c is not self.use_custom_btn:
                    c.Width = width - 20
        self.ok_btn.Width = width

    def update_selection_label(self):
        name = self.selected_label if self.selected_label else "Selected"
        self.selection_lbl.Text = f"{name}:  {self.selected_factor:.6f}"

    # events
    def pick_standard(self, sender, e):
        name, val = sender.Tag
        self.selected_label = name
        self.selected_factor = float(val)
        self.factor_box.Text = f"{self.selected_factor:.6f}"
        self.update_selection_label()

    def open_csv(self, sender, e):
        dlg = OpenFileDialog()
        dlg.Filter = "CSV files (*.csv)|*.csv|All files (*.*)|*.*"
        if dlg.ShowDialog() == DialogResult.OK:
            try:
                with open(dlg.FileName, "r", encoding="utf-8-sig") as f:
                    r = csv.reader(f)
                    first = next(r, [])
                    second = next(r, [])
                print("CSV preview:", first)
                print("CSV preview:", second)
            except Exception as ex:
                print("CSV read error:", ex)
            self.selected_label = os.path.basename(dlg.FileName)
            self.update_selection_label()

    def use_custom(self, sender, e):
        try:
            val = float(self.factor_box.Text)
            self.selected_factor = val
            self.selected_label = "Custom (CSV)"
            self.update_selection_label()
        except:
            pass

    def confirm_and_close(self, sender, e):
        self.DialogResult = DialogResult.OK
        self.Close()

# launcher
_conversion_factor = _LAST_FACTOR if _LAST_FACTOR is not None else None

if _run:
    ui = ConversionFactorUI(last_factor=_LAST_FACTOR, last_label=_LAST_LABEL)
    res = ui.ShowDialog()
    if res == DialogResult.OK:
        _conversion_factor = ui.selected_factor
        _LAST_FACTOR = ui.selected_factor
        _LAST_LABEL  = ui.selected_label
else:
    _conversion_factor = _LAST_FACTOR
# ---------- end python_3_script_9 ----------
python_3_script_10 = Python3Script(run=Button())  # -> out, conversion_factor
# ---------- python_3_script_10: Python ----------
import os, csv
from System.Windows.Forms import (
    Form, Button, Label, TextBox, OpenFileDialog,
    FlowLayoutPanel, DockStyle, DialogResult, Padding, FlowDirection,
    FormStartPosition, AutoScaleMode, LinkLabel, LinkArea
)
from System.Drawing import Size, Color, SizeF


try:
    _LAST_FACTOR
    _LAST_LABEL
except NameError:
    _LAST_FACTOR = None
    _LAST_LABEL  = None


# Constants
STANDARD_SOURCES = [
    ("CIE-D55",     0.017833),
    ("CIE-D65",     0.018043),
    ("CIE-D75",     0.018345),
    ("CIE-HPS-1",   0.011640),
    ("CIE-HPS-5",   0.016180),
    ("CIE-LED-BH1", 0.013633),
    ("CIE-LED-V2",  0.017691)
]
DEFAULT_FACTOR = 0.018043


# UI
class ConversionFactorUI(Form):
    def __init__(self, last_factor=None, last_label=None):
        Form.__init__(self)


        self.SuspendLayout()
        self.AutoScaleMode = AutoScaleMode.Dpi
        self.AutoScaleDimensions = SizeF(96.0, 96.0)
        self.ClientSize = Size(560, 680)
        self.MinimumSize = Size(560, 420)
        self.StartPosition = FormStartPosition.CenterScreen
        self.Text = "Select Conversion Factor"
        self.BackColor = Color.White

        self.selected_label  = last_label
        self.selected_factor = last_factor if last_factor is not None else DEFAULT_FACTOR

        # Header
        self.header = LinkLabel()
        self.header.Text = "Choose a source for the illuminance to PAR conversion factor"
        self.header.AutoSize = True
        self.header.Dock = DockStyle.Top
        self.header.Padding = Padding(10, 10, 10, 0)
        self.header.LinkArea = LinkArea(0, 0) 
        self.Controls.Add(self.header)

        # Main wrapper
        self.wrapper = FlowLayoutPanel()
        self.wrapper.Dock = DockStyle.Fill
        self.wrapper.FlowDirection = FlowDirection.TopDown
        self.wrapper.WrapContents = False
        self.wrapper.AutoScroll = True

        self.wrapper.Padding = Padding(10, 5, 10, 10)
        self.Controls.Add(self.wrapper)

        # Standard Sources
        self.add_group_title("Standard Sources")
        self.std_panel = FlowLayoutPanel()
        self.std_panel.FlowDirection = FlowDirection.TopDown
        self.std_panel.WrapContents = False
        self.std_panel.AutoSize = True
        self.wrapper.Controls.Add(self.std_panel)

        for name, val in STANDARD_SOURCES:
            btn = Button()
            btn.Text = f"{name}   =   {val:.6f}"
            btn.Height = 44

            btn.Margin = Padding(5, 4, 5, 4) 
            btn.Tag = (name, val)
            btn.Click += self.pick_standard
            self.std_panel.Controls.Add(btn)

        # Custom Spectra (CSV) 
        self.add_group_title("Custom Spectra (CSV)")
        self.custom_panel = FlowLayoutPanel()
        self.custom_panel.FlowDirection = FlowDirection.TopDown
        self.custom_panel.WrapContents = False
        self.custom_panel.AutoSize = True
        self.wrapper.Controls.Add(self.custom_panel)

        self.custom_hint = Label()
        self.custom_hint.Text = (
            "Load a CSV or enter the conversion factor.\n"
            "Tip: if the CSV contains the pre calculated factor, open it to view and then paste the value here."
        )
        self.custom_hint.AutoSize = True
        self.custom_hint.Margin = Padding(5, 0, 5, 6)
        self.custom_panel.Controls.Add(self.custom_hint)

        self.open_btn = Button()
        self.open_btn.Text = "Open CSV…"
        self.open_btn.Height = 40
        # width
        self.open_btn.Click += self.open_csv
        self.custom_panel.Controls.Add(self.open_btn)

        self.factor_row = FlowLayoutPanel()
        self.factor_row.FlowDirection = FlowDirection.LeftToRight
        self.factor_row.AutoSize = True
        self.factor_row.Margin = Padding(5, 6, 5, 6)
        self.custom_panel.Controls.Add(self.factor_row)

        self.factor_lbl = Label()
        self.factor_lbl.Text = "Factor:"
        self.factor_lbl.Width = 60
        self.factor_lbl.AutoSize = False
        self.factor_row.Controls.Add(self.factor_lbl)

        self.factor_box = TextBox()
        self.factor_box.Width = 140
        self.factor_box.Text = f"{self.selected_factor:.6f}"
        self.factor_row.Controls.Add(self.factor_box)

        self.use_custom_btn = Button()
        self.use_custom_btn.Text = "Use this factor"
        self.use_custom_btn.Height = 22
        self.use_custom_btn.Width = 150
        self.use_custom_btn.Click += self.use_custom
        self.factor_row.Controls.Add(self.use_custom_btn)

        # Footer
        self.selection_lbl = Label()
        self.selection_lbl.AutoSize = True
        self.selection_lbl.Padding = Padding(10, 6, 10, 6)
        self.update_selection_label()
        self.wrapper.Controls.Add(self.selection_lbl)

        self.ok_btn = Button()
        self.ok_btn.Text = "Set Factor and Close"
        self.ok_btn.Height = 44
        # width
        self.ok_btn.Margin = Padding(5, 8, 5, 10)
        self.ok_btn.Click += self.confirm_and_close
        self.wrapper.Controls.Add(self.ok_btn)

        # Resize
        self.Resize += self.resize_fullwidth
        self.Resize += self.fit_header_width

        self.wrapper.SizeChanged += self.resize_fullwidth

        # layout
        self.fit_header_width()
        self.resize_fullwidth(None, None)
        self.ResumeLayout(False)
        self.PerformLayout()
        self.Shown += lambda *_: (self.CenterToScreen(), self.Invalidate(True))

    # sizing
    def usable_wrapper_width(self):
        return max(
            100,
            self.wrapper.ClientSize.Width - (self.wrapper.Padding.Left + self.wrapper.Padding.Right)
        )

    def fit_header_width(self, *args):
        self.header.MaximumSize = Size(self.usable_wrapper_width(), 0)

    def add_group_title(self, text):
        lbl = Label()
        lbl.Text = text
        lbl.AutoSize = True
        lbl.Padding = Padding(5, 10, 5, 6)
        self.wrapper.Controls.Add(lbl)

    def resize_fullwidth(self, s, e):
        usable = self.usable_wrapper_width()

        # Panels
        for pnl in (self.std_panel, self.custom_panel):
            pnl.Width = usable
            # Buttons
            for c in pnl.Controls:
                if isinstance(c, Button) and c is not self.use_custom_btn:
                    c.Width = max(10, usable - 10)

        # Buttons
        self.open_btn.Width = max(10, usable - 10)
        self.ok_btn.Width   = usable

        # header
        self.fit_header_width()

    def update_selection_label(self):
        name = self.selected_label if self.selected_label else "Selected"
        self.selection_lbl.Text = f"{name}:  {self.selected_factor:.6f}"

    # events
    def pick_standard(self, sender, e):
        name, val = sender.Tag
        self.selected_label = name
        self.selected_factor = float(val)
        self.factor_box.Text = f"{self.selected_factor:.6f}"
        self.update_selection_label()

    def open_csv(self, sender, e):
        dlg = OpenFileDialog()
        dlg.Filter = "CSV files (*.csv)|*.csv|All files (*.*)|*.*"
        if dlg.ShowDialog() == DialogResult.OK:
            try:
                with open(dlg.FileName, "r", encoding="utf-8-sig") as f:
                    r = csv.reader(f)
                    first  = next(r, [])
                    second = next(r, [])
                print("CSV preview:", first)
                print("CSV preview:", second)
            except Exception as ex:
                print("CSV read error:", ex)
            self.selected_label = os.path.basename(dlg.FileName)
            self.update_selection_label()

    def use_custom(self, sender, e):
        try:
            val = float(self.factor_box.Text)
            self.selected_factor = val
            self.selected_label = "Custom (CSV)"
            self.update_selection_label()
        except:
            pass

    def confirm_and_close(self, sender, e):
        self.DialogResult = DialogResult.OK
        self.Close()


# Launcher
_conversion_factor = _LAST_FACTOR if _LAST_FACTOR is not None else None

if _run:
    ui  = ConversionFactorUI(last_factor=_LAST_FACTOR, last_label=_LAST_LABEL)
    res = ui.ShowDialog()
    if res == DialogResult.OK:
        _conversion_factor = ui.selected_factor
        _LAST_FACTOR = ui.selected_factor
        _LAST_LABEL  = ui.selected_label
else:
    _conversion_factor = _LAST_FACTOR
# ---------- end python_3_script_10 ----------
panel_34 = Panel(conversion_factors.conversion_factor)
panel_35 = Panel(load_spectral_data.conversion_factor)
panel_36 = Panel(python_3_script_9.conversion_factor)

# ----
# Result Folder
panel_37 = Panel(annualdaylight.results)
# 3
boolean_toggle_3 = BooleanToggle(True)
# Electric Lighting Simulation
cluster = Cluster()
# Radiance_Folder
panel_38 = Panel("C:\radiance_folders\folder8_electric_PIT")
# Positions
point = Point([<point referenced from the Rhino model> x6])
# Annual Simulation
panel_39 = Panel("C:\radiance_folders\folder9_yearly")
# Radiance Compilation
# command-line compilation to run radiance simulation from generated folder
# Radiance Folder
panel_40 = Panel("C:\radiance_folders\folder8_electric_PIT")
panel_41 = Panel("""skyfunc glow sky_glow
0
0
4 1.000 1.000 1.000 0
sky_glow source sky
0
0
4 0 0 1 180

skyfunc glow ground_glow
0
0
4 1.000 1.000 1.000 0
ground_glow source ground
0
0
4 0 0 -1 180""")
# Spectral Workflow
panel_42 = Panel("C:\radiance_folders\folder21")
panel_43 = Panel("C:\radiance_folders\folder14\spectral_data_aluminum_frames.csv")
python_3_script_11 = Python3Script(run=Button())  # -> selected_hour
# ---------- python_3_script_11: Python ----------
import clr
clr.AddReference('System.Windows.Forms')
clr.AddReference('System.Drawing')

from System.Windows.Forms import (Form, ComboBox, Label, Button, RadioButton,
                                  FormStartPosition, ComboBoxStyle)
from System.Drawing import Point, Size, Color
import scriptcontext as sc

# Static data
days_in_month = [31, 28, 31, 30, 31, 30, 31, 31, 30, 31, 30, 31]
month_names = ["January", "February", "March", "April", "May", "June",
               "July", "August", "September", "October", "November", "December"]

# Sticky keys
K_LAST_IDX   = 'kybele_hour_idx'
K_LAST_BTN   = 'kybele_btn_prev'
K_LAST_PICK  = 'kybele_last_mdh'

# Outputs 
_selected_hour = sc.sticky.get(K_LAST_IDX, None)
a = None
b = None

# Optional reset
if '_reset' in globals() and _reset:
    for k in [K_LAST_IDX, K_LAST_BTN, K_LAST_PICK]:
        if k in sc.sticky: del sc.sticky[k]
    _selected_hour = None
    a = b = None

# UI Form
class CustomCalendarForm(Form):
    def __init__(self, preset=None):
        super(CustomCalendarForm, self).__init__()
        self.Text = "Select Date and Hour"
        self.BackColor = Color.White
        self.Size = Size(480, 310)
        self.StartPosition = FormStartPosition.CenterScreen
        self.result = None

        # Month
        self.month_label = Label()
        self.month_label.Text = "Month:"
        self.month_label.Location = Point(5, 25)
        self.Controls.Add(self.month_label)

        self.month_combo = ComboBox()
        self.month_combo.Location = Point(120, 22)
        self.month_combo.Size = Size(300, 24)
        self.month_combo.DropDownStyle = ComboBoxStyle.DropDownList
        for m in month_names:
            self.month_combo.Items.Add(m)
        self.month_combo.SelectedIndex = 0
        self.month_combo.SelectedIndexChanged += self.update_days
        self.Controls.Add(self.month_combo)

        # Day
        self.day_label = Label()
        self.day_label.Text = "Day:"
        self.day_label.Location = Point(5, 65)
        self.Controls.Add(self.day_label)

        self.day_combo = ComboBox()
        self.day_combo.Location = Point(120, 62)
        self.day_combo.Size = Size(300, 24)
        self.day_combo.DropDownStyle = ComboBoxStyle.DropDownList
        self.Controls.Add(self.day_combo)
        self.update_days(None, None)

        # Hour
        self.hour_label = Label()
        self.hour_label.Text = "Hour:"
        self.hour_label.Location = Point(5, 105)
        self.Controls.Add(self.hour_label)

        self.hour_combo = ComboBox()
        self.hour_combo.Location = Point(120, 102)
        self.hour_combo.Size = Size(300, 24)
        self.hour_combo.DropDownStyle = ComboBoxStyle.DropDownList
        for i in range(1, 13):
            self.hour_combo.Items.Add(str(i))
        self.hour_combo.SelectedIndex = 0
        self.Controls.Add(self.hour_combo)

        # AM/PM
        self.am_radio = RadioButton()
        self.am_radio.Text = "AM"
        self.am_radio.Location = Point(150, 142)
        self.am_radio.Checked = True
        self.Controls.Add(self.am_radio)

        self.pm_radio = RadioButton()
        self.pm_radio.Text = "PM"
        self.pm_radio.Location = Point(300, 142)
        self.Controls.Add(self.pm_radio)

        # OK Button
        self.ok_button = Button()
        self.ok_button.Text = "OK"
        self.ok_button.Size = Size(440, 30)
        self.ok_button.Location = Point(10, 220)
        self.ok_button.Click += self.ok_clicked
        self.Controls.Add(self.ok_button)

        # Apply preset
        if preset:
            pm, pd, ph = preset
            self.month_combo.SelectedIndex = max(0, min(11, pm - 1))
            self.update_days(None, None)
            self.day_combo.SelectedIndex = max(0, min(days_in_month[pm - 1] - 1, pd - 1))
            if ph == 0:
                self.hour_combo.SelectedIndex = 11  # 12
                self.am_radio.Checked = True
            elif 1 <= ph <= 11:
                self.hour_combo.SelectedIndex = ph - 1
                self.am_radio.Checked = True
            elif ph == 12:
                self.hour_combo.SelectedIndex = 11
                self.pm_radio.Checked = True
            else:
                self.hour_combo.SelectedIndex = ph - 13
                self.pm_radio.Checked = True

    def update_days(self, sender, args):
        month_index = self.month_combo.SelectedIndex
        num_days = days_in_month[month_index]
        self.day_combo.Items.Clear()
        for d in range(1, num_days + 1):
            self.day_combo.Items.Add(str(d))
        self.day_combo.SelectedIndex = 0

    def ok_clicked(self, sender, args):
        m = self.month_combo.SelectedIndex + 1
        d = int(self.day_combo.SelectedItem)
        # Resolve to 24h
        h12 = int(self.hour_combo.SelectedItem)
        if self.pm_radio.Checked and h12 != 12:
            h24 = h12 + 12
        elif self.am_radio.Checked and h12 == 12:
            h24 = 0
        else:
            h24 = h12
        self.result = (m, d, h24)
        self.Close()

# Button
prev = sc.sticky.get(K_LAST_BTN, False)
now  = bool(_run) if '_run' in globals() else False
clicked = (not prev) and now
sc.sticky[K_LAST_BTN] = now

if clicked:
    preset = sc.sticky.get(K_LAST_PICK, None)
    form = CustomCalendarForm(preset=preset)
    form.ShowDialog()
    if form.result:
        m, d, h24 = form.result
        days_before = sum(days_in_month[:m - 1]) + (d - 1)
        offset_hour = (h24 + 23) % 24
        idx = days_before * 24 + offset_hour


        sc.sticky[K_LAST_IDX]  = idx
        sc.sticky[K_LAST_PICK] = (m, d, h24)
        _selected_hour = idx
        a, b = m, d
# ---------- end python_3_script_11 ----------
panel_44 = Panel("C:\radiance_folders\folder11_spectral_pit_glazing\glazing_mono1.dat")
panel_45 = Panel("C:\radiance_folders\folder11_spectral_pit_glazing\glazing_mono1.dat")
panel_46 = Panel("C:\radiance_folders\folder11_spectral_pit_glazing\glazing_mono2.dat")

panel_47 = Panel("C:\radiance_folders\folder6")
modeltorad = HBModelToRadFolder(model=assigngridsviews, folder=panel_40, write=Toggle(False))  # -> out, folder; plug-in component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

python_3_script_12 = Python3Script(folder=panel_40, sky_data=customsky, sky_matrix=panel_41, write_sky=Toggle(False))  # -> out, a
# ---------- python_3_script_12: Python ----------
ghenv.Component.Message = 'Kybele 1.0.0 Sky'


#sky_path
sky_path = str(_folder) + r"\sky.rad"
# print(sky_path)

sky_co_ordinates = str(_sky_data).strip().split()
solar_altitude = sky_co_ordinates[2]
solar_azimuth = sky_co_ordinates[4]


print(sky_co_ordinates)

# sky command
sky_cmd = f"!gendaylit -ang {solar_altitude} {solar_azimuth} -W 474 222 -g 0.2"
# print(sky_cmd)

# sky matrix
matrix = str(_sky_matrix)
# print(_sky_matrix)



# Write
if _write_sky:
    try:
        with open(sky_path, "w") as s:
            s.write(sky_cmd + "\n\n" +matrix)
        # print(s)

    except Exception as e:
        print('Error: ', e)
# ---------- end python_3_script_12 ----------
point_2 = Point()
modeltorad_2 = HBModelToRadFolder(model=assigngridsviews, folder=panel_39, write=Toggle(False))  # -> out, folder; plug-in component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
# Electric Lighting Simulation
panel_48 = Panel("C:\RadIES\area-light.ies")
epw_illuminance_data = Epw_illuminance_data(epw_file=panel_23, hour_index=python_3_script_11)  # -> direct_normal_ill_3, diffuse_horizontal_ill_2, total_sky_cover_2
panel_49 = Panel(modeltorad_2.folder)
# 4
boolean_toggle_4 = BooleanToggle(True)
# 2
boolean_toggle_5 = BooleanToggle(True)
# 1
boolean_toggle_6 = BooleanToggle(True)
construct_point_2 = ConstructPoint(XCoordinate=Slider(7, range=0..10), YCoordinate=0, ZCoordinate=Slider(2, range=0..10))
write_batch_file = Python3Script(folder=panel_40, details=Slider(1, range=0..4), run=Toggle(False))  # -> out, a
# ---------- write_batch_file: Python ----------
ghenv.Component.Message = 'Kybele 1.0.0 PIT'


import os
from pathlib import Path

# Path
batch_file = str(_folder) + r"\run_simulation.bat"
# print(batch_file)
# print(str(_folder))

# oconv command
oconv_cmd = f"oconv model\\scene\\envelope.mat model\\scene\\envelope.rad sky.rad > model.oct"


# specify pts path
pts_path = str(_folder) + r"\model\grid"


# loop to find pts file
for filename in os.listdir(pts_path):
    if filename.endswith(".pts"):
        old_path = os.path.join(pts_path, filename)
        new_path = os.path.join(pts_path, "0.pts")
        os.rename(old_path, new_path)
        print(f"Renamed {filename} to 0.pts")
        break 


rtrace_cmd = "rtrace -I -h -ab 2 -ad 1024 -aa 0.1 -ar 64 -lr 6 -lw 1e-4 model.oct < model\\grid\\0.pts > raw.txt"

# rtrace command
"""low_details = "-ab 2 -ad 512  -as 128  -aa 0.15 -ar 64  -lr 4  -lw 2e-4 \-ds 0.5 -dj 0.7 -dt 0.10 -st 0.15 -n 8"
mid_details = "-ab 4 -ad 2048 -as 512  -aa 0.07 -ar 128 -lr 8  -lw 1e-4 \-ds 0.2 -dj 0.7 -dt 0.05 -st 0.08 -n 16"
high_details = "-ab 6 -ad 8192 -as 2048 -aa 0.04 -ar 256 -lr 12 -lw 5e-5 \-ds 0.1 -dj 0.7 -dt 0    -st 0.02 -n 16"
_custom_details = str(_custom_parameter)

if _details == 1:
    rtrace_cmd = f"rtrace -I -h {mid_details} model.oct < model\\grid\\0.pts > raw.txt"
elif _details == 2:
    rtrace_cmd = f"rtrace -I -h {high_details} model.oct < model\\grid\\0.pts > raw.txt"
elif _details == 3:
    rtrace_cmd = f"rtrace -I -h {_custom_details} model.oct < model\\grid\\0.pts > raw.txt"
else:
    rtrace_cmd = "rtrace -I -h -ab 2 -ad 512  -as 128  -aa 0.15 -ar 64  -lr 4  -lw 2e-4 \-ds 0.5 -dj 0.7 -dt 0.10 -st 0.15 -n 8 model.oct < model\\grid\\0.pts > raw.txt"
print(rtrace_cmd)"""


# Commands
commands = [
    "echo Running Radiance Simulation",
    oconv_cmd,
    rtrace_cmd,
    "echo Done!"
]


# Write
if _run:
    try:
        with open(batch_file, "w") as f:
            for cmd in commands:
                f.write(cmd + "\n")
        print(f"Batch file saved: {batch_file}")

    except Exception as e:
        print('Error: ', e)
# ---------- end write_batch_file ----------
ies_file_to_radiance = Python3Script(ies_path=panel_48)  # -> out, rad_files, dat_files, cmdline, log; disabled
# ---------- ies_file_to_radiance: Python ----------
ghenv.Component.Message = 'Kybele 1.0.0'
import os, shlex, subprocess, time, glob

# validate inputs
def fail(msg):
    raise ValueError(msg)

if not ies_path or not os.path.isfile(ies_path):
    fail("Provide a valid IES file path for 'ies_path'.")

out_dir = out_dir or os.path.join(os.path.expanduser("~"), "radiance_out")
if not os.path.isdir(out_dir):
    os.makedirs(out_dir)

# locate
exe = "ies2rad.exe" if os.name == "nt" else "ies2rad"
ies2rad_path = exe
if radiance_bin:
    cand = os.path.join(radiance_bin, exe)
    if os.path.isfile(cand):
        ies2rad_path = cand

# path_check
try:
    subprocess.run([ies2rad_path, "-?"],
                   stdout=subprocess.PIPE, stderr=subprocess.PIPE, check=False)
except Exception as e:
    fail("Could not execute ies2rad. Ensure Radiance is installed and ies2rad is on PATH or provide 'radiance_bin'.")

# build command
stem = name.strip() if name else os.path.splitext(os.path.basename(ies_path))[0]
cmd = [ies2rad_path, "-o", stem]

# multiplier
if isinstance(multiplier, (int, float)) and multiplier not in (None, 0):
    cmd += ["-m", str(float(multiplier))]

# rgb color
if rgb:
    try:
        r, g, b = [str(float(x)) for x in rgb.split(",")]
        cmd += ["-c", r, g, b]
    except:
        fail("rgb must be like '1,1,1' (three numbers).")


cmd += [ies_path]

# new outputs
before = set(os.listdir(out_dir))

# run
proc = subprocess.run(cmd, cwd=out_dir,
                      stdout=subprocess.PIPE, stderr=subprocess.PIPE, text=True)
_log = (proc.stdout or "") + ("\n" + proc.stderr if proc.stderr else "")
_cmdline = " ".join(shlex.quote(c) for c in cmd)

if proc.returncode != 0:
    fail("ies2rad failed.\nCommand:\n{}\n\nLog:\n{}".format(_cmdline, _log))

# detect 
after = set(os.listdir(out_dir))
new = list(after - before)

# ies2rad writes:
_rad_files = [os.path.join(out_dir, f) for f in new if f.lower().endswith(".rad")]
_dat_files = [os.path.join(out_dir, f) for f in new if f.lower().endswith(".dat")]


if not _rad_files:
    _rad_files = glob.glob(os.path.join(out_dir, stem + "*.rad"))
if not _dat_files:
    _dat_files = glob.glob(os.path.join(out_dir, stem + "*.dat"))
# ---------- end ies_file_to_radiance ----------
ies_file_to_radiance_2 = Python3Script(ies_path="C:\RadIES\area-light.ies", out_dir=panel_38, name="ies_test")  # -> out, rad_files, dat_files, cmdline, log; same code as ies_file_to_radiance
# Change Input Parameters
annual_batch_file = Python3Script()  # -> out, a; inputs sensor_points: list; disabled
# ---------- annual_batch_file: Python ----------
ghenv.Component.Message = 'Kybele 1.0.0'

import os
from pathlib import Path
import shutil


# paths
_root = str(_folder)
batch_file = os.path.join(_root, "run_annual_simulation.bat")


# root
os.makedirs(_root, exist_ok=True)


# copy
if not _weather_file or not os.path.isfile(_weather_file):
    raise ValueError("Set a valid EPW path for _weather_file.")

root_weather = os.path.join(_root, os.path.basename(_weather_file))
shutil.copy2(_weather_file, root_weather)
name_weather = os.path.basename(root_weather)
print(f"Copied weather file to: {root_weather}")


# sky_glow = str(_folder) + "\skyglow.rad"
sky_glow = os.path.join(_root, "skyglow.rad")

sky_glow_text = """void glow skyglow
0
0
4 1 1 1 0

skyglow source sky
0
0
4 0 0 1 180
"""

try:
    with open(sky_glow, "w") as f:
        f.write(sky_glow_text)
    print("skyglow file saved:", sky_glow)
except Exception as e:
    print("Error:", e)


# gendaymtx -m selection
_m = 4 if (m_par == 4) else 1

# qdetails
if _custom_parameter not in (None, ""):
    details = str(_custom_parameter).strip()
elif _details == 1:
    # Medium
    details = "-lw 0.001 -ab 4 -ad 2048 -n 12"
elif _details == 2:
    # High
    details = "-lw 0.0001 -ab 6 -ad 8192 -n 16"
else:
    # Fast
    details = "-lw 0.01 -ab 2 -ad 512 -n 8"

# sensor count
try:
    sensor_num = len(sensor_points) if sensor_points is not None else 0
except:
    sensor_num = 0

print(f"Sensor count (rows): {sensor_num}")


grid_dir = os.path.join(_root, "model", "grid")
os.makedirs(grid_dir, exist_ok=True)

pts_candidates = [f for f in os.listdir(grid_dir) if f.lower().endswith(".pts")]
if "0.pts" not in pts_candidates and pts_candidates:
    old_path = os.path.join(grid_dir, pts_candidates[0])
    new_path = os.path.join(grid_dir, "0.pts")
    try:
        os.replace(old_path, new_path)
        print(f"Renamed {pts_candidates[0]} -> 0.pts")
    except Exception as e:
        print(f"Warning: could not rename {pts_candidates[0]} to 0.pts ({e})")


# commands
commands = [
    "echo Running Radiance Annual Daylight Simulation",
    f"epw2wea {name_weather} Weather.wea",
    "",
    "REM Step1 calculate illuminance (direct and diffuse) with daylight coefficients",
    f"gendaymtx -m {_m} Weather.wea > Weather.smx",
    r"oconv model\scene\envelope.mat model\scene\envelope.rad > amodel.oct",
    f"rfluxmtx -I+ -y {sensor_num} {details} - skyglow.rad -i amodel.oct < model\\grid\\0.pts > illum.mtx",
    "dctimestep illum.mtx Weather.smx | rmtxop -fa -t -c 47.4 119.9 11.6 - > annualR.ill",

    "",
    "REM Step2 calculate only the direct radiation",
    r"oconv model\scene\envelope.blk model\scene\envelope.rad > bmodel.oct",
    f"rfluxmtx -I+ -y {sensor_num} {details} - skyglow.rad -i bmodel.oct < model\\grid\\0.pts > billum.mtx",
    f"gendaymtx -m {_m} -d Weather.wea > Weathrd.smx",
    "dctimestep billum.mtx Weathrd.smx | rmtxop -fa -t -c 47.4 119.9 11.6 - > annualRd.ill",

    "",
    "REM Step3 create high resolution sun",
    "echo void light solar 0 0 3 1e6 1e6 1e6 > suns.rad",
    r"oconv -f model\scene\envelope.blk model\scene\envelope.rad suns.rad > sunCoefficientsDDS.oct",
    "rcontrib -I+ -ab 1 -y {y} -n {n} -ad 256 -lw 1.0e-3 -dc 1 -dt 0 -dj 0 -faf -e MF:6 -f reinhart.cal -b rbin -bn Nrbins -m solar sunCoefficientsDDS.oct < model\\grid\\0.pts > cdsDDS.mtx"
        .format(y=sensor_num, n=max(1, int(details.split()[-1])) if details.strip().endswith(tuple(str(i) for i in range(1,65))) else 16),
    "gendaymtx -5 0.533 -d -m 6 Weather.wea > WeathsunM6.smx",
    "dctimestep cdsDDS.mtx WeathsunM6.smx | rmtxop -fa -t -c 47.4 119.9 11.6 - > annualRs.ill",

    "",
    "REM Final step",
    "rmtxop annualR.ill + -s -1 annualRd.ill + annualRs.ill > annualRfinal.ill",

    "",
    "echo Done!"
]

# write batch file
if _run:
    try:
        with open(batch_file, "w", newline="\n") as f:
            for cmd in commands:
                f.write(cmd + "\n")
        print(f"Batch file saved: {batch_file}")
    except Exception as e:
        print("Error:", e)
# ---------- end annual_batch_file ----------
annual_batch_file_2 = Python3Script(
    folder=panel_39,
    weather_file=panel_23,
    details=Slider(1, range=0..1),
    m_par=Slider(1, range=0..1),
    sensor_points=flatten(genpts.points),
    run=Toggle(False))  # -> out, a; inputs sensor_points: list
# ---------- annual_batch_file_2: Python ----------
ghenv.Component.Message = 'Kybele 1.0.0'

import os
from pathlib import Path
import shutil


# paths
_root = str(_folder)
batch_file = os.path.join(_root, "run_annual_simulation.bat")


# root
os.makedirs(_root, exist_ok=True)


# copy
if not _weather_file or not os.path.isfile(_weather_file):
    raise ValueError("Set a valid EPW path for _weather_file.")

root_weather = os.path.join(_root, os.path.basename(_weather_file))
shutil.copy2(_weather_file, root_weather)
name_weather = os.path.basename(root_weather)
print(f"Copied weather file to: {root_weather}")

# ground_glow_to be done!
# sky_glow = str(_folder) + "\skyglow.rad"
sky_glow = os.path.join(_root, "skyglow.rad")

sky_glow_text = """void glow skyglow
0
0
4 1 1 1 0

skyglow source sky
0
0
4 0 0 1 180
"""

try:
    with open(sky_glow, "w") as f:
        f.write(sky_glow_text)
    print("skyglow file saved:", sky_glow)
except Exception as e:
    print("Error:", e)


# gendaymtx -m selection
_m = 4 if (m_par == 4) else 1

# qdetails
if _custom_parameter not in (None, ""):
    details = str(_custom_parameter).strip()
elif _details == 1:
    # Medium
    details = "-lw 0.001 -ab 4 -ad 2048 -n 12"
elif _details == 2:
    # High
    details = "-lw 0.0001 -ab 6 -ad 8192 -n 16"
else:
    # Fast
    details = "-lw 0.01 -ab 2 -ad 512 -n 8"

# sensor count
try:
    sensor_num = len(sensor_points) if sensor_points is not None else 0
except:
    sensor_num = 0

print(f"Sensor count (rows): {sensor_num}")


grid_dir = os.path.join(_root, "model", "grid")
os.makedirs(grid_dir, exist_ok=True)

pts_candidates = [f for f in os.listdir(grid_dir) if f.lower().endswith(".pts")]
if "0.pts" not in pts_candidates and pts_candidates:
    old_path = os.path.join(grid_dir, pts_candidates[0])
    new_path = os.path.join(grid_dir, "0.pts")
    try:
        os.replace(old_path, new_path)
        print(f"Renamed {pts_candidates[0]} -> 0.pts")
    except Exception as e:
        print(f"Warning: could not rename {pts_candidates[0]} to 0.pts ({e})")


# commands
commands = [
    "echo Running Radiance Annual Daylight Simulation",
    f"epw2wea {name_weather} Weather.wea",
    "",
    "REM Step1 calculate illuminance (direct and diffuse) with daylight coefficients",
    f"gendaymtx -m {_m} Weather.wea > Weather.smx",
    r"oconv model\scene\envelope.mat model\scene\envelope.rad > amodel.oct",
    f"rfluxmtx -I+ -y {sensor_num} {details} - skyglow.rad -i amodel.oct < model\\grid\\0.pts > illum.mtx",
    "dctimestep illum.mtx Weather.smx | rmtxop -fa -t -c 47.4 119.9 11.6 - > annualR.ill",

    "",
    "REM Step2 calculate only the direct radiation",
    r"oconv model\scene\envelope.blk model\scene\envelope.rad > bmodel.oct",
    f"rfluxmtx -I+ -y {sensor_num} {details} - skyglow.rad -i bmodel.oct < model\\grid\\0.pts > billum.mtx",
    f"gendaymtx -m {_m} -d Weather.wea > Weathrd.smx",
    "dctimestep billum.mtx Weathrd.smx | rmtxop -fa -t -c 47.4 119.9 11.6 - > annualRd.ill",

    "",
    "REM Step3 create high resolution sun",
    "echo void light solar 0 0 3 1e6 1e6 1e6 > suns.rad",
    r"oconv -f model\scene\envelope.blk model\scene\envelope.rad suns.rad > sunCoefficientsDDS.oct",
    "rcontrib -I+ -ab 1 -y {y} -n {n} -ad 256 -lw 1.0e-3 -dc 1 -dt 0 -dj 0 -faf -e MF:6 -f reinhart.cal -b rbin -bn Nrbins -m solar sunCoefficientsDDS.oct < model\\grid\\0.pts > cdsDDS.mtx"
        .format(y=sensor_num, n=max(1, int(details.split()[-1])) if details.strip().endswith(tuple(str(i) for i in range(1,65))) else 16),
    "gendaymtx -5 0.533 -d -m 6 Weather.wea > WeathsunM6.smx",
    "dctimestep cdsDDS.mtx WeathsunM6.smx | rmtxop -fa -t -c 47.4 119.9 11.6 - > annualRs.ill",

    "",
    "REM Final step",
    "rmtxop annualR.ill + -s -1 annualRd.ill + annualRs.ill > annualRfinal.ill",

    "",
    "echo Done!"
]

# write batch file
if _run:
    try:
        with open(batch_file, "w", newline="\n") as f:
            for cmd in commands:
                f.write(cmd + "\n")
        print(f"Batch file saved: {batch_file}")
    except Exception as e:
        print("Error:", e)
# ---------- end annual_batch_file_2 ----------
# Spectral Materials
python_3_script_13 = Python3Script(
    folder=panel_42,
    material_name=spectrum_name,
    spectral_csv="C:\radiance_folders\folder14\concrete.csv",
    material_type=Slider(0, range=0..1),
    specularity=Slider(0.0065, range=0..1),
    roughness=Slider(0.2, range=0..1),
    write_spectral_material=boolean_toggle_3)  # -> out, material_rad_file; inputs specularity: Double, roughness: Double
# ---------- python_3_script_13: Python ----------
import csv


# removes "_spectrum"
base_name = _material_name.rsplit("_spectrum", 1)[0]
print(base_name)



# file name
_root = str(_folder)
material_rad_file = _root + f"\{base_name}.rad"





# inputs
_material_name     = _material_name      
_spectral_csv_path = _spectral_csv         
_specularity       = float(_specularity)
_roughness         = float(_roughness)

if _material_type is None:
    mat_type = "plastic"
if int(_material_type) == 1:
    mat_type = "metal"
else:
    mat_type = "plastic"

# read CSV
wavelengths = []
values = []

with open(_spectral_csv_path, "r") as f:
    rdr = csv.DictReader(f)
    for row in rdr:
        try:
            wl  = float(row["wl"])
            sce = float(row["sce"]) / 100.0
        except Exception:
            continue
        wavelengths.append(wl)
        values.append(sce)

if not wavelengths:
    raise ValueError("No usable rows found in CSV.")


# sorted
pairs = sorted(zip(wavelengths, values), key=lambda x: x[0]) 
wavelengths, values = [p[0] for p in pairs], [p[1] for p in pairs]


# wvl start and end 
w_start = wavelengths[0]
w_end   = wavelengths[-1]
num_samples = len(values) + 2
print(num_samples)

# build values string
values_str = " ".join(f"{v:.17g}" for v in values)


# Radiance spectrum material
spectral_mat_string = f"""\
void spectrum {_material_name}
0
0
{num_samples} {w_start:.1f} {w_end:.1f} {values_str}

{_material_name} {mat_type} {base_name}
0
0
5 1 1 1 {_specularity} {_roughness}"""

print(spectral_mat_string)

if _write_spectral_material:
    try:
        with open(material_rad_file, "w") as f:
            f.write(spectral_mat_string)
            print(f"rad file saved: {material_rad_file}")
    except Exception as e:
        print("Error:", e)
# ---------- end python_3_script_13 ----------
python_3_script_14 = Python3Script(
    folder=panel_42,
    material_name=spectrum_name_2,
    spectral_csv=panel_43,
    material_type=Slider(1, range=0..1),
    specularity=Slider(0.04679642, range=0..0.1),
    roughness=Slider(0, range=0..1),
    write_spectral_material=boolean_toggle_3)  # -> out, material_rad_file; inputs specularity: Double, roughness: Double; same code as python_3_script_13
python_3_script_15 = Python3Script(
    folder=panel_42,
    material_name=spectrum_name_3,
    spectral_csv="C:\radiance_folders\folder14\ground.csv",
    material_type=Slider(0, range=0..1),
    specularity=Slider(0, range=0..1),
    roughness=Slider(0, range=0..1),
    write_spectral_material=boolean_toggle_3)  # -> out, material_rad_file; inputs specularity: Double, roughness: Double; same code as python_3_script_13
number_slider_8 = Slider(45, range=0..100)  # disabled
number_slider_9 = Slider(30, range=0..100)  # disabled
number_slider_10 = Slider(15, range=0..100)  # disabled
# Spectral Glazing Materials
spectral_glazing_materials = Python3Script(
    folder=panel_42,
    glazing_file_dat_1=panel_45,
    glazing_file_dat_2=panel_46,
    glazing_file_dat_3=panel_44,
    glazing_thickness_1=Slider(0.012, range=0..0.1),
    glazing_thickness_2=Slider(0.009, range=0..0.1),
    glazing_thickness_3=Slider(0.006, range=0..0.1),
    start_wavelength=Slider(380, range=0..1000),
    end_wavelength=Slider(780, range=0..1000),
    interval=Slider(10, range=0..10),
    material_name=spectrum_name_4,
    write_r_t=boolean_toggle_4)  # -> out, glazing_rad_file
# ---------- spectral_glazing_materials: Python ----------
import os, subprocess, shutil

# --- keep your material base name (don't shadow it later) ---
mat_base = _material_name.rsplit("_spectrum", 1)[0]
print(mat_base)

_root = _folder
batch_file = os.path.join(_root, f"{_material_name}.bat")
_glazing_rad_file = os.path.join(_root, f"{mat_base}.rad")

# ---- gather any number of glazing files/thicknesses ----
def gather_inputs(prefix):
    items = []
    for name, val in list(globals().items()):
        if name.startswith(prefix):
            # expect names like _glazing_file_dat_1, glazing_thickness_3, ...
            try:
                idx = int(name.split("_")[-1])
            except Exception:
                idx = 10**9
            items.append((idx, val))
    items.sort()
    flat = []
    for _, v in items:
        if v is None: 
            continue
        if isinstance(v, (list, tuple)):
            flat.extend([x for x in v if x])
        else:
            flat.append(v)
    return flat

dat_paths = gather_inputs("_glazing_file_dat_")
thicks    = gather_inputs("glazing_thickness_")

# basic validation (kept simple)
if not dat_paths:
    raise ValueError("Provide at least one _glazing_file_dat_* input.")
if not thicks:
    raise ValueError("Provide matching glazing_thickness_* inputs.")
if len(dat_paths) != len(thicks):
    print(f"WARNING: {len(dat_paths)} .dat files but {len(thicks)} thicknesses. Truncating to match.")
min_len = min(len(dat_paths), len(thicks))
dat_paths = dat_paths[:min_len]
thicks    = thicks[:min_len]

# ---- copy all .dat files into _folder and collect basenames ----
bases = []
for fp in dat_paths:
    if os.path.isfile(fp):
        file_base = os.path.basename(fp)             # avoid shadowing mat_base
        dst = os.path.join(_folder, file_base)
        try:
            shutil.copy2(fp, dst)                    # copy (overwrite with latest)
            print(f"dat file copied to: {dst}")
            bases.append(file_base)
        except Exception as e:
            print(f"Error copying {fp}: {e}")
    else:
        print(f"file not found: {fp}")

# ---- build dynamic -m segment ----
m_parts = []
for b, t in zip(bases, thicks):
    m_parts.extend(["-m", f'"{b}"', f"{float(t):.6g}"])
m_segment = " ".join(m_parts)

# ---- full command (stdout redirected to .rad) ----
cmd_line = (
    f"genglaze -s {int(start_wavelength)} {int(end_wavelength)} {int(_interval)} "
    f'-p "{_material_name}" {m_segment} > "{_glazing_rad_file}"'
)
print(cmd_line)

# ---- write & run batch (unchanged style) ----
if _write_r_t:
    try:
        with open(batch_file, "w", newline="\r\n") as f:
            f.write(f'cd /d "{_root}"\r\n')
            f.write(cmd_line + "\r\n")
        print(f"Batch file saved: {batch_file}")

        where_res = subprocess.run(['cmd', '/c', 'where genglaze'], cwd=_root, capture_output=True, text=True)
        if where_res.returncode != 0:
            print("WARNING: 'genglaze' not found on PATH. Output:")
            print(where_res.stdout or where_res.stderr)

        run_res = subprocess.run(['cmd', '/c', batch_file], cwd=_root, capture_output=True, text=True)
        print(f"Batch exit code: {run_res.returncode}")
        if run_res.stdout: print(run_res.stdout.strip())
        if run_res.stderr: print(run_res.stderr.strip())

        # ---- patch material name token (kept logic, updated to mat_base) ----
        if os.path.exists(_glazing_rad_file):
            with open(_glazing_rad_file, "r", encoding="ascii", errors="ignore") as f:
                txt = f.read()
            target  = f"glaze_mat_{_material_name}"
            patched = txt.replace(target, mat_base)
            if patched != txt:
                with open(_glazing_rad_file, "w", encoding="ascii", newline="\n") as f:
                    f.write(patched)
                print(f"Patched '{target}' → '{mat_base}' in {_glazing_rad_file}")
            else:
                print(f"No '{target}' token found in {_glazing_rad_file} (nothing to change).")
        else:
            print(f"RAD not found after running BAT: {_glazing_rad_file}")

    except Exception as e:
        print("Error:", e)
# ---------- end spectral_glazing_materials ----------
# Spectral Sky
python_3_script_16 = Python3Script(
    folder=panel_42,
    epw_file=panel_23,
    haze_level=Slider(0, range=0..10),
    month=Slider(9, range=0..10),
    day=Slider(21, range=0..100),
    hour=Slider(12, range=0..100),
    year=Slider(2024, range=0..10000),
    direct_normal=epw_illuminance_data.direct_normal_ill_3,
    diffuse_horizontal=epw_illuminance_data.diffuse_horizontal_ill_2,
    cloud_cover=epw_illuminance_data.total_sky_cover_2,
    write_spectral_sky=boolean_toggle_5)  # -> out, sky_file; inputs month: Int32, day: Int32, hour: Int32, year: Int32
#   port haze_level: default AOD is 0.115
# ---------- python_3_script_16: Python ----------
ghenv.Component.Message = 'Kybele 1.0.0'
import os, subprocess


_root = str(_folder)
batch_file = _folder + r"\spectral_sky.bat"

# read epw file
epw_path = str(_epw_file)
with open (epw_path, "r", encoding="utf-8") as f:
    first_line = f.readline().strip().split(",")



_latitude = float(first_line[6])
_longitude = (float(first_line[7]) * -1)
_timezone = float(first_line[8])
_standard_meridian = float(_timezone) * -15
print(first_line)
print(_latitude)
print(_longitude)
print(_standard_meridian)



# Cloud cover
if _cloud_cover is None:
    c_value = 0
elif float(_cloud_cover) > 1:
    c_value = 1
elif float(_cloud_cover) < 0:
    c_value = 0
else: c_value = float(_cloud_cover)
print(f"cloud_cover: {c_value}")



# Haze level [AOD]
if _haze_level is None:
    d_value = 0.115
elif float(_haze_level) > 3:
    d_value = 3
elif float(_haze_level) < 0:
    d_value = 0
else:
    d_value = float(_haze_level)
print(f"Haze level: {d_value}")


# sky name(-f) default out(out_sky.hsr, out_ground.hsr)
# Average ground reflection
# -l Custom Mie scattering profile file


# thread fro computation
n_value = os.cpu_count()
print(n_value)


# -l Custom Mie scattering profile file
# -p default=current working directory.
# -r Sky hyperspectral image x resolution. default=128
# -g Average ground reflectance, default=0.2


# -y Set year to invoke a more accurate algorithm to calculate solar angles, default=0.
if _year is None:
    y_value = 0
else:
    y_value = int(_year)
print(y_value)


# -L Set direct normal and diffuse horizontal illuminance value.
L_value = f"{float(_direct_normal)} {float(_diffuse_horizontal)}"
print(f"direct normal illuminance and difuse horizontal illuminance: {L_value}")

# gen spectral sky
spectral__sky_cmd = ["genssky", _month, _day, _hour, "-y", y_value, "-d", d_value, "-c", c_value, 
                "-L", L_value, "-n", n_value, "-a", _latitude, "-o", _longitude, 
                "-m", _standard_meridian, "-r 256", "-f out" "> spectral_sky.rad"
                ]

print(spectral__sky_cmd)

if _write_spectral_sky:
    try:
        with open(batch_file, "w") as f:
            for cmd in spectral__sky_cmd:
                f.write(str(cmd) +  " ")
        print(f"Batch file saved: {batch_file}")


        # Run batch
        run_res = subprocess.run(
            ['cmd', '/c', batch_file],
            cwd=_root, capture_output=True, text=True
        )
        print(f"Batch exit code: {run_res.returncode}")
        if run_res.stdout:
            print(run_res.stdout.strip())
        if run_res.stderr:
            print(run_res.stderr.strip())

        
        #Sky File
        _sky_file = _root + str(r"\spectral_sky.rad")

    
    except Exception as e:
        print("Error:", e)
# ---------- end python_3_script_16 ----------
modeltorad_3 = HBModelToRadFolder(model=assigngridsviews, folder=panel_42, write=boolean_toggle_6)  # -> out, folder; plug-in component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
panel_50 = Panel(write_batch_file.out)
panel_51 = Panel(modeltorad.folder)
panel_52 = Panel(annual_batch_file_2.out)
panel_53 = Panel("C:\radiance_folders\folder9_yearly\annualRfinal.ill")
lighting_geometry = Python3Script(
    points=flatten(point_2),
    rotationX=number_slider_8,
    rotationY=number_slider_9,
    rotationZ=number_slider_10,
    rad_files=ies_file_to_radiance.rad_files)  # -> out, flatten(lighting_geometry); inputs points: list of Point3d, rad_files: list; disabled
# ---------- lighting_geometry: Python ----------
ghenv.Component.Message = 'Kybele 1.0.0'
import os
import Rhino

try:
    from Grasshopper.Kernel.Types import GH_Point, GH_Number, GH_String
except:
    GH_Point = GH_Number = GH_String = None



def flatten_any(x):
    # GH DataTree
    try:
        bc = getattr(x, "BranchCount", None)
        if bc is not None:
            cnt = x.BranchCount if isinstance(bc, int) else x.BranchCount()
            flat = []
            for i in range(cnt):
                flat.extend(list(x.Branch(i)))
            return flat
    except:
        pass
    # list/tuple
    try:
        _ = len(x); return list(x)
    except:
        return [x]

def coerce_point(obj):
    if obj is None: return None
    if isinstance(obj, Rhino.Geometry.Point3d): return obj
    if GH_Point and isinstance(obj, GH_Point):
        try: return obj.Value
        except: pass
    # tuple-like
    try: return Rhino.Geometry.Point3d(float(obj[0]), float(obj[1]), float(obj[2]))
    except: pass
    # object with X/Y/Z
    try: return Rhino.Geometry.Point3d(float(obj.X), float(obj.Y), float(obj.Z))
    except: return None

def coerce_float(obj):
    if obj is None: return None
    if isinstance(obj, (int, float)): return float(obj)
    if GH_Number and isinstance(obj, GH_Number):
        try: return float(obj.Value)
        except: pass
    try: return float(obj)
    except: return None

def coerce_str(obj):
    if obj is None: return None
    if isinstance(obj, str): return obj
    if GH_String and isinstance(obj, GH_String):
        try: return str(obj.Value)
        except: pass
    try: return str(obj)
    except: return None

def ensure_float_list(x, n, default=0.0):
    raw = [r for r in flatten_any(x) if r is not None]
    if len(raw) == 0: return [default]*n
    if len(raw) == 1:
        v = coerce_float(raw[0]); v = default if v is None else v
        return [float(v)]*n
    if len(raw) != n:
        raise ValueError("Rotation list length {} must match number of points {}."
                         .format(len(raw), n))
    out = []
    for r in raw:
        v = coerce_float(r)
        out.append(default if v is None else float(v))
    return out

def ensure_path_list(rad_files_input, n):
    """Return list of N quoted, normalized absolute paths.
       If 1 input, broadcast; if N inputs, use as-is; else error."""
    raw = [coerce_str(s) for s in flatten_any(rad_files_input)]
    raw = [s.strip() for s in raw if s and s.strip() != ""]
    if len(raw) == 0:
        raise ValueError("Provide _rad_files (one path or a list of N paths).")
    paths_src = raw if len(raw) == n else (raw* n if len(raw) == 1 else None)
    if paths_src is None:
        raise ValueError("Number of _rad_files ({}) must be 1 or {} to match points."
                         .format(len(raw), n))
    paths = []
    missing = []
    for r in paths_src:
        p_abs = os.path.abspath(r).replace("\\", "/")
        paths.append('"{}"'.format(p_abs))
        if not os.path.isfile(p_abs):
            missing.append(p_abs)
    return paths, missing

# main
out = ""
_lighting_geometry = []

try:
    # Points
    pts = []
    for item in flatten_any(_points):
        p = coerce_point(item)
        if p is not None: pts.append(p)
    n = len(pts)

    if n == 0:
        out = ("No points detected.\n"
               "• Plug Point(s) into _points (flatten if needed).\n"
               "• Set _rad_files to one path (broadcast) or N paths.")
    else:
        rx = ensure_float_list(_rotationX, n, 0.0)
        ry = ensure_float_list(_rotationY, n, 0.0)
        rz = ensure_float_list(_rotationZ, n, 0.0)


        rad_paths, missing = ensure_path_list(_rad_files, n)

        for i, p in enumerate(pts):
            parts = ["!xform"]
            if abs(rx[i]) > 1e-12: parts.append("-rx {:.6f}".format(rx[i]))
            if abs(ry[i]) > 1e-12: parts.append("-ry {:.6f}".format(ry[i]))
            if abs(rz[i]) > 1e-12: parts.append("-rz {:.6f}".format(rz[i]))
            parts.append("-t {x:.6f} {y:.6f} {z:.6f}".format(x=p.X, y=p.Y, z=p.Z))
            parts.append(rad_paths[i])  # one path per point
            _lighting_geometry.append(" ".join(parts))

        warn = ""
        if missing:
            warn = "WARNING: {} path(s) not found:\n  - {}\n".format(len(missing), "\n  - ".join(missing))

        example = _lighting_geometry[0] if _lighting_geometry else "(none)"
        out = "{}OK: {} line(s). Example → {}".format(warn, len(_lighting_geometry), example)

except Exception as e:
    out = "ERROR: {}".format(e)
# ---------- end lighting_geometry ----------
panel_54 = Panel(ies_file_to_radiance_2.cmdline)
lighting_geometry_2 = Python3Script(
    points=flatten(point),
    rotationX=Slider(45, range=0..100),
    rotationY=Slider(30, range=0..100),
    rotationZ=Slider(15, range=0..100),
    rad_files=ies_file_to_radiance_2.rad_files)  # -> out, flatten(lighting_geometry); inputs points: list of Point3d, rad_files: list; same code as lighting_geometry
lighting_geometry_3 = Python3Script(
    points=flatten(construct_point_2),
    rotationX=Slider(40, range=0..100),
    rotationY=Slider(25, range=0..100),
    rotationZ=Slider(10, range=0..100),
    rad_files=ies_file_to_radiance_2.rad_files)  # -> out, flatten(lighting_geometry); inputs points: list of Point3d, rad_files: list
# ---------- lighting_geometry_3: Python ----------
ghenv.Component.Message = 'Kybele 1.0.0'
import os
import Rhino

try:
    from Grasshopper.Kernel.Types import GH_Point, GH_Number, GH_String
except:
    GH_Point = GH_Number = GH_String = None

# utils
def flatten_any(x):
    # GH DataTree
    try:
        bc = getattr(x, "BranchCount", None)
        if bc is not None:
            cnt = x.BranchCount if isinstance(bc, int) else x.BranchCount()
            flat = []
            for i in range(cnt):
                flat.extend(list(x.Branch(i)))
            return flat
    except:
        pass
    # list/tuple
    try:
        _ = len(x); return list(x)
    except:
        return [x]

def coerce_point(obj):
    if obj is None: return None
    if isinstance(obj, Rhino.Geometry.Point3d): return obj
    if GH_Point and isinstance(obj, GH_Point):
        try: return obj.Value
        except: pass
    # tuple-like
    try: return Rhino.Geometry.Point3d(float(obj[0]), float(obj[1]), float(obj[2]))
    except: pass
    # object with X/Y/Z
    try: return Rhino.Geometry.Point3d(float(obj.X), float(obj.Y), float(obj.Z))
    except: return None

def coerce_float(obj):
    if obj is None: return None
    if isinstance(obj, (int, float)): return float(obj)
    if GH_Number and isinstance(obj, GH_Number):
        try: return float(obj.Value)
        except: pass
    try: return float(obj)
    except: return None

def coerce_str(obj):
    if obj is None: return None
    if isinstance(obj, str): return obj
    if GH_String and isinstance(obj, GH_String):
        try: return str(obj.Value)
        except: pass
    try: return str(obj)
    except: return None

def ensure_float_list(x, n, default=0.0):
    raw = [r for r in flatten_any(x) if r is not None]
    if len(raw) == 0: return [default]*n
    if len(raw) == 1:
        v = coerce_float(raw[0]); v = default if v is None else v
        return [float(v)]*n
    if len(raw) != n:
        raise ValueError("Rotation list length {} must match number of points {}."
                         .format(len(raw), n))
    out = []
    for r in raw:
        v = coerce_float(r)
        out.append(default if v is None else float(v))
    return out

def ensure_path_list(rad_files_input, n):
    """Return list of N quoted, normalized absolute paths.
       If 1 input, broadcast; if N inputs, use as-is; else error."""
    raw = [coerce_str(s) for s in flatten_any(rad_files_input)]
    raw = [s.strip() for s in raw if s and s.strip() != ""]
    if len(raw) == 0:
        raise ValueError("Provide _rad_files (one path or a list of N paths).")
    paths_src = raw if len(raw) == n else (raw* n if len(raw) == 1 else None)
    if paths_src is None:
        raise ValueError("Number of _rad_files ({}) must be 1 or {} to match points."
                         .format(len(raw), n))
    paths = []
    missing = []
    for r in paths_src:
        p_abs = os.path.abspath(r).replace("\\", "/")
        paths.append('"{}"'.format(p_abs))
        if not os.path.isfile(p_abs):
            missing.append(p_abs)
    return paths, missing

# main
out = ""
_lighting_geometry = []

try:
    # Points
    pts = []
    for item in flatten_any(_points):
        p = coerce_point(item)
        if p is not None: pts.append(p)
    n = len(pts)

    if n == 0:
        out = ("No points detected.\n"
               "• Plug Point(s) into _points (flatten if needed).\n"
               "• Set _rad_files to one path (broadcast) or N paths.")
    else:
        rx = ensure_float_list(_rotationX, n, 0.0)
        ry = ensure_float_list(_rotationY, n, 0.0)
        rz = ensure_float_list(_rotationZ, n, 0.0)


        rad_paths, missing = ensure_path_list(_rad_files, n)

        for i, p in enumerate(pts):
            parts = ["!xform"]
            if abs(rx[i]) > 1e-12: parts.append("-rx {:.6f}".format(rx[i]))
            if abs(ry[i]) > 1e-12: parts.append("-ry {:.6f}".format(ry[i]))
            if abs(rz[i]) > 1e-12: parts.append("-rz {:.6f}".format(rz[i]))
            parts.append("-t {x:.6f} {y:.6f} {z:.6f}".format(x=p.X, y=p.Y, z=p.Z))
            parts.append(rad_paths[i])  # one path per point
            _lighting_geometry.append(" ".join(parts))

        warn = ""
        if missing:
            warn = "WARNING: {} path(s) not found:\n  - {}\n".format(len(missing), "\n  - ".join(missing))

        example = _lighting_geometry[0] if _lighting_geometry else "(none)"
        out = "{}OK: {} line(s). Example → {}".format(warn, len(_lighting_geometry), example)

except Exception as e:
    out = "ERROR: {}".format(e)
# ---------- end lighting_geometry_3 ----------
lighting_geometry_4 = Python3Script(
    points=flatten(construct_point_2),
    rotationX=Slider(40, range=0..100),
    rotationY=Slider(25, range=0..100),
    rotationZ=Slider(10, range=0..100),
    rad_files=ies_file_to_radiance_2.rad_files)  # -> out, flatten(lighting_geometry); inputs points: list of Point3d, rad_files: list; same code as lighting_geometry_3
panel_55 = Panel(spectral_glazing_materials.glazing_rad_file)
panel_56 = Panel(modeltorad_3.folder)
panel_57 = Panel(python_3_script_16.out)
panel_58 = Panel(python_3_script_16.sky_file)
panel_59 = Panel(python_3_script_13.material_rad_file)
panel_60 = Panel(python_3_script_14.material_rad_file)
panel_61 = Panel(python_3_script_15.material_rad_file)
result = Python3Script(folder=panel_40)  # -> out, illuminance; disabled
# ---------- result: Python ----------
ghenv.Component.Message = 'Kybele 1.0.0'


import os, re

_illuminance = []

raw_path = os.path.join(_folder, "raw.txt")
with open(raw_path, "r") as f:
    for line in f:
        s = line.strip()
        if not s or s.startswith(("#", "!")):
            continue

        parts = re.split(r"[,\s]+", s)
        if len(parts) < 3:
            continue

        try:
            r, g, b = float(parts[0]), float(parts[1]), float(parts[2])
        except ValueError:
            continue

        
        rgb_factor = 0.265 * r + 0.670 * g + 0.065 * b
        ill = 179.0 * rgb_factor
        _illuminance.append(ill)

print(_illuminance)
# ---------- end result ----------
concatenate = Concatenate(FragmentA=panel_39, FragmentB="\annualRfinal.ill")
panel_62 = Panel(lighting_geometry.lighting_geometry)
panel_63 = Panel(lighting_geometry_4.lighting_geometry)
colrange_2 = LBColorRange(index=Slider(2, range=0..26))  # -> colors; plug-in component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
merge = Merge(Data1=lighting_geometry_2.lighting_geometry, Data2=lighting_geometry_3.lighting_geometry)  # -> flatten(Result)
panel_64 = Panel("hour")
panel_65 = Panel("sensor")
legendpar_2 = LBLegendParameters(
    min=Slider(3000, range=0..120000),
    max=Slider(30000, range=0..120000),
    colors=colrange_2,
    continuous_leg=Toggle(True),
    num_decimals=Toggle(False),
    text_height=Slider(0.193, range=0..1))  # -> leg_par; plug-in component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
result_2 = Python3Script(ill_file=concatenate, mode="sensor", index=Slider(39, range=0..100), run=Toggle(True))  # -> out, result, status; inputs ill_file: String, index: Int32
# ---------- result_2: Python ----------
ghenv.Component.Message = 'Kybele 1.0.0'

result = []
nrows = ncols = 0
meta = {}
status = ""

def is_data_line(s):
    s = s.strip()
    return bool(s) and (s[0].isdigit() or s[0] in "+-.")

def parse_header_and_first_data_line(fobj):
    meta, first_data = {}, None
    while True:
        ln = fobj.readline()
        if not ln: break
        s = ln.strip()
        if is_data_line(s):
            first_data = ln
            break
        if s.startswith("#?RADIANCE"):
            meta["magic"] = s
        elif "=" in s:
            k, v = s.split("=", 1)
            meta[k.strip().upper()] = v.strip()
    return meta, first_data

def float_tokens(line):
    for tok in line.split():
        yield float(tok)

if _run:
    if not _ill_file:
        raise ValueError("Provide _ill_file (annualRfinal.ill).")

    mode = (_mode or "sensor").strip().lower()
    if mode not in ("sensor", "hour"):
        mode = "sensor"

    with open(_ill_file, "r") as f:
        meta, first_data = parse_header_and_first_data_line(f)
        nrows = int(meta.get("NROWS", "0"))
        ncols = int(meta.get("NCOLS", "0"))
        ncomp = int(meta.get("NCOMP", "1") or "1")
        if nrows <= 0 or ncols <= 0: raise ValueError("Bad header: {}".format(meta))
        if ncomp != 1: raise ValueError("Expect NCOMP=1, got {}".format(ncomp))

        if mode == "sensor":
            if _index < 0 or _index >= ncols:
                raise ValueError("Sensor index out of range [0..{}]".format(ncols-1))

            # first row:
            if first_data:
                vals = list(float_tokens(first_data))
                if len(vals) != ncols: raise ValueError("Row width mismatch")
                result.append(vals[_index])
            # remaining rows:
            for _ in range(nrows-1):
                ln = f.readline()
                while ln and not is_data_line(ln):
                    ln = f.readline()
                if not ln: break
                vals = list(float_tokens(ln))
                if len(vals) != ncols: raise ValueError("Row width mismatch")
                result.append(vals[_index])
            status = "Sensor {}: {} hours".format(_index, len(result))

        else:  
            if _index < 0 or _index >= nrows:
                raise ValueError("Hour index out of range [0..{}]".format(nrows-1))

            cur = 0
            if _index == 0:
                result = list(float_tokens(first_data))
            else:

                for _ in range(_index-1):
                    f.readline()

                ln = f.readline()
                while ln and not is_data_line(ln):
                    ln = f.readline()
                result = list(float_tokens(ln))
            if len(result) != ncols: raise ValueError("Row width mismatch @hour {}".format(_index))
            status = "Hour {}: {} sensors".format(_index, len(result))
# ---------- end result_2 ----------
result_3 = Python3Script(ill_file=concatenate, mode="hour", index=Slider(6323, range=0..8760), run=Toggle(False))  # -> out, result, status; inputs ill_file: String, index: Int32; same code as result_2
heatmap_4 = LBSpatialHeatmap(values=result.illuminance, mesh=genpts.mesh, legend_par=legendpar_2)  # -> mesh, legend, title, colors, legend_par, vis_set; disabled; plug-in component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
panel_66 = Panel(pitgrid.results)
panel_67 = Panel(merge)
panel_68 = Panel(result_3.result)
panel_69 = Panel(result.illuminance)
write_luminaries_file = Python3Script(folder=panel_38, lighting_geometry=flatten(merge), write=Toggle(False))  # -> out, lum_rad_path; inputs lighting_geometry: list
# ---------- write_luminaries_file: Python ----------
ghenv.Component.Message = 'Kybele 1.0.0'
import os


def flatten_any(x):
    # ghpythonlib
    try:
        from ghpythonlib import treehelpers
        return list(treehelpers.flatten(x))
    except:
        pass
    # GH DataTree
    try:
        bc = getattr(x, "BranchCount", None)
        if bc is not None:
            cnt = x.BranchCount if isinstance(bc, int) else x.BranchCount()
            flat = []
            for i in range(cnt):
                flat.extend(list(x.Branch(i)))
            return flat
    except:
        pass
    # list/tuple or single
    try:
        _ = len(x); return list(x)
    except:
        return [x]

def as_str_list(x):
    out = []
    for v in flatten_any(x):
        if v is None: 
            continue
        s = str(v).strip()
        if s:
            out.append(s)
    return out

def norm_folder(path_like):
    if not path_like:
        raise ValueError("No _folder provided.")
    p = os.path.abspath(str(path_like)).strip()
    if not p:
        raise ValueError("Empty _folder path.")
    return p

# main
lum_rad_path, out = None, ""

try:
    if _write:
        lines = as_str_list(_lighting_geometry)
        if not lines:
            raise ValueError("No xform lines in _lighting_geometry.")

        folder = norm_folder(_folder)
        if not os.path.isdir(folder):
            os.makedirs(folder)

        fname = "luminaries.rad"
        lum_rad_path = os.path.join(folder, fname)

        with open(lum_rad_path, "w", newline="\n") as f:
            f.write("# Auto-generated luminaire placement file\n")
            f.write("# Created by GH Python component: Electric lighting\n\n")
            for l in lines:
                # one line per entry
                if not l.endswith("\n"):
                    l += "\n"
                f.write(l)

        sample = lines[0] if lines else "(none)"
        out = "Wrote {} line(s) to:\n{}\nExample: {}".format(len(lines), lum_rad_path, sample)
    else:
        out = "Toggle _write to generate luminaries.rad."

except Exception as e:
    out = "ERROR: {}".format(e)
# ---------- end write_luminaries_file ----------
# 5
# Gateway for
# Electric/Daylight
boolean_toggle_7 = BooleanToggle(True)
# Spectral Model
python_3_script_17 = Python3Script(
    folder=panel_42,
    spectral_sky=python_3_script_16.sky_file,
    opaque_materials=[python_3_script_13.material_rad_file, python_3_script_14.material_rad_file, python_3_script_15.material_rad_file],
    glazing_materials=spectral_glazing_materials.glazing_rad_file,
    run=boolean_toggle_7)  # -> out, spectral_model; inputs opaque_materials: list, glazing_materials: list
# ---------- python_3_script_17: Python ----------
import os, subprocess

out = ""
_spectral_model = None

def quote_path(file_name):
    """Quote a file name for Windows batch (spaces safe)."""
    return '"' + str(file_name) + '"'



def get_file_names(list_path):
    """Return (valid_file_names, missing_file_names)."""
    valid_files, missing_files = [], []
    if not list_path:
        return valid_files, missing_files
    for file_path in list_path:
        if file_path and os.path.isfile(file_path):
            valid_files.append(os.path.basename(file_path))
        else:
            missing_files.append(str(file_path))
    return valid_files, missing_files


# envelope.rad path
envelope_path = str(_folder) + r"\model\scene"


# loop to find envelope.rad file
for filename in os.listdir(envelope_path):
    if filename.endswith(".rad"):
        old_path = os.path.join(envelope_path, filename)
        new_path = os.path.join(_folder, filename)
        os.rename(old_path, new_path)
        print(f"Placed {filename} to {new_path}")
        break 



# Collect file names
opaque_files, opaque_missing = get_file_names(_opaque_materials)
glazing_files, glazing_missing = get_file_names(_glazing_materials)



# files inside the folder
folder_is_valid = bool(_folder) and os.path.isdir(_folder)
envelope_file_name = "envelope.rad"
spectral_sky_name = os.path.basename(_spectral_sky) if _spectral_sky else "spectral_sky.rad"
spectral_model_name = "specmodel.oct"
batch_file_name = "spectral_model.bat"

spectral_model_path = os.path.join(_folder, spectral_model_name)
batch_file_path = os.path.join(_folder, batch_file_name)



# Validation
errors = []
if not folder_is_valid:
    errors.append("Invalid _folder.")
if not opaque_files:
    errors.append("No valid _opaque_materials found.")
if not glazing_files:
    errors.append("No valid _glazing_materials found.")
if not os.path.isfile(os.path.join(_folder, spectral_sky_name)):
    errors.append("Missing spectral_sky.rad in folder.")
if not os.path.isfile(os.path.join(_folder, envelope_file_name)):
    errors.append("Missing envelope.rad in folder.")




# Build oconv command
command_parts = ["oconv"]
command_parts += opaque_files
command_parts += glazing_files
command_parts.append(envelope_file_name)
command_parts.append(spectral_sky_name)

command_line = " ".join(quote_path(name) for name in command_parts) + " > " + quote_path(spectral_model_name)
print(command_line)




# Write batch file
if not errors:
    try:
        with open(batch_file_path, "w", encoding="utf-8", newline="\r\n") as batch_file:
            batch_file.write("@echo off\r\n")
            batch_file.write("setlocal\r\n")
            batch_file.write(command_line + "\r\n")
            batch_file.write("endlocal\r\n")
        out += "Batch file written: {}\nCommand:\n{}\n".format(batch_file_path, command_line)
    except Exception as error:
        errors.append("Failed to write batch file: {}".format(error))




# Run batch file
if _run and not errors:
    try:
        process = subprocess.run(batch_file_path, cwd=_folder, capture_output=True, text=True, shell=True)
        if process.stdout:
            out += "\nSTDOUT:\n" + process.stdout
        if process.stderr:
            out += "\nSTDERR:\n" + process.stderr
        if process.returncode != 0:
            errors.append("oconv failed (return code {}).".format(process.returncode))
        elif not (os.path.isfile(spectral_model_path) and os.path.getsize(spectral_model_path) > 0):
            errors.append("specmodel.oct not created or empty.")
    except Exception as error:
        errors.append("Run error: {}".format(error))




# Final outputs
if errors:
    if opaque_missing:
        errors.append("Missing opaque files:\n- " + "\n- ".join(opaque_missing))
    if glazing_missing:
        errors.append("Missing glazing files:\n- " + "\n- ".join(glazing_missing))
    out = "Issues:\n- " + "\n- ".join(errors)
    _spectral_model = None
else:
    _spectral_model = spectral_model_path
    out += "\nOK → spectral model created: {}".format(_spectral_model)

print(errors)
# ---------- end python_3_script_17 ----------
panel_70 = Panel(write_luminaries_file.lum_rad_path)
grid_mode = Slider(2, range=0..3)
colrange_3 = LBColorRange(index=Slider(2, range=0..26))  # -> colors; plug-in component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
panel_71 = Panel(python_3_script_17.out)

# ----
# 6
boolean_toggle_8 = BooleanToggle(True)

run = Button()
legendpar_3 = LBLegendParameters(
    min=Slider(300, range=0..120000),
    max=Slider(10000, range=0..120000),
    colors=colrange_3,
    continuous_leg=Toggle(True),
    num_decimals=Toggle(False),
    text_height=Slider(0.193, range=0..1))  # -> leg_par; plug-in component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
python_3_script_18 = Python3Script(
    result_hourly=result_2.result,
    graph_title="Hourly Heat Map",
    range1=Slider(300, range=0..100000),
    range2=Slider(3000, range=0..100000),
    range3=Slider(10000, range=0..100000),
    range4=Slider(30000, range=0..100000),
    name_range1="Failing",
    name_range2="Low",
    name_range3="Supplemental",
    name_range4="Acceptable",
    name_range5="Excessive",
    run=run,
    grid_mode=grid_mode,
    grid_color=ColourSwatch(SwatchColor=RGB(207, 207, 207)))  # -> out, form; inputs result_hourly: list
# ---------- python_3_script_18: Python ----------
ghenv.Component.Message = 'Kybele 1.0.0'


import System.Windows.Forms as WinForms
import System.Drawing as Drawing
from System.Drawing import Point, Color
from System.Drawing.Drawing2D import SmoothingMode, PixelOffsetMode

# Inputs
if not _run:
    ghenv.Component.Message = "Kybele 1.0.0" # "Waiting for _run trigger"
else:
    try:
        flat_data = [float(x) for x in _result_hourly if x is not None]
        if len(flat_data) != 8760:
            raise ValueError("Expected 8760 values.")
    except:
        WinForms.MessageBox.Show("PAR_8760 must contain exactly 8760 float values.", "Error")
        raise

    thresholds = [
        float(_range1) if _range1 is not None else 0,
        float(_range2) if _range2 is not None else 10,
        float(_range3) if _range3 is not None else 20,
        float(_range4) if _range4 is not None else 50
    ]

    # Ascending thresholds
    if not (thresholds[0] <= thresholds[1] <= thresholds[2] <= thresholds[3]):
        WinForms.MessageBox.Show("Ranges must be ascending (r1 ≤ r2 ≤ r3 ≤ r4).", "Invalid Ranges")
        raise ValueError("Non-ascending thresholds")

    # Color Setup
    def to_color(val):
        if val is None:
            return Color.LightGray
        if isinstance(val, Color):
            return val
        if isinstance(val, (tuple, list)) and len(val) == 3:
            return Color.FromArgb(int(val[0]), int(val[1]), int(val[2]))
        if isinstance(val, str):
            s = val.strip()
            if ',' in s or ' ' in s:
                s = s.replace('(', '').replace(')', '')
                parts = [p for p in s.replace(',', ' ').split(' ') if p]
                if len(parts) == 3:
                    r, g, b = [int(float(p)) for p in parts]
                    return Color.FromArgb(r, g, b)
            s = s.lstrip('#')
            if len(s) == 6:
                r = int(s[0:2], 16); g = int(s[2:4], 16); b = int(s[4:6], 16)
                return Color.FromArgb(r, g, b)
        raise ValueError("Unsupported color format: use '#rrggbb', (r,g,b), 'r,g,b', or a GH Color.")

    def hex_to_color(hex_str):
        s = hex_str.lstrip('#')
        return Drawing.Color.FromArgb(int(s[0:2], 16), int(s[2:4], 16), int(s[4:6], 16))

    # Grid / inset mode
    mode = int(round(float(_grid_mode))) if _grid_mode is not None else 0
    mode = max(0, min(3, mode))  # clamp to 0..3

    INSET = 0.5
    inset_px     = INSET if mode == 1 else 0.0
    grid_enabled = (mode in (2, 3))
    grid_color   = to_color("#636363") if mode == 3 else \
                   (to_color(_grid_color) if _grid_color else Drawing.Color.LightGray)

    # Bucket 0 color
    first_color = hex_to_color("#808080") if mode == 3 else hex_to_color("#ffffff")

    colors = [
        first_color,                 # imperceptible
        hex_to_color("#f9ebab"),     # perceptible
        hex_to_color("#f0be39"),     # disturbing
        hex_to_color("#e46828"),     # intolerable
        hex_to_color("#d70e17")      # excessive
    ]

    # Classification
    def classify(value):
        if value <= thresholds[0]: return 0
        elif value <= thresholds[1]: return 1
        elif value <= thresholds[2]: return 2
        elif value <= thresholds[3]: return 3
        else: return 4

    # Custom range names
    def _safe_name(val, default):
        return val if (val is not None and str(val).strip() != "") else default

    n1 = _safe_name(globals().get("_name_range1"), "Imperceptible")
    n2 = _safe_name(globals().get("_name_range2"), "Perceptible")
    n3 = _safe_name(globals().get("_name_range3"), "Disturbing")
    n4 = _safe_name(globals().get("_name_range4"), "Intolerable")
    n5 = _safe_name(globals().get("_name_range5"), "Excessive")
    range_names = [n1, n2, n3, n4, n5]


    # Heatmap Form Class
    class PARHeatmapForm(WinForms.Form):
        def __init__(self, data):
            super(PARHeatmapForm, self).__init__()
            self.Text = "Hourly Heat Map"
            self.StartPosition = WinForms.FormStartPosition.CenterScreen
            self.FormBorderStyle = WinForms.FormBorderStyle.Sizable
            self.DoubleBuffered = True
            self.BackColor = Drawing.Color.Gray if mode == 3 else Drawing.Color.White


            self.mode = mode
            self.inset_px = inset_px
            self.grid_enabled = grid_enabled
            self.grid_color = grid_color
            self.colors = colors
            self.range_names = range_names

            self.cell_w = 4
            self.cell_h = 20
            self.cols = 365
            self.rows = 24
            self.title_height = 25
            self.margin_top = 40
            self.margin_right = 130
            self.margin_left = 30
            self.margin_bottom = 200
            self.data = data

            self.ClientSize = Drawing.Size(
                self.margin_left + self.cols * self.cell_w + self.margin_right,
                self.rows * self.cell_h + self.margin_bottom + self.margin_top
            )

            self.Paint += self.on_paint
            self.MouseMove += self.on_mouse_move

            self.save_btn = WinForms.Button()
            self.save_btn.Text = "Export PNG"
            self.save_btn.Height = 30
            self.save_btn.Dock = WinForms.DockStyle.Bottom
            self.save_btn.Margin = WinForms.Padding(0, 10, 0, 10)
            self.save_btn.Click += self.on_export_click
            self.Controls.Add(self.save_btn)

            self.hover_label = WinForms.Label()
            self.hover_label.AutoSize = True
            self.hover_label.Location = Point(120, self.rows * self.cell_h + self.margin_top + 70)
            self.Controls.Add(self.hover_label)

        def on_paint(self, sender, e):
            g = e.Graphics
            g.SmoothingMode = SmoothingMode.Default
            g.PixelOffsetMode = PixelOffsetMode.HighSpeed

            # Shift title
            g.TranslateTransform(self.margin_left, self.margin_top + self.title_height)

            # GDI objects
            bucket_brushes = [Drawing.SolidBrush(c) for c in self.colors]
            grid_pen = Drawing.Pen(self.grid_color) if self.grid_enabled else None

            # Heatmap cells
            inset = float(self.inset_px)
            for i in range(self.rows):
                for j in range(self.cols):
                    idx = j * 24 + i
                    value = self.data[idx]
                    cat = classify(value)
                    brush = bucket_brushes[cat]

                    x = j * self.cell_w
                    y = i * self.cell_h

                    # symmetric inset
                    ix = x + inset
                    iy = y + inset
                    w  = self.cell_w  - 2 * inset
                    h  = self.cell_h  - 2 * inset

                    g.FillRectangle(brush, ix, iy, w, h)

                    if self.grid_enabled:
                        g.DrawRectangle(grid_pen, x, y, self.cell_w, self.cell_h)

            # Month dividers and labels
            month_starts = [0, 31, 59, 90, 120, 151, 181, 212, 243, 273, 304, 334]
            month_names = ["Jan", "Feb", "Mar", "Apr", "May", "Jun",
                           "Jul", "Aug", "Sep", "Oct", "Nov", "Dec"]

            if self.mode == 2:
                month_pen = Drawing.Pens.Gray
            elif self.mode == 3:
                month_pen = Drawing.Pens.Black
            else:
                month_pen = Drawing.Pens.LightGray

            for idx, day in enumerate(month_starts):
                x = day * self.cell_w
                g.DrawLine(month_pen, x, 0, x, self.rows * self.cell_h)
                g.DrawString(month_names[idx], self.Font, Drawing.Brushes.Black,
                             x + 50, self.rows * self.cell_h + 5)

            # Hour labels
            for i in [0, 6, 12, 18, 24]:
                if i <= 24:
                    label = str(i).zfill(2) + ":00"
                    y = i * self.cell_h - 20
                    g.DrawString(label, self.Font, Drawing.Brushes.Black,
                                 self.cols * self.cell_w + 5, y)


            # Legend (counts + labels)
            legend_counts = [0] * 5
            for val in self.data:
                legend_counts[classify(val)] += 1

            total = float(len(self.data))
            percentages = [int(round(c / total * 100)) for c in legend_counts]

            legend_labels = [
                "{}% {}".format(percentages[0], self.range_names[0]),
                "{}% {}".format(percentages[1], self.range_names[1]),
                "{}% {}".format(percentages[2], self.range_names[2]),
                "{}% {}".format(percentages[3], self.range_names[3]),
                "{}% {}".format(percentages[4], self.range_names[4])
            ]

            legend_spacing = 55
            legend_elements = []
            total_width = 0
            for i in range(5):
                label = legend_labels[i]
                label_size = g.MeasureString(label, self.Font)
                element_width = 20 + 5 + int(label_size.Width) + legend_spacing
                legend_elements.append((label, element_width))
                total_width += element_width

            legend_x = (self.cols * self.cell_w - total_width) // 2
            legend_y = self.rows * self.cell_h + self.margin_top + 45

            for i, (label, element_width) in enumerate(legend_elements):
                g.FillRectangle(bucket_brushes[i], legend_x, legend_y, 20, 15)
                g.DrawString(label, self.Font, Drawing.Brushes.Black, legend_x + 25, legend_y)
                legend_x += element_width

            # Reset transform
            g.ResetTransform()

            # Title
            title_font = Drawing.Font(self.Font.FontFamily, 10) # Drawing.FontStyle.Bold
            title = _graph_title or ""
            sz = g.MeasureString(title, title_font)
            g.DrawString(_graph_title, title_font, Drawing.Brushes.Black,
                        self.margin_left + (self.cols * self.cell_w - sz.Width) / 2.0, 10)

            # X-Axis Label
            g.DrawString("Day of Year", self.Font, Drawing.Brushes.Black,
                        self.margin_left + self.cols * self.cell_w // 2 - 30,
                        self.rows * self.cell_h + self.margin_top + 70)

            # Y-Axis Label
            g.TranslateTransform(self.cols * self.cell_w + 90,
                                 self.margin_top + self.rows * self.cell_h // 2 + 30)
            g.RotateTransform(-90)
            g.DrawString("Time of Day", self.Font, Drawing.Brushes.Black, -60, 30)
            g.ResetTransform()

            # GDI objects
            if grid_pen: grid_pen.Dispose()
            for b in bucket_brushes: b.Dispose()

        def on_mouse_move(self, sender, e):
            x, y = e.X, e.Y
            col = (x - self.margin_left) // self.cell_w
            row = (y - self.margin_top - self.title_height) // self.cell_h
            if 0 <= col < 365 and 0 <= row < 24:
                index = col * 24 + row
                val = round(self.data[index], 2)
                self.hover_label.Text = f"Day {col+1}, Hour {row}: {val}"

        def on_export_click(self, sender, args):
            dialog = WinForms.SaveFileDialog()
            dialog.Filter = "PNG Image|*.png"
            dialog.FileName = _graph_title
            if dialog.ShowDialog() == WinForms.DialogResult.OK:
                try:
                    bmp = Drawing.Bitmap(self.ClientSize.Width, self.ClientSize.Height)
                    g = Drawing.Graphics.FromImage(bmp)
                    g.Clear(self.BackColor)
                    paint_args = WinForms.PaintEventArgs(g, self.ClientRectangle)
                    self.on_paint(self, paint_args)
                    bmp.Save(dialog.FileName)
                    WinForms.MessageBox.Show("Saved successfully to:\n" + dialog.FileName)
                except Exception as e:
                    WinForms.MessageBox.Show("Export failed:\n" + str(e), "Error")

    # Show Form
    form = PARHeatmapForm(flat_data)
    form.Show()
# ---------- end python_3_script_18 ----------
python_3_script_19 = Python3Script(folder=panel_38, details=Slider(1, range=0..4), electric_lighting=Toggle(False), run=Toggle(False))  # -> out, a
# ---------- python_3_script_19: Python ----------
ghenv.Component.Message = 'Kybele 1.0.0'


import os
from pathlib import Path

# Path
batch_file = str(_folder) + r"\run_simulation.bat"
# print(batch_file)
# print(str(_folder))

# oconv command
if _electric_lighting == True:
    oconv_cmd = f"oconv model\\scene\\envelope.mat model\\scene\\envelope.rad luminaries.rad > model.oct"
else:
    oconv_cmd = f"oconv model\\scene\\envelope.mat model\\scene\\envelope.rad sky.rad > model.oct"



# pts path
pts_path = str(_folder) + r"\model\grid"


# loop to find pts file
for filename in os.listdir(pts_path):
    if filename.endswith(".pts"):
        old_path = os.path.join(pts_path, filename)
        new_path = os.path.join(pts_path, "0.pts")
        os.rename(old_path, new_path)
        print(f"Renamed {filename} to 0.pts")
        break 


rtrace_cmd = "rtrace -I -h -ab 2 -ad 1024 -aa 0.1 -ar 64 -lr 6 -lw 1e-4 model.oct < model\\grid\\0.pts > raw.txt"

# rtrace command
"""low_details = "-ab 2 -ad 512  -as 128  -aa 0.15 -ar 64  -lr 4  -lw 2e-4 \-ds 0.5 -dj 0.7 -dt 0.10 -st 0.15 -n 8"
mid_details = "-ab 4 -ad 2048 -as 512  -aa 0.07 -ar 128 -lr 8  -lw 1e-4 \-ds 0.2 -dj 0.7 -dt 0.05 -st 0.08 -n 16"
high_details = "-ab 6 -ad 8192 -as 2048 -aa 0.04 -ar 256 -lr 12 -lw 5e-5 \-ds 0.1 -dj 0.7 -dt 0    -st 0.02 -n 16"
_custom_details = str(_custom_parameter)

if _details == 1:
    rtrace_cmd = f"rtrace -I -h {mid_details} model.oct < model\\grid\\0.pts > raw.txt"
elif _details == 2:
    rtrace_cmd = f"rtrace -I -h {high_details} model.oct < model\\grid\\0.pts > raw.txt"
elif _details == 3:
    rtrace_cmd = f"rtrace -I -h {_custom_details} model.oct < model\\grid\\0.pts > raw.txt"
else:
    rtrace_cmd = "rtrace -I -h -ab 2 -ad 512  -as 128  -aa 0.15 -ar 64  -lr 4  -lw 2e-4 \-ds 0.5 -dj 0.7 -dt 0.10 -st 0.15 -n 8 model.oct < model\\grid\\0.pts > raw.txt"
print(rtrace_cmd)"""


# Commands
commands = [
    "echo Running Radiance Simulation",
    oconv_cmd,
    rtrace_cmd,
    "echo Done!"
]


# Write
if _run:
    try:
        with open(batch_file, "w") as f:
            for cmd in commands:
                f.write(cmd + "\n")
        print(f"Batch file saved: {batch_file}")

    except Exception as e:
        print('Error: ', e)
# ---------- end python_3_script_19 ----------
# Spectral Point In Time
python_3_script_20 = Python3Script(
    folder=panel_42,
    spectral_model=python_3_script_17.spectral_model,
    number_of_channel=Slider(20, range=0..100),
    wavelength_lower=Slider(380, range=0..1000),
    wavelength_upper=Slider(780, range=0..1000),
    details_level=Slider(0, range=0..10),
    output_type=Slider(1, range=1..2),
    write_files=Toggle(True),
    run=boolean_toggle_8)  # -> out, result; inputs details_level: Int32
#   port details_level: 0 = Low Details (fast) 1 = Mid Details (slower) 2 = High Details (Fast) Valid Text for Details Parameter
#   port output_type: Spectral data = 0 Illuminance = 1
# ---------- python_3_script_20: Python ----------
import os, shutil, subprocess, multiprocessing

out = ""
_result = None
errors = []



# validate folder & octree
if not _folder or not os.path.isdir(_folder):
    errors.append("Invalid _folder.")

octree_name = os.path.basename(str(_spectral_model)) if _spectral_model else ""
if not octree_name:
    errors.append("Missing _spectral_model (.oct) path/name.")
elif not os.path.isfile(os.path.join(_folder, octree_name)):
    errors.append("Octree not found in _folder: {}".format(octree_name))



# copy a .pts from model\grid to root as 0.pts
if _write_files:
    grid_dir = os.path.join(_folder, "model", "grid")
    root_pts_path = os.path.join(_folder, "0.pts")

    if not os.path.isdir(grid_dir):
        errors.append("Missing folder: model\\grid")
    else:
        # prefer a file already named 0.pts; otherwise pick the first *.pts
        all_pts = sorted([f for f in os.listdir(grid_dir) if f.lower().endswith(".pts")])
        if not all_pts:
            errors.append("No .pts file found in model\\grid")
        else:
            src_name = "0.pts" if "0.pts" in all_pts else all_pts[0]
            src_pts_path = os.path.join(grid_dir, src_name)
            try:
                shutil.copy2(src_pts_path, root_pts_path)  # copy (not move)
                out += f"Copied points: {src_name} -> 0.pts\n"
            except Exception as e:
                errors.append("Could not copy points to root: {}".format(e))

    if not os.path.isfile(root_pts_path):
        errors.append("Root points file missing: 0.pts")



# spectral params
try:
    cs = int(_number_of_channel)
    wl_lo = float(wavelength_lower)
    wl_hi = float(wavelength_upper)
except Exception:
    errors.append("Invalid spectral parameters (_number_of_channel / wavelength bounds).")
if not errors and wl_hi <= wl_lo:
    errors.append("wavelength_upper must be greater than wavelength_lower.")



# presets
num_cores = multiprocessing.cpu_count()
low_details  = f"-ab 2 -ad 512  -as 128  -aa 0.15 -ar 64  -lr 4  -lw 2e-4  -ds 0.5 -dj 0.7 -dt 0.10 -st 0.15 -n {num_cores}"
mid_details  = f"-ab 3 -ad 1024 -as 1024 -aa 0.06 -ar 192 -lr 10 -lw 1e-4  -dc 0.5 -dj 0.7 -dp 512  -dr 1 -ds 0.20 -dt 0.02 -st 0.05 -n {num_cores}"
high_details = f"-ab 6 -ad 2028 -as 4096 -aa 0.03 -ar 320 -lr 16 -lw 2e-5 -dc 0.5 -dj 0.7 -dp 1024 -dr 1 -ds 0.10 -dt 0 -st 0.01 -n {num_cores}"

details_line = low_details
if isinstance(_details_level, int):
    details_line = [low_details, mid_details, high_details][_details_level if 0 <= _details_level <= 2 else 0]
elif isinstance(_details_level, str) and _details_level.strip():
    details_line = _details_level.strip()



# 0 spectral bands; 1 photopic Y
output_mode = "-pY" if int(_output_type) == 2 else "-co+"



# commands
ambient_name   = "model.amb"
error_log_name = "error.log"
result_name    = "result.res"

rtrace_parts = [
    "rtrace", "-I", "-h",
    f"-cs {cs}",
    f"-cw {wl_lo} {wl_hi}",
    details_line,
    f"-af {ambient_name}",
    f"-e {error_log_name}",
    output_mode,
    octree_name,
    "<", "0.pts",
    ">", result_name
]
command_line = " ".join(str(p) for p in rtrace_parts if str(p).strip())
print(command_line)
batch_path   = os.path.join(_folder, "run_spectral_pt.bat")
result_path  = os.path.join(_folder, result_name)



# write & run
if _write_files and not errors:
    with open(batch_path, "w", encoding="utf-8", newline="\r\n") as f:
        f.write(command_line + "\r\n")
        f.write("exit")




if _run and not errors:
    run_res = subprocess.run(
        ["cmd", "/c", batch_path],
        cwd=_folder,
        capture_output=True,
        text=True
    )
    out  += f"Batch exit code: {run_res.returncode}\n"
    if run_res.stdout: out += "STDOUT:\n" + run_res.stdout
    if run_res.stderr: out += "\nSTDERR:\n" + run_res.stderr

    if run_res.returncode == 0 and os.path.isfile(result_path) and os.path.getsize(result_path) > 0:
        _result = result_path
        out += f"\nOK → result: {_result}"
    else:
        _result = None
        out += f"\nNo result written (expected: {result_name})."

elif errors:
    out = "Issues:\n- " + "\n- ".join(errors)
    _result = None
# ---------- end python_3_script_20 ----------
heatmap_5 = LBSpatialHeatmap(values=result_3.result, mesh=genpts.mesh, legend_par=legendpar_3)  # -> mesh, legend, title, colors, legend_par, vis_set; plug-in component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
panel_72 = Panel(python_3_script_19.a)
panel_73 = Panel(python_3_script_20.result)
python_3_script_21 = Python3Script(folder=panel_42, result_file=python_3_script_20.result)  # -> out, illuminance
# ---------- python_3_script_21: Python ----------
import os, re

out = ""
_illuminance = []

def parse_result_file(path):
    """Parse an rtrace -I -pY result: one numeric value per line (lux)."""
    vals = []
    with open(path, "r", encoding="utf-8", errors="ignore") as f:
        for line in f:
            s = line.strip()
            if not s or s.startswith("#"):
                continue

            m = re.search(r'[-+]?(?:\d+(?:\.\d*)?|\.\d+)(?:[eE][-+]?\d+)?', s)
            if m:
                vals.append(float(m.group(0)))
    return vals


candidate = None
if _result_file and os.path.isfile(_result_file):
    candidate = _result_file
elif _folder and os.path.isdir(_folder):
    for name in ("result.res", "result.txt"):
        p = os.path.join(_folder, name)
        if os.path.isfile(p):
            candidate = p
            break

if not candidate:
    out = "Result file not found. Provide _result_file or place result.res/result.txt in _folder."
else:
    try:
        _illuminance = parse_result_file(candidate)
        out = "Read {} values from '{}' (lux).".format(len(_illuminance), os.path.basename(candidate))
    except Exception as e:
        out = "Failed to read result file: {}".format(e)
        _illuminance = []
print(_illuminance)
# ---------- end python_3_script_21 ----------
colrange_4 = LBColorRange(index=Slider(2, range=0..26))  # -> colors; plug-in component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
colrange_5 = LBColorRange(index=Slider(2, range=0..26))  # -> colors; plug-in component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
legendpar_4 = LBLegendParameters(
    min=Slider(60000, range=0..100000),
    max=Slider(70000, range=0..100000),
    colors=colrange_4,
    continuous_leg=Toggle(True),
    num_decimals=Toggle(False),
    text_height=Slider(0.193, range=0..1))  # -> leg_par; plug-in component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
illuminance = Panel(python_3_script_21.illuminance)
# PIT Illuminance Result
result_4 = Python3Script(folder=panel_38)  # -> out, illuminance
# ---------- result_4: Python ----------
ghenv.Component.Message = 'Kybele 1.1.0'


import os, re

_illuminance = []

raw_path = os.path.join(_folder, "raw.txt")
with open(raw_path, "r") as f:
    for line in f:
        s = line.strip()
        if not s or s.startswith(("#", "!")):
            continue

        parts = re.split(r"[,\s]+", s)
        if len(parts) < 3:
            continue

        try:
            r, g, b = float(parts[0]), float(parts[1]), float(parts[2])
        except ValueError:
            continue

        
        rgb_factor = 0.265 * r + 0.670 * g + 0.065 * b
        ill = 179.0 * rgb_factor
        _illuminance.append(ill)

print(_illuminance)
# ---------- end result_4 ----------
legendpar_5 = LBLegendParameters(
    min=Slider(300, range=0..120000),
    max=Slider(3000, range=0..120000),
    colors=colrange_5,
    continuous_leg=Toggle(True),
    num_decimals=Toggle(False),
    text_height=Slider(0.193, range=0..1))  # -> leg_par; plug-in component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
heatmap_6 = LBSpatialHeatmap(values=python_3_script_21.illuminance, mesh=genpts.mesh, legend_par=legendpar_4)  # -> mesh, legend, title, colors, legend_par, vis_set; plug-in component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
heatmap_7 = LBSpatialHeatmap(values=result_4.illuminance, mesh=genpts.mesh, legend_par=legendpar_5)  # -> mesh, legend, title, colors, legend_par, vis_set; plug-in component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

# ----
# Hour Index Selection
# UI for Hour Index Selection
button = Button()
python_3_script_22 = Python3Script(run=button)  # -> selected_hour; same code as python_3_script_11
panel_74 = Panel(python_3_script_22)

select_hour_index = Button()
python_3_script_23 = Python3Script(run=select_hour_index)  # -> hour_index
# ---------- python_3_script_23: Python ----------
from System.Windows.Forms import (
    Form, MonthCalendar, Panel, Label, ComboBox, Button,
    RadioButton, FormBorderStyle, FormStartPosition, ComboBoxStyle,
    MessageBox
)
from System.Drawing import Point, Size, Font, FontStyle, ContentAlignment, Color
from System import DateTime
import scriptcontext as sc
import Rhino

# Sticky key
key = 'selected_hour_index'

if _run:

    class CalendarForm(Form):
        def __init__(self):
            Form.__init__(self)
            
            self.Text = "Select Date and Hour"
            self.Size = Size(353, 420)
            self.BackColor = Color.White
            self.StartPosition = self.StartPosition.CenterScreen
            self.FormBorderStyle = self.FormBorderStyle.FixedDialog
            self.MaximizeBox = False
            self.MinimizeBox = False

            # Calendar
            self.calendar = MonthCalendar()
            self.calendar.Location = Point(10, 10)
            self.calendar.MaxSelectionCount = 1
            self.calendar.ShowToday = False
            self.calendar.ShowTodayCircle = False
            self.Controls.Add(self.calendar)

            # month label
            self.calendar.DateChanged += self.update_month_label
            # Block Feb 29
            self.calendar.DateChanged += self.block_feb_29

            # YEAR
            self.header_cover = Panel()
            self.header_cover.Size = Size(200, 30)
            self.header_cover.Location = Point(70, 35)
            self.header_cover.BackColor = Color.White
            self.Controls.Add(self.header_cover)
            self.header_cover.BringToFront()

            # Custom Label month
            self.month_label = Label()
            self.month_label.Text = self.calendar.SelectionStart.ToString("MMMMMMM")
            self.month_label.Location = Point(90, 32)
            self.month_label.Size = Size(150, 30)
            self.month_label.Font = Font("Segoe UI", 10, FontStyle.Bold)
            self.month_label.BackColor = Color.White
            self.month_label.TextAlign = ContentAlignment.MiddleCenter
            self.Controls.Add(self.month_label)
            self.month_label.BringToFront()

            # Hour Label
            self.hour_label = Label()
            self.hour_label.Text = "Hour:"
            self.hour_label.Location = Point(20, 270)
            self.Controls.Add(self.hour_label)

            # Hour Dropdown
            self.hour_combo = ComboBox()
            self.hour_combo.Location = Point(120, 265)
            self.hour_combo.Size = Size(200, 24)
            self.hour_combo.DropDownStyle = ComboBoxStyle.DropDownList
            for i in range(1, 13):
                self.hour_combo.Items.Add(str(i))
            self.hour_combo.SelectedIndex = 0
            self.Controls.Add(self.hour_combo)

            # AM Radio
            self.am_radio = RadioButton()
            self.am_radio.Text = "AM"
            self.am_radio.Font = Font("Segoe UI", 7)
            self.am_radio.Location = Point(120, 300)
            self.am_radio.Checked = True
            self.Controls.Add(self.am_radio)

            # PM Radio
            self.pm_radio = RadioButton()
            self.pm_radio.Text = "PM"
            self.pm_radio.Font = Font("Segoe UI", 7)
            self.pm_radio.Location = Point(230, 300)
            self.Controls.Add(self.pm_radio)

            # OK Button
            self.ok_button = Button()
            self.ok_button.Text = "OK"
            self.ok_button.Size = Size(310, 30)
            self.ok_button.Location = Point(10, 330)
            self.ok_button.Click += self.on_ok_click
            self.Controls.Add(self.ok_button)

        def update_month_label(self, sender, args):
            self.month_label.Text = self.calendar.SelectionStart.ToString("MMMM")

        # prevent selecting Feb 29
        def block_feb_29(self, sender, args):
            d = self.calendar.SelectionStart
            if d.Month == 2 and d.Day == 29:
                MessageBox.Show("February 29 is not supported in this workflow.", "Invalid date")
                safe = DateTime(d.Year, 2, 28)
                self.calendar.SetDate(safe)

        def on_ok_click(self, sender, args):
            date = self.calendar.SelectionStart

            # Validate
            if date.Month == 2 and date.Day == 29:
                MessageBox.Show("February 29 is not supported in this workflow.", "Invalid date")
                return

            hour = int(self.hour_combo.SelectedItem)
            if self.pm_radio.Checked and hour != 12:
                hour += 12
            if self.am_radio.Checked and hour == 12:
                hour = 0

            dt = DateTime(date.Year, date.Month, date.Day, hour, 0, 0)
            # Map hours
            h = dt.Hour  # 0..23
            offset_hour = (h + 23) % 24
            index = (dt.DayOfYear - 1) * 24 + offset_hour
            sc.sticky[key] = index
            self.Close()

    form = CalendarForm()
    form.ShowDialog()

# Output
hour_index = sc.sticky.get(key, None)
# ---------- end python_3_script_23 ----------
# Kybele Workflow
# Illuminance
# Kybele component for Illuminance
number_slider_11 = Slider(0, range=0..10)
# DLI
# Kybele component for DLI
number_slider_12 = Slider(4, range=0..10)
# PAR
# Kybele component for PAR
number_slider_13 = Slider(7, range=0..10)
point_in_time_illuminance = Python3Script(result=xdata.values, hour_index=python_3_script_23, conversion_factor=python_3_script_9.conversion_factor)  # -> out, flatten(DLI), hourly_DLI; inputs result: tree, hour_index: Int32
# ---------- point_in_time_illuminance: Python ----------
ghenv.Component.Message = 'Kybele 1.0.0'


import System
from Grasshopper import DataTree
from Grasshopper.Kernel.Data import GH_Path

_DLI = []
_hourly_DLI = DataTree[System.Object]()

def is_tree(x):
    return hasattr(x, "BranchCount") and hasattr(x, "Branch") and hasattr(x, "Path")

def to_float(x):
    try: return float(x)
    except:
        try: return float(str(x))
        except: return None

def parse_factor(val):
    default = 0.0185
    if isinstance(val, (int, float)): return float(val)
    if val is None: return default
    s = str(val).strip().lower()
    if s in ("electric","elec","electriconly","electric_light","electriclighting"): return 0.015
    if s in ("sunonly","sun","sunlight"): return 0.0205
    if s in ("skyonly","sky"): return 0.0135
    try: return float(s)
    except: return default

def hourly_dli_from_lux(lux24, k):
    hourly = []
    total = 0.0
    for v in lux24:
        fv = to_float(v)
        if fv is None:
            hourly.append(None)
        else:
            ppfd = fv * k
            mol  = ppfd * 3600.0 / 1e6    
            hourly.append(mol)
            total += mol
    return hourly, total

if is_tree(_result) and _result.BranchCount > 0 and _hour_index is not None:
    k = parse_factor(_conversion_factor)
    h = max(0, int(_hour_index))

    for bi in range(_result.BranchCount):
        br = _result.Branch(_result.Path(bi))
        L = len(br)
        path = GH_Path(bi)

        if L == 0:
            _DLI.append(None)
            continue

        # calendar-day
        days_available = max(1, L // 24) if L >= 24 else 1
        day_idx = min(h // 24, days_available - 1)
        start = day_idx * 24
        end   = min(start + 24, L)

        # day's lux
        lux24 = [br[i] for i in range(start, end)]

        hourly, total = hourly_dli_from_lux(lux24, k)


        if len(hourly) < 24:
            hourly += [None] * (24 - len(hourly))

        # hourly values
        for val in hourly:
            _hourly_DLI.Add(val, path)

        _DLI.append(total)
else:
    pass
# ---------- end point_in_time_illuminance ----------
python_3_script_24 = Python3Script(
    result=xdata.values,
    conversion_factor=python_3_script_9.conversion_factor,
    sensor_index=number_slider_13,
    sensor_pts=genpts.points,
    mark=Toggle(False),
    marker_size=Slider(0.52, range=0..10))  # -> out, PAR, sensor_pt, marker; inputs result: tree, sensor_index: Int32, sensor_pts: tree, mark: Boolean, marker_size: Double
# ---------- python_3_script_24: Python ----------
ghenv.Component.Message = 'Kybele 1.0.0'


import Rhino.Geometry as rg
import scriptcontext as sc
import System


_PAR, _marker = [], []
_sensor_pt = None

# Tree
def is_tree(x):
    return hasattr(x, "BranchCount") and hasattr(x, "Branch") and hasattr(x, "Path")

def flat_items(T):
    L = []
    for bi in range(T.BranchCount):
        br = T.Branch(T.Path(bi))
        for it in br:
            L.append(it)
    return L

def coerce_point(x):
    if isinstance(x, rg.Point3d):
        return x
    if hasattr(x, "Location"):
        return x.Location
    if isinstance(x, (list, tuple)) and len(x) == 3:
        try:
            return rg.Point3d(float(x[0]), float(x[1]), float(x[2]))
        except:
            return None
    if isinstance(x, System.Guid):
        obj = sc.doc.Objects.FindId(x)
        if obj and hasattr(obj, "Geometry") and isinstance(obj.Geometry, rg.Point):
            return obj.Geometry.Location
    return None

def to_float(x):
    try:
        return float(x)
    except:
        try:
            return float(str(x))
        except:
            return None

def parse_factor(val):
    default = 0.0185
    if isinstance(val, (int, float)):
        return float(val)
    if val is None:
        return default
    s = str(val).strip().lower()
    if s in ("electric","elec","electriconly","electric_light","electriclighting"):
        return 0.015
    if s in ("sunonly","sun","sunlight"):
        return 0.0205
    if s in ("skyonly","sky"):
        return 0.0135
    try:
        return float(s)
    except:
        return default

def lux_to_par_list(lux_list, factor):
    k = float(factor)
    out = []
    for v in lux_list:
        fv = to_float(v)
        out.append(fv * k if fv is not None else None)
    return out

# illuminance branch
if is_tree(_result) and _result.BranchCount > 0:
    n = _result.BranchCount
    idx = int(_sensor_index)
    if 0 <= idx < n:
        lux_branch = _result.Branch(_result.Path(idx))
        lux_vals = [to_float(x) for x in lux_branch]
        factor = parse_factor(_conversion_factor)
        _PAR = lux_to_par_list(lux_vals, factor)

        # sensor point
        if _sensor_pts is not None:
            if is_tree(_sensor_pts):
                pts_flat = flat_items(_sensor_pts)
                if len(pts_flat) > idx:
                    _sensor_pt = coerce_point(pts_flat[idx])
            elif isinstance(_sensor_pts, (list, tuple)) and len(_sensor_pts) > idx:
                _sensor_pt = coerce_point(_sensor_pts[idx])

# hemisphere marker
if _mark and (_sensor_pt is not None) and (_marker_size is not None) and (_marker_size > 0):
    r = float(_marker_size) * 0.5
    sphere_brep = rg.Brep.CreateFromSphere(rg.Sphere(_sensor_pt, r))

    # cut plane
    up = _marker_up if (_marker_up and _marker_up.IsValid and _marker_up.Length > 0) else rg.Vector3d.ZAxis
    up.Unitize()
    pl = rg.Plane(_sensor_pt, up)

    # finite plane-brep
    side = _marker_size * 10.0
    psrf = rg.PlaneSurface(pl, rg.Interval(-side, side), rg.Interval(-side, side))
    pbrep = psrf.ToBrep()

    tol = sc.doc.ModelAbsoluteTolerance if sc.doc else 1e-6
    parts = sphere_brep.Split(pbrep, tol)
    if parts and len(parts) >= 2:
        # piece
        def score(b):
            c = b.GetBoundingBox(True).Center
            return rg.Vector3d(c - _sensor_pt) * up   # dot
        _marker = [max(parts, key=score)]
else:
    _marker = []
# ---------- end python_3_script_24 ----------
python_3_script_25 = Python3Script(
    result=xdata.values,
    conversion_factor=python_3_script_9.conversion_factor,
    sensor_index=number_slider_12,
    sensor_pts=genpts.points,
    mark=Toggle(False),
    marker_size=Slider(1.01, range=0..10))  # -> out, DLI, sensor_pt, marker; inputs result: tree, sensor_index: Int32, sensor_pts: tree, mark: Boolean, marker_size: Double
# ---------- python_3_script_25: Python ----------
ghenv.Component.Message = 'Kybele 1.0.0'


import Rhino.Geometry as rg
import scriptcontext as sc
import System

_DLI, _marker = [], []
_sensor_pt = None

# Tree
def is_tree(x):
    return hasattr(x, "BranchCount") and hasattr(x, "Branch") and hasattr(x, "Path")

def flat_items(T):
    L = []
    for bi in range(T.BranchCount):
        br = T.Branch(T.Path(bi))
        for it in br: L.append(it)
    return L

def coerce_point(x):
    if isinstance(x, rg.Point3d): return x
    if hasattr(x, "Location"):    return x.Location
    if isinstance(x, (list, tuple)) and len(x) == 3:
        try: return rg.Point3d(float(x[0]), float(x[1]), float(x[2]))
        except: return None
    if isinstance(x, System.Guid):
        obj = sc.doc.Objects.FindId(x)
        if obj and hasattr(obj, "Geometry") and isinstance(obj.Geometry, rg.Point):
            return obj.Geometry.Location
    return None

def to_float(x):
    try: return float(x)
    except:
        try: return float(str(x))
        except: return None

def parse_factor(val):
    default = 0.0185
    if isinstance(val, (int, float)): return float(val)
    if val is None: return default
    s = str(val).strip().lower()
    if s in ("electric","elec","electriconly","electric_light","electriclighting"):
        return 0.015
    if s in ("sunonly","sun","sunlight"):
        return 0.0205
    if s in ("skyonly","sky"):
        return 0.0135
    try: return float(s)
    except: return default

def dli_from_par_day(par24):
    """par24: list of 24 PPFD values (µmol·s⁻¹·m⁻²) → DLI (mol·m⁻²·day⁻¹)"""
    s = 0.0
    for v in par24:
        if v is not None:
            s += v * 3600.0 / 1e6
    return s

# selected sensor branch
if is_tree(_result) and _result.BranchCount > 0:
    n = _result.BranchCount
    idx = int(_sensor_index)
    if 0 <= idx < n:
        lux_branch = _result.Branch(_result.Path(idx))
        lux_vals = [to_float(x) for x in lux_branch]

        # lux to PAR
        k = parse_factor(_conversion_factor)
        par_vals = [ (v * k if v is not None else None) for v in lux_vals ]

        # group by day
        hours = len(par_vals)
        days = min(365, hours // 24)
        _DLI = []
        for d in range(days):
            day_slice = par_vals[d*24:(d+1)*24]
            _DLI.append(dli_from_par_day(day_slice))

        # resolve sensor point
        if _sensor_pts is not None:
            if is_tree(_sensor_pts):
                pts_flat = flat_items(_sensor_pts)
                if len(pts_flat) > idx:
                    _sensor_pt = coerce_point(pts_flat[idx])
            elif isinstance(_sensor_pts, (list, tuple)) and len(_sensor_pts) > idx:
                _sensor_pt = coerce_point(_sensor_pts[idx])

# marker 
if _mark and (_sensor_pt is not None) and (_marker_size is not None) and (_marker_size > 0):
    r = float(_marker_size) * 0.5
    sphere_brep = rg.Brep.CreateFromSphere(rg.Sphere(_sensor_pt, r))

    up = _marker_up if (_marker_up and _marker_up.IsValid and _marker_up.Length > 0) \
         else rg.Vector3d.ZAxis
    up.Unitize()
    pl = rg.Plane(_sensor_pt, up)

    side = _marker_size * 10.0
    psrf = rg.PlaneSurface(pl, rg.Interval(-side, side), rg.Interval(-side, side))
    pbrep = psrf.ToBrep()

    tol = sc.doc.ModelAbsoluteTolerance if sc.doc else 1e-6
    parts = sphere_brep.Split(pbrep, tol)
    if parts and len(parts) >= 2:
        def score(b):
            c = b.GetBoundingBox(True).Center
            return rg.Vector3d(c - _sensor_pt) * up
        _marker = [max(parts, key=score)]
else:
    _marker = []
# ---------- end python_3_script_25 ----------
point_in_time_illuminance_2 = Python3Script(result=xdata.values, hour_index=python_3_script_23, conversion_factor=python_3_script_9.conversion_factor)  # -> out, flatten(PAR); inputs result: tree
# ---------- point_in_time_illuminance_2: Python ----------
ghenv.Component.Message = 'Kybele 1.0.0'


import Rhino.Geometry as rg

_PAR = []

def is_tree(x):
    return hasattr(x, "BranchCount") and hasattr(x, "Branch") and hasattr(x, "Path")

def to_float(x):
    try:
        return float(x)
    except:
        try:
            return float(str(x))
        except:
            return None

def parse_factor(val):
    default = 0.0185
    if isinstance(val, (int, float)):
        return float(val)
    if val is None:
        return default
    s = str(val).strip().lower()
    if s in ("electric","elec","electriconly","electric_light","electriclighting"):
        return 0.015
    if s in ("sunonly","sun","sunlight"):
        return 0.0205
    if s in ("skyonly","sky"):
        return 0.0135
    try:
        return float(s)
    except:
        return default

def lux_to_par(lux, factor):
    return lux * factor

# main
if is_tree(_result) and _result.BranchCount > 0 and _hour_index is not None:
    k = parse_factor(_conversion_factor)
    h = int(_hour_index)

    for bi in range(_result.BranchCount):
        br = _result.Branch(_result.Path(bi))
        if 0 <= h < len(br):
            v = to_float(br[h])
            _PAR.append(lux_to_par(v, k) if v is not None else None)
        else:
            _PAR.append(None)
else:
    _PAR = []
# ---------- end point_in_time_illuminance_2 ----------
python_3_script_26 = Python3Script(
    result=xdata.values,
    sensor_index=number_slider_11,
    sensor_pts=genpts.points,
    mark=Toggle(False),
    marker_size=Slider(1.05, range=0..10))  # -> out, illuminance, sensor_pt, marker; inputs result: tree, sensor_index: Int32, sensor_pts: tree, mark: Boolean, marker_size: Double
# ---------- python_3_script_26: Python ----------
ghenv.Component.Message = 'Kybele 1.0.0'


import Rhino.Geometry as rg
import scriptcontext as sc


_illuminance, _marker = [], []
_sensor_pt = None

def is_tree(x):
    return hasattr(x, "BranchCount") and hasattr(x, "Branch") and hasattr(x, "Path")

def flat_items(T):
    out = []
    for bi in range(T.BranchCount):
        for it in T.Branch(T.Path(bi)):
            out.append(it)
    return out

def as_pt3d(x):
    try:
        if isinstance(x, rg.Point3d): return x
        if hasattr(x, "Location"):    return x.Location  # GH_Point
        if isinstance(x, (list, tuple)) and len(x) == 3:
            return rg.Point3d(float(x[0]), float(x[1]), float(x[2]))
    except:
        pass
    return None

# values and sensor point
if is_tree(_result) and _result.BranchCount > 0:
    n = _result.BranchCount
    idx = max(0, min(int(_sensor_index), _result.BranchCount-1))

    if 0 <= idx < n:
        br = _result.Branch(_result.Path(idx))
        _illuminance = [float(x) for x in br]

        if _sensor_pts is not None:
            if is_tree(_sensor_pts):
                if _sensor_pts.BranchCount == n:
                    b = _sensor_pts.Branch(_sensor_pts.Path(idx))
                    if len(b) > 0: _sensor_pt = as_pt3d(b[0])
                else:
                    f = flat_items(_sensor_pts)
                    if len(f) > idx: _sensor_pt = as_pt3d(f[idx])
            elif isinstance(_sensor_pts, (list, tuple)) and len(_sensor_pts) > idx:
                _sensor_pt = as_pt3d(_sensor_pts[idx])

# upper hemisphere marker
if _mark and (_sensor_pt is not None) and (_marker_size is not None) and (_marker_size > 0):
    r = float(_marker_size) * 0.5

    # sphere
    s_brep = rg.Brep.CreateFromSphere(rg.Sphere(_sensor_pt, r))

    # cut plane
    up = _marker_up if (_marker_up and _marker_up.IsValid and _marker_up.Length > 0) else rg.Vector3d.ZAxis
    up.Unitize()
    pl = rg.Plane(_sensor_pt, up)

    # finite plane-brep
    side = _marker_size * 10.0
    psrf = rg.PlaneSurface(pl, rg.Interval(-side, side), rg.Interval(-side, side))
    pbrep = psrf.ToBrep()

    tol = sc.doc.ModelAbsoluteTolerance if sc.doc else 1e-6
    parts = s_brep.Split(pbrep, tol)

    if parts and len(parts) >= 2:
        # half
        def score(b):
            c = b.GetBoundingBox(True).Center
            return rg.Vector3d(c - _sensor_pt) * up
        hemi = max(parts, key=score)
        _marker = [hemi]
else:
    _marker = []
# ---------- end python_3_script_26 ----------
point_in_time_illuminance_3 = Python3Script(data=xdata.values, hour_index=python_3_script_23)  # -> out, illuminance; inputs data: tree
# ---------- point_in_time_illuminance_3: Python ----------
ghenv.Component.Message = 'Kybele 1.0.0'


import Grasshopper as gh

def extract_lux_for_hour(data_tree, hour_index):
    """Get illuminance values (lux) from a DataTree at a specific hour index."""
    try:
        lux_list = []
        for i in range(data_tree.BranchCount):
            branch = data_tree.Branch(i)
            if branch.Count > hour_index and hour_index >= 0:
                try:
                    lux_list.append(float(branch[hour_index]))
                except:
                    lux_list.append(None)
            else:
                lux_list.append(None)
        return lux_list
    except Exception as e:
        raise RuntimeError("Error at hour {}: {}".format(hour_index, str(e)))

# Run
try:
    if _hour_index is None:
        raise ValueError("Provide _hour_index (0-based hour-of-year).")

    # validate
    hour = int(_hour_index)
    if hour < 0:
        raise ValueError("_hour_index must be >= 0.")

    _illuminance = extract_lux_for_hour(_data, hour)
    print("Hour index:", hour)

except Exception as e:
    _illuminance = "Failed: " + str(e)
# ---------- end point_in_time_illuminance_3 ----------
panel_75 = Panel(point_in_time_illuminance_3.illuminance)
panel_76 = Panel(python_3_script_25.sensor_pt)
panel_77 = Panel(point_in_time_illuminance.DLI)
panel_78 = Panel(python_3_script_24.sensor_pt)
panel_79 = Panel(python_3_script_26.illuminance)
panel_80 = Panel(point_in_time_illuminance_2.PAR)
custom_preview_3 = CustomPreview(Geometry=python_3_script_26.marker, Material=ColourSwatch(SwatchColor=RGBA(31, 31, 31, 92)))
custom_preview_4 = CustomPreview(Geometry=python_3_script_24.marker, Material=ColourSwatch(SwatchColor=RGBA(31, 31, 31, 92)))
custom_preview_5 = CustomPreview(Geometry=python_3_script_25.marker, Material=ColourSwatch(SwatchColor=RGBA(31, 31, 31, 92)))
grid_mode_2 = Slider(3, range=0..3)

colrange_6 = LBColorRange(index=Slider(2, range=0..26))  # -> colors; plug-in component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
legendpar_6 = LBLegendParameters(
    min=Slider(3000, range=0..120000),
    max=Slider(30000, range=0..120000),
    colors=colrange_6,
    continuous_leg=Toggle(True),
    num_decimals=Toggle(False),
    text_height=Slider(0.193, range=0..1))  # -> leg_par; plug-in component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

grid_mode_3 = Slider(3, range=0..3)
grid_mode_4 = Slider(0, range=0..3)
colrange_7 = LBColorRange(index=Slider(2, range=0..26))  # -> colors; plug-in component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
colrange_8 = LBColorRange(index=Slider(2, range=0..26))  # -> colors; plug-in component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
colrange_9 = LBColorRange(index=Slider(2, range=0..26))  # -> colors; plug-in component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
run_2 = Button()
run_3 = Button()
run_4 = Button()
legendpar_7 = LBLegendParameters(
    min=Slider(3000, range=0..120000),
    max=Slider(30000, range=0..120000),
    colors=colrange_7,
    continuous_leg=Toggle(True),
    num_decimals=Toggle(False),
    text_height=Slider(0.193, range=0..1))  # -> leg_par; plug-in component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
python_3_script_27 = Python3Script(
    result_hourly=python_3_script_26.illuminance,
    graph_title="Hourly Heat Map",
    range1=Slider(300, range=0..100000),
    range2=Slider(3000, range=0..100000),
    range3=Slider(10000, range=0..100000),
    range4=Slider(30000, range=0..100000),
    name_range1="Failing",
    name_range2="Low",
    name_range3="Supplemental",
    name_range4="Acceptable",
    name_range5="Excessive",
    run=run_2,
    grid_mode=grid_mode_3,
    grid_color=ColourSwatch(SwatchColor=RGB(207, 207, 207)))  # -> out, form; inputs result_hourly: list; same code as python_3_script_18
legendpar_8 = LBLegendParameters(
    min=Slider(100, range=0..120000),
    max=Slider(800, range=0..120000),
    colors=colrange_8,
    continuous_leg=Toggle(True),
    num_decimals=Toggle(False),
    text_height=Slider(0.193, range=0..1))  # -> leg_par; plug-in component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
python_3_script_28 = Python3Script(
    result_hourly=python_3_script_24.PAR,
    graph_title="Hourly Heat Map",
    range1=Slider(100, range=0..1000),
    range2=Slider(200, range=0..1000),
    range3=Slider(400, range=0..1000),
    range4=Slider(800, range=0..1000),
    name_range1="Failing",
    name_range2="Low",
    name_range3="Supplemental",
    name_range4="Acceptable",
    name_range5="Excessive",
    run=run_4,
    grid_mode=grid_mode_4,
    grid_color=ColourSwatch(SwatchColor=RGB(207, 207, 207)))  # -> out, form; inputs result_hourly: list
# ---------- python_3_script_28: Python ----------
ghenv.Component.Message = 'Kybele 1.0.0'


import System.Windows.Forms as WinForms
import System.Drawing as Drawing
from System.Drawing import Point, Color
from System.Drawing.Drawing2D import SmoothingMode, PixelOffsetMode

# Inputs
if not _run:
    ghenv.Component.Message = 'Kybele 1.0.0' # "Waiting for _run trigger"
else:
    try:
        flat_data = [float(x) for x in _result_hourly if x is not None]
        if len(flat_data) != 8760:
            raise ValueError("Expected 8760 values.")
    except:
        WinForms.MessageBox.Show("PAR_8760 must contain exactly 8760 float values.", "Error")
        raise

    thresholds = [
        float(_range1) if _range1 is not None else 0,
        float(_range2) if _range2 is not None else 10,
        float(_range3) if _range3 is not None else 20,
        float(_range4) if _range4 is not None else 50
    ]

    # Ascending thresholds
    if not (thresholds[0] <= thresholds[1] <= thresholds[2] <= thresholds[3]):
        WinForms.MessageBox.Show("Ranges must be ascending (r1 ≤ r2 ≤ r3 ≤ r4).", "Invalid Ranges")
        raise ValueError("Non-ascending thresholds")

    # Color Setup
    def to_color(val):
        if val is None:
            return Color.LightGray
        if isinstance(val, Color):
            return val
        if isinstance(val, (tuple, list)) and len(val) == 3:
            return Color.FromArgb(int(val[0]), int(val[1]), int(val[2]))
        if isinstance(val, str):
            s = val.strip()
            if ',' in s or ' ' in s:
                s = s.replace('(', '').replace(')', '')
                parts = [p for p in s.replace(',', ' ').split(' ') if p]
                if len(parts) == 3:
                    r, g, b = [int(float(p)) for p in parts]
                    return Color.FromArgb(r, g, b)
            s = s.lstrip('#')
            if len(s) == 6:
                r = int(s[0:2], 16); g = int(s[2:4], 16); b = int(s[4:6], 16)
                return Color.FromArgb(r, g, b)
        raise ValueError("Unsupported color format: use '#rrggbb', (r,g,b), 'r,g,b', or a GH Color.")

    def hex_to_color(hex_str):
        s = hex_str.lstrip('#')
        return Drawing.Color.FromArgb(int(s[0:2], 16), int(s[2:4], 16), int(s[4:6], 16))

    # Grid / inset mode
    mode = int(round(float(_grid_mode))) if _grid_mode is not None else 0
    mode = max(0, min(3, mode))

    INSET = 0.5
    inset_px     = INSET if mode == 1 else 0.0
    grid_enabled = (mode in (2, 3))
    grid_color   = to_color("#636363") if mode == 3 else \
                   (to_color(_grid_color) if _grid_color else Drawing.Color.LightGray)

    # Bucket 0 color
    first_color = hex_to_color("#808080") if mode == 3 else hex_to_color("#ffffff")

    colors = [
        first_color,                 # imperceptible
        hex_to_color("#f9ebab"),     # perceptible
        hex_to_color("#f0be39"),     # disturbing
        hex_to_color("#e46828"),     # intolerable
        hex_to_color("#d70e17")      # excessive
    ]

    # Classification
    def classify(value):
        if value <= thresholds[0]: return 0
        elif value <= thresholds[1]: return 1
        elif value <= thresholds[2]: return 2
        elif value <= thresholds[3]: return 3
        else: return 4

    # Custom range names
    def _safe_name(val, default):
        return val if (val is not None and str(val).strip() != "") else default

    n1 = _safe_name(globals().get("_name_range1"), "Imperceptible")
    n2 = _safe_name(globals().get("_name_range2"), "Perceptible")
    n3 = _safe_name(globals().get("_name_range3"), "Disturbing")
    n4 = _safe_name(globals().get("_name_range4"), "Intolerable")
    n5 = _safe_name(globals().get("_name_range5"), "Excessive")
    range_names = [n1, n2, n3, n4, n5]


    # Heatmap Form Class
    class PARHeatmapForm(WinForms.Form):
        def __init__(self, data):
            super(PARHeatmapForm, self).__init__()
            self.Text = "Hourly Heat Map"
            self.StartPosition = WinForms.FormStartPosition.CenterScreen
            self.FormBorderStyle = WinForms.FormBorderStyle.Sizable
            self.DoubleBuffered = True
            self.BackColor = Drawing.Color.Gray if mode == 3 else Drawing.Color.White


            self.mode = mode
            self.inset_px = inset_px
            self.grid_enabled = grid_enabled
            self.grid_color = grid_color
            self.colors = colors
            self.range_names = range_names

            self.cell_w = 4
            self.cell_h = 20
            self.cols = 365
            self.rows = 24
            self.title_height = 25
            self.margin_top = 40
            self.margin_right = 130
            self.margin_left = 30
            self.margin_bottom = 200
            self.data = data

            self.ClientSize = Drawing.Size(
                self.margin_left + self.cols * self.cell_w + self.margin_right,
                self.rows * self.cell_h + self.margin_bottom + self.margin_top
            )

            self.Paint += self.on_paint
            self.MouseMove += self.on_mouse_move

            self.save_btn = WinForms.Button()
            self.save_btn.Text = "Export PNG"
            self.save_btn.Height = 30
            self.save_btn.Dock = WinForms.DockStyle.Bottom
            self.save_btn.Margin = WinForms.Padding(0, 10, 0, 10)
            self.save_btn.Click += self.on_export_click
            self.Controls.Add(self.save_btn)

            self.hover_label = WinForms.Label()
            self.hover_label.AutoSize = True
            self.hover_label.Location = Point(120, self.rows * self.cell_h + self.margin_top + 70)
            self.Controls.Add(self.hover_label)

        def on_paint(self, sender, e):
            g = e.Graphics
            g.SmoothingMode = SmoothingMode.Default
            g.PixelOffsetMode = PixelOffsetMode.HighSpeed

            # Shift title
            g.TranslateTransform(self.margin_left, self.margin_top + self.title_height)

            # GDI objects
            bucket_brushes = [Drawing.SolidBrush(c) for c in self.colors]
            grid_pen = Drawing.Pen(self.grid_color) if self.grid_enabled else None

            # Heatmap cells
            inset = float(self.inset_px)
            for i in range(self.rows):
                for j in range(self.cols):
                    idx = j * 24 + i
                    value = self.data[idx]
                    cat = classify(value)
                    brush = bucket_brushes[cat]

                    x = j * self.cell_w
                    y = i * self.cell_h

                    # symmetric inset
                    ix = x + inset
                    iy = y + inset
                    w  = self.cell_w  - 2 * inset
                    h  = self.cell_h  - 2 * inset

                    g.FillRectangle(brush, ix, iy, w, h)

                    if self.grid_enabled:
                        g.DrawRectangle(grid_pen, x, y, self.cell_w, self.cell_h)

            # Month dividers and labels
            month_starts = [0, 31, 59, 90, 120, 151, 181, 212, 243, 273, 304, 334]
            month_names = ["Jan", "Feb", "Mar", "Apr", "May", "Jun",
                           "Jul", "Aug", "Sep", "Oct", "Nov", "Dec"]

            if self.mode == 2:
                month_pen = Drawing.Pens.Gray
            elif self.mode == 3:
                month_pen = Drawing.Pens.Black
            else:
                month_pen = Drawing.Pens.LightGray

            for idx, day in enumerate(month_starts):
                x = day * self.cell_w
                g.DrawLine(month_pen, x, 0, x, self.rows * self.cell_h)
                g.DrawString(month_names[idx], self.Font, Drawing.Brushes.Black,
                             x + 50, self.rows * self.cell_h + 5)

            # Hour labels
            for i in [0, 6, 12, 18, 24]:
                if i <= 24:
                    label = str(i).zfill(2) + ":00"
                    y = i * self.cell_h - 20
                    g.DrawString(label, self.Font, Drawing.Brushes.Black,
                                 self.cols * self.cell_w + 5, y)


            # Legend (counts + labels)
            legend_counts = [0] * 5
            for val in self.data:
                legend_counts[classify(val)] += 1

            total = float(len(self.data))
            percentages = [int(round(c / total * 100)) for c in legend_counts]

            legend_labels = [
                "{}% {}".format(percentages[0], self.range_names[0]),
                "{}% {}".format(percentages[1], self.range_names[1]),
                "{}% {}".format(percentages[2], self.range_names[2]),
                "{}% {}".format(percentages[3], self.range_names[3]),
                "{}% {}".format(percentages[4], self.range_names[4])
            ]

            legend_spacing = 55
            legend_elements = []
            total_width = 0
            for i in range(5):
                label = legend_labels[i]
                label_size = g.MeasureString(label, self.Font)
                element_width = 20 + 5 + int(label_size.Width) + legend_spacing
                legend_elements.append((label, element_width))
                total_width += element_width

            legend_x = (self.cols * self.cell_w - total_width) // 2
            legend_y = self.rows * self.cell_h + self.margin_top + 45

            for i, (label, element_width) in enumerate(legend_elements):
                g.FillRectangle(bucket_brushes[i], legend_x, legend_y, 20, 15)
                g.DrawString(label, self.Font, Drawing.Brushes.Black, legend_x + 25, legend_y)
                legend_x += element_width


            # Reset transform
            g.ResetTransform()


            # Title
            title_font = Drawing.Font(self.Font.FontFamily, 10) # Drawing.FontStyle.Bold
            title = _graph_title or ""
            sz = g.MeasureString(title, title_font)
            g.DrawString(_graph_title, title_font, Drawing.Brushes.Black,
                        self.margin_left + (self.cols * self.cell_w - sz.Width) / 2.0, 10)

            # X-Axis Label
            g.DrawString("Day of Year", self.Font, Drawing.Brushes.Black,
                        self.margin_left + self.cols * self.cell_w // 2 - 30,
                        self.rows * self.cell_h + self.margin_top + 70)

            # Y-Axis Label
            g.TranslateTransform(self.cols * self.cell_w + 90,
                                 self.margin_top + self.rows * self.cell_h // 2 + 30)
            g.RotateTransform(-90)
            g.DrawString("Time of Day", self.Font, Drawing.Brushes.Black, -60, 30)
            g.ResetTransform()

            # GDI objects
            if grid_pen: grid_pen.Dispose()
            for b in bucket_brushes: b.Dispose()

        def on_mouse_move(self, sender, e):
            x, y = e.X, e.Y
            col = (x - self.margin_left) // self.cell_w
            row = (y - self.margin_top - self.title_height) // self.cell_h
            if 0 <= col < 365 and 0 <= row < 24:
                index = col * 24 + row
                val = round(self.data[index], 2)
                self.hover_label.Text = f"Day {col+1}, Hour {row}: {val}"

        def on_export_click(self, sender, args):
            dialog = WinForms.SaveFileDialog()
            dialog.Filter = "PNG Image|*.png"
            dialog.FileName = _graph_title
            if dialog.ShowDialog() == WinForms.DialogResult.OK:
                try:
                    bmp = Drawing.Bitmap(self.ClientSize.Width, self.ClientSize.Height)
                    g = Drawing.Graphics.FromImage(bmp)
                    g.Clear(self.BackColor)
                    paint_args = WinForms.PaintEventArgs(g, self.ClientRectangle)
                    self.on_paint(self, paint_args)
                    bmp.Save(dialog.FileName)
                    WinForms.MessageBox.Show("Saved successfully to:\n" + dialog.FileName)
                except Exception as e:
                    WinForms.MessageBox.Show("Export failed:\n" + str(e), "Error")

    # Show Form
    form = PARHeatmapForm(flat_data)
    form.Show()
# ---------- end python_3_script_28 ----------
legendpar_9 = LBLegendParameters(
    min=Slider(22, range=0..100),
    max=Slider(26, range=0..100),
    colors=colrange_9,
    continuous_leg=Toggle(True),
    num_decimals=Toggle(False),
    text_height=Slider(0.193, range=0..1))  # -> leg_par; plug-in component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
python_3_script_29 = Python3Script(
    result_daily=python_3_script_25.DLI,
    graph_title="Daily Heat Map",
    range1=Slider(6, range=0..100),
    range2=Slider(12, range=0..100),
    range3=Slider(18, range=0..100),
    range4=Slider(30, range=0..100),
    name_range1="Failing",
    name_range2="Low",
    name_range3="Supplemental",
    name_range4="Acceptable",
    name_range5="Excessive",
    run=run_3,
    grid_mode=grid_mode_2,
    grid_color=ColourSwatch(SwatchColor=RGB(207, 207, 207)))  # -> out, form; inputs result_daily: list
# ---------- python_3_script_29: Python ----------
import System.Windows.Forms as WinForms
import System.Drawing as Drawing
from System.Drawing import Point, Color
from System.Drawing.Drawing2D import SmoothingMode, PixelOffsetMode

# Color Setup
def to_color(val):
    if val is None:
        return Color.LightGray
    if isinstance(val, Color):
        return val
    if isinstance(val, (tuple, list)) and len(val) == 3:
        return Color.FromArgb(int(val[0]), int(val[1]), int(val[2]))
    if isinstance(val, str):
        s = val.strip()
        if ',' in s or ' ' in s:
            s = s.replace('(', '').replace(')', '')
            parts = [p for p in s.replace(',', ' ').split(' ') if p]
            if len(parts) == 3:
                r, g, b = [int(float(p)) for p in parts]
                return Color.FromArgb(r, g, b)
        s = s.lstrip('#')
        if len(s) == 6:
            r = int(s[0:2], 16); g = int(s[2:4], 16); b = int(s[4:6], 16)
            return Color.FromArgb(r, g, b)
    raise ValueError("Unsupported color: use '#rrggbb', (r,g,b), 'r,g,b', or a GH Color.")

def hex_to_color(hex_str):
    s = hex_str.lstrip('#')
    return Drawing.Color.FromArgb(int(s[0:2], 16), int(s[2:4], 16), int(s[4:6], 16))

def as_float_or_default(x, default):
    try:
        return float(x)
    except (TypeError, ValueError):
        return default

def _safe_name(val, default):
    return val if (val is not None and str(val).strip() != "") else default

# Main
if not _run:
    ghenv.Component.Message = "Waiting for _run trigger"
else:
    # Data
    try:
        flat_data = [float(x) for x in _result_daily if x is not None]
        if len(flat_data) != 365:
            raise ValueError("Expected 365 values.")
    except:
        WinForms.MessageBox.Show("DLI_365 must contain exactly 365 float values.", "Error")
        raise

    # Thresholds
    r1 = as_float_or_default(globals().get("_range1"), 0.0)
    r2 = as_float_or_default(globals().get("_range2", globals().get("_range-2")), 10.0)
    r3 = as_float_or_default(globals().get("_range3"), 20.0)
    r4 = as_float_or_default(globals().get("_range4"), 50.0)
    thresholds = [r1, r2, r3, r4]

    # Ascending guard
    if not (thresholds[0] <= thresholds[1] <= thresholds[2] <= thresholds[3]):
        WinForms.MessageBox.Show("Ranges must be ascending (r1 ≤ r2 ≤ r3 ≤ r4).", "Invalid Ranges")
        raise ValueError("Non-ascending thresholds")

    # Grid / inset mode
    mode = int(round(float(globals().get("_grid_mode", 0)))) if globals().get("_grid_mode") is not None else 0
    mode = max(0, min(3, mode))

    INSET = 0.5
    inset_px     = INSET if mode == 1 else 0.0
    grid_enabled = (mode in (2, 3))

    # Grid color
    _grid_col_in = globals().get("_grid_color", globals().get("grid_color"))
    grid_color = to_color("#636363") if mode == 3 else (to_color(_grid_col_in) if _grid_col_in else Drawing.Color.LightGray)

    # Colors
    first_color = hex_to_color("#808080") if mode == 3 else hex_to_color("#ffffff")
    colors = [
        first_color,                 # bucket 0
        hex_to_color("#f9ebab"),
        hex_to_color("#f0be39"),
        hex_to_color("#e46828"),
        hex_to_color("#d70e17")
    ]

    # Names
    n1 = _safe_name(globals().get("_name_range1"), "Imperceptible")
    n2 = _safe_name(globals().get("_name_range2"), "Perceptible")
    n3 = _safe_name(globals().get("_name_range3"), "Disturbing")
    n4 = _safe_name(globals().get("_name_range4"), "Intolerable")
    n5 = _safe_name(globals().get("_name_range5"), "Excessive")
    range_names = [n1, n2, n3, n4, n5]

    # Classification
    def classify(v):
        if v <= thresholds[0]: return 0
        elif v <= thresholds[1]: return 1
        elif v <= thresholds[2]: return 2
        elif v <= thresholds[3]: return 3
        else: return 4

    # UI Form
    class DLIHeatmapForm(WinForms.Form):
        def __init__(self, data):
            super(DLIHeatmapForm, self).__init__()
            self.Text = "Daily Plot Heat Map"
            self.StartPosition = WinForms.FormStartPosition.CenterScreen
            self.FormBorderStyle = WinForms.FormBorderStyle.Sizable
            self.DoubleBuffered = True
            self.BackColor = Drawing.Color.Gray if mode == 3 else Drawing.Color.White


            self.mode = mode
            self.inset_px = inset_px
            self.grid_enabled = grid_enabled
            self.grid_color = grid_color
            self.colors = colors
            self.range_names = range_names

            # Geometry
            self.cell_w = 4
            self.cell_h = 20 * 12   # = 480
            self.cols = 365
            self.rows = 1
            self.title_height = 25
            self.margin_top = 40
            self.margin_right = 60
            self.margin_bottom = 200
            self.margin_left = 30

            self.data = data

            self.ClientSize = Drawing.Size(
                self.margin_left + self.cols * self.cell_w + self.margin_right,
                self.rows * self.cell_h + self.margin_bottom + self.margin_top
            )

            self.Paint += self.on_paint
            self.MouseMove += self.on_mouse_move

            self.save_btn = WinForms.Button()
            self.save_btn.Text = "Export PNG"
            self.save_btn.Height = 30
            self.save_btn.Dock = WinForms.DockStyle.Bottom
            self.save_btn.Margin = WinForms.Padding(0, 10, 0, 10)
            self.save_btn.Click += self.on_export_click
            self.Controls.Add(self.save_btn)

            self.hover_label = WinForms.Label()
            self.hover_label.AutoSize = True
            self.hover_label.Location = Point(120, self.rows * self.cell_h + self.margin_top + 70)
            self.Controls.Add(self.hover_label)

        def on_paint(self, sender, e):
            g = e.Graphics
            g.SmoothingMode = SmoothingMode.Default
            g.PixelOffsetMode = PixelOffsetMode.HighSpeed

            # Shift title
            g.TranslateTransform(self.margin_left, self.margin_top + self.title_height)

            # GDI objects
            bucket_brushes = [Drawing.SolidBrush(c) for c in self.colors]
            grid_pen = Drawing.Pen(self.grid_color) if self.grid_enabled else None

            # Draw cells
            inset = float(self.inset_px)
            i = 0
            for j in range(self.cols):
                idx = j
                value = self.data[idx]
                cat = classify(value)
                brush = bucket_brushes[cat]

                x = j * self.cell_w
                y = i * self.cell_h

                # symmetric inset
                ix = x + inset
                iy = y + inset
                w  = self.cell_w  - 2 * inset
                h  = self.cell_h  - 2 * inset

                g.FillRectangle(brush, ix, iy, w, h)

                if self.grid_enabled:
                    g.DrawRectangle(grid_pen, x, y, self.cell_w, self.cell_h)

            # Month dividers + labels
            month_starts = [0, 31, 59, 90, 120, 151, 181, 212, 243, 273, 304, 334]
            month_names = ["Jan", "Feb", "Mar", "Apr", "May", "Jun",
                           "Jul", "Aug", "Sep", "Oct", "Nov", "Dec"]

            if self.mode == 2:
                month_pen = Drawing.Pen(Drawing.Color.DimGray, 4.0)
            elif self.mode == 3:
                month_pen = Drawing.Pen(Drawing.Color.Gray, 4.0)
            elif self.mode == 1:
                month_pen = Drawing.Pen(Drawing.Color.White, 5.0)
            else:
                month_pen = Drawing.Pen(Drawing.Color.Black, 1.0)

            for idx, day in enumerate(month_starts):
                x = day * self.cell_w
                g.DrawLine(month_pen, x, 0, x, self.rows * self.cell_h)
                g.DrawString(month_names[idx], self.Font, Drawing.Brushes.Black,
                             x + 50, self.rows * self.cell_h + 5)

            # Legend
            legend_counts = [0] * 5
            for val in self.data:
                legend_counts[classify(val)] += 1

            total = float(len(self.data))
            percentages = [int(round(c / total * 100)) for c in legend_counts]

            legend_labels = [
                "{}% {}".format(percentages[0], self.range_names[0]),
                "{}% {}".format(percentages[1], self.range_names[1]),
                "{}% {}".format(percentages[2], self.range_names[2]),
                "{}% {}".format(percentages[3], self.range_names[3]),
                "{}% {}".format(percentages[4], self.range_names[4])
            ]

            legend_spacing = 55
            legend_elements = []
            total_width = 0
            for i5 in range(5):
                label = legend_labels[i5]
                label_size = g.MeasureString(label, self.Font)
                element_width = 20 + 5 + int(label_size.Width) + legend_spacing
                legend_elements.append((label, element_width))
                total_width += element_width

            legend_x = (self.cols * self.cell_w - total_width) // 2
            legend_y = self.rows * self.cell_h + self.margin_top + 45

            for i5, (label, element_width) in enumerate(legend_elements):
                g.FillRectangle(bucket_brushes[i5], legend_x, legend_y, 20, 15)
                g.DrawString(label, self.Font, Drawing.Brushes.Black, legend_x + 25, legend_y)
                legend_x += element_width

            # Reset transform
            g.ResetTransform()

            # Title
            title_font = Drawing.Font(self.Font.FontFamily, 11, Drawing.FontStyle.Regular)
            title = _graph_title or ""
            sz = g.MeasureString(title, title_font)
            g.DrawString(title, title_font, Drawing.Brushes.Black,
                         self.margin_left + (self.cols * self.cell_w - sz.Width) / 2.0, 10)

            # X-Axis Label
            g.DrawString("Day of Year", self.Font, Drawing.Brushes.Black,
                         self.margin_left + self.cols * self.cell_w // 2 - 30,
                         self.rows * self.cell_h + self.margin_top + 70)

            # Y-Axis Label
            g.TranslateTransform(self.margin_left + self.cols * self.cell_w + 90,
                                 self.margin_top + self.rows * self.cell_h // 2 + 30)
            g.RotateTransform(-90)
            g.DrawString("24 Hours", self.Font, Drawing.Brushes.Black, -35, -80)
            g.ResetTransform()

            # Dispose
            if grid_pen: grid_pen.Dispose()
            month_pen.Dispose()
            for b in bucket_brushes: b.Dispose()

        def on_mouse_move(self, sender, e):
            x, y = e.X, e.Y

            col = (x - self.margin_left) // self.cell_w
            row = (y - (self.margin_top + self.title_height)) // self.cell_h
            if 0 <= col < 365 and 0 <= row < 1:
                index = int(col)
                val = round(self.data[index], 2)
                self.hover_label.Text = f"Day {index+1}: {val}"

        def on_export_click(self, sender, args):
            dialog = WinForms.SaveFileDialog()
            dialog.Filter = "PNG Image|*.png"
            dialog.FileName = _graph_title
            if dialog.ShowDialog() == WinForms.DialogResult.OK:
                try:
                    bmp = Drawing.Bitmap(self.ClientSize.Width, self.ClientSize.Height)
                    g = Drawing.Graphics.FromImage(bmp)
                    g.Clear(self.BackColor)
                    paint_args = WinForms.PaintEventArgs(g, self.ClientRectangle)
                    self.on_paint(self, paint_args)
                    bmp.Save(dialog.FileName)
                    WinForms.MessageBox.Show("Saved successfully to:\n" + dialog.FileName)
                except Exception as e:
                    WinForms.MessageBox.Show("Export failed:\n" + str(e), "Error")

    # Show form
    form = DLIHeatmapForm(flat_data)
    form.Show()
# ---------- end python_3_script_29 ----------
heatmap_8 = LBSpatialHeatmap(values=point_in_time_illuminance_2.PAR, mesh=genpts.mesh, legend_par=legendpar_8)  # -> mesh, legend, title, colors, legend_par, vis_set; plug-in component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
heatmap_9 = LBSpatialHeatmap(values=point_in_time_illuminance.DLI, mesh=genpts.mesh, legend_par=legendpar_9)  # -> mesh, legend, title, colors, legend_par, vis_set; plug-in component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
heatmap_10 = LBSpatialHeatmap(values=point_in_time_illuminance_3.illuminance, mesh=genpts.mesh, legend_par=legendpar_7)  # -> mesh, legend, title, colors, legend_par, vis_set; plug-in component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

# ----
# Visualization Components
# Four Graph styles for Hourly Graph 5 Ranges and 4 ranges,
# Daily Graph 5 Ranges and 4 Ranges, Marker
panel_82 = Panel("Hourly Heat Map")

grid_mode_5 = Slider(2, range=0..3)
grid_mode_6 = Slider(0, range=0..3)
run_5 = Button()
run_6 = Button()
python_3_script_30 = Python3Script(
    result_hourly=python_3_script_26.illuminance,
    graph_title=panel_82,
    range1=Slider(300, range=-1..300),
    range2=Slider(1000, range=0..1000),
    range3=Slider(10000, range=0..10000),
    range4=Slider(30000, range=0..100000),
    name_range1="Failing",
    name_range2="Low",
    name_range3="Supplemental",
    name_range4="Acceptable",
    name_range5="Excessive",
    run=run_5,
    grid_mode=grid_mode_6,
    grid_color=ColourSwatch(SwatchColor=RGB(207, 207, 207)))  # -> out, form; inputs result_hourly: list
# ---------- python_3_script_30: Python ----------
import System.Windows.Forms as WinForms
import System.Drawing as Drawing
from System.Drawing import Point, Color
from System.Drawing.Drawing2D import SmoothingMode, PixelOffsetMode

# Inputs
if not _run:
    ghenv.Component.Message = "Waiting for _run trigger"
else:
    try:
        flat_data = [float(x) for x in _result_hourly if x is not None]
        if len(flat_data) != 8760:
            raise ValueError("Expected 8760 values.")
    except:
        WinForms.MessageBox.Show("PAR_8760 must contain exactly 8760 float values.", "Error")
        raise

    thresholds = [
        float(_range1) if _range1 is not None else 0,
        float(_range2) if _range2 is not None else 10,
        float(_range3) if _range3 is not None else 20,
        float(_range4) if _range4 is not None else 50
    ]

    # Ascending thresholds
    if not (thresholds[0] <= thresholds[1] <= thresholds[2] <= thresholds[3]):
        WinForms.MessageBox.Show("Ranges must be ascending (r1 ≤ r2 ≤ r3 ≤ r4).", "Invalid Ranges")
        raise ValueError("Non-ascending thresholds")

    # Color Setup
    def to_color(val):
        if val is None:
            return Color.LightGray
        if isinstance(val, Color):
            return val
        if isinstance(val, (tuple, list)) and len(val) == 3:
            return Color.FromArgb(int(val[0]), int(val[1]), int(val[2]))
        if isinstance(val, str):
            s = val.strip()
            if ',' in s or ' ' in s:
                s = s.replace('(', '').replace(')', '')
                parts = [p for p in s.replace(',', ' ').split(' ') if p]
                if len(parts) == 3:
                    r, g, b = [int(float(p)) for p in parts]
                    return Color.FromArgb(r, g, b)
            s = s.lstrip('#')
            if len(s) == 6:
                r = int(s[0:2], 16); g = int(s[2:4], 16); b = int(s[4:6], 16)
                return Color.FromArgb(r, g, b)
        raise ValueError("Unsupported color format: use '#rrggbb', (r,g,b), 'r,g,b', or a GH Color.")

    def hex_to_color(hex_str):
        s = hex_str.lstrip('#')
        return Drawing.Color.FromArgb(int(s[0:2], 16), int(s[2:4], 16), int(s[4:6], 16))

    # Grid / inset mode
    mode = int(round(float(_grid_mode))) if _grid_mode is not None else 0
    mode = max(0, min(3, mode))  # clamp to 0..3

    INSET = 0.5
    inset_px     = INSET if mode == 1 else 0.0
    grid_enabled = (mode in (2, 3))
    grid_color   = to_color("#636363") if mode == 3 else \
                   (to_color(_grid_color) if _grid_color else Drawing.Color.LightGray)

    # Bucket 0 color
    first_color = hex_to_color("#808080") if mode == 3 else hex_to_color("#ffffff")

    colors = [
        first_color,                 # imperceptible
        hex_to_color("#f9ebab"),     # perceptible
        hex_to_color("#f0be39"),     # disturbing
        hex_to_color("#e46828"),     # intolerable
        hex_to_color("#d70e17")      # excessive
    ]

    # Classification
    def classify(value):
        if value <= thresholds[0]: return 0
        elif value <= thresholds[1]: return 1
        elif value <= thresholds[2]: return 2
        elif value <= thresholds[3]: return 3
        else: return 4

    # Custom range names
    def _safe_name(val, default):
        return val if (val is not None and str(val).strip() != "") else default

    n1 = _safe_name(globals().get("_name_range1"), "Imperceptible")
    n2 = _safe_name(globals().get("_name_range2"), "Perceptible")
    n3 = _safe_name(globals().get("_name_range3"), "Disturbing")
    n4 = _safe_name(globals().get("_name_range4"), "Intolerable")
    n5 = _safe_name(globals().get("_name_range5"), "Excessive")
    range_names = [n1, n2, n3, n4, n5]


    # Heatmap Form Class
    class PARHeatmapForm(WinForms.Form):
        def __init__(self, data):
            super(PARHeatmapForm, self).__init__()
            self.Text = "Hourly Heat Map"
            self.StartPosition = WinForms.FormStartPosition.CenterScreen
            self.FormBorderStyle = WinForms.FormBorderStyle.Sizable
            self.DoubleBuffered = True
            self.BackColor = Drawing.Color.Gray if mode == 3 else Drawing.Color.White


            self.mode = mode
            self.inset_px = inset_px
            self.grid_enabled = grid_enabled
            self.grid_color = grid_color
            self.colors = colors
            self.range_names = range_names

            self.cell_w = 4
            self.cell_h = 20
            self.cols = 365
            self.rows = 24
            self.title_height = 25
            self.margin_top = 40
            self.margin_right = 130
            self.margin_left = 30
            self.margin_bottom = 200
            self.data = data

            self.ClientSize = Drawing.Size(
                self.margin_left + self.cols * self.cell_w + self.margin_right,
                self.rows * self.cell_h + self.margin_bottom + self.margin_top
            )

            self.Paint += self.on_paint
            self.MouseMove += self.on_mouse_move

            self.save_btn = WinForms.Button()
            self.save_btn.Text = "Export PNG"
            self.save_btn.Height = 30
            self.save_btn.Dock = WinForms.DockStyle.Bottom
            self.save_btn.Margin = WinForms.Padding(0, 10, 0, 10)
            self.save_btn.Click += self.on_export_click
            self.Controls.Add(self.save_btn)

            self.hover_label = WinForms.Label()
            self.hover_label.AutoSize = True
            self.hover_label.Location = Point(120, self.rows * self.cell_h + self.margin_top + 70)
            self.Controls.Add(self.hover_label)

        def on_paint(self, sender, e):
            g = e.Graphics
            g.SmoothingMode = SmoothingMode.Default
            g.PixelOffsetMode = PixelOffsetMode.HighSpeed

            # Shift title
            g.TranslateTransform(self.margin_left, self.margin_top + self.title_height)

            # GDI objects
            bucket_brushes = [Drawing.SolidBrush(c) for c in self.colors]
            grid_pen = Drawing.Pen(self.grid_color) if self.grid_enabled else None

            # Heatmap cells
            inset = float(self.inset_px)
            for i in range(self.rows):
                for j in range(self.cols):
                    idx = j * 24 + i
                    value = self.data[idx]
                    cat = classify(value)
                    brush = bucket_brushes[cat]

                    x = j * self.cell_w
                    y = i * self.cell_h

                    # symmetric inset
                    ix = x + inset
                    iy = y + inset
                    w  = self.cell_w  - 2 * inset
                    h  = self.cell_h  - 2 * inset

                    g.FillRectangle(brush, ix, iy, w, h)

                    if self.grid_enabled:
                        g.DrawRectangle(grid_pen, x, y, self.cell_w, self.cell_h)

            # Month dividers and labels
            month_starts = [0, 31, 59, 90, 120, 151, 181, 212, 243, 273, 304, 334]
            month_names = ["Jan", "Feb", "Mar", "Apr", "May", "Jun",
                           "Jul", "Aug", "Sep", "Oct", "Nov", "Dec"]

            if self.mode == 2:
                month_pen = Drawing.Pens.Gray
            elif self.mode == 3:
                month_pen = Drawing.Pens.Black
            else:
                month_pen = Drawing.Pens.LightGray

            for idx, day in enumerate(month_starts):
                x = day * self.cell_w
                g.DrawLine(month_pen, x, 0, x, self.rows * self.cell_h)
                g.DrawString(month_names[idx], self.Font, Drawing.Brushes.Black,
                             x + 50, self.rows * self.cell_h + 5)

            # Hour labels
            for i in [0, 6, 12, 18, 24]:
                if i <= 24:
                    label = str(i).zfill(2) + ":00"
                    y = i * self.cell_h - 20
                    g.DrawString(label, self.Font, Drawing.Brushes.Black,
                                 self.cols * self.cell_w + 5, y)


            # Legend (counts + labels)
            legend_counts = [0] * 5
            for val in self.data:
                legend_counts[classify(val)] += 1

            total = float(len(self.data))
            percentages = [int(round(c / total * 100)) for c in legend_counts]

            legend_labels = [
                "{}% {}".format(percentages[0], self.range_names[0]),
                "{}% {}".format(percentages[1], self.range_names[1]),
                "{}% {}".format(percentages[2], self.range_names[2]),
                "{}% {}".format(percentages[3], self.range_names[3]),
                "{}% {}".format(percentages[4], self.range_names[4])
            ]

            legend_spacing = 55
            legend_elements = []
            total_width = 0
            for i in range(5):
                label = legend_labels[i]
                label_size = g.MeasureString(label, self.Font)
                element_width = 20 + 5 + int(label_size.Width) + legend_spacing
                legend_elements.append((label, element_width))
                total_width += element_width

            legend_x = (self.cols * self.cell_w - total_width) // 2
            legend_y = self.rows * self.cell_h + self.margin_top + 45

            for i, (label, element_width) in enumerate(legend_elements):
                g.FillRectangle(bucket_brushes[i], legend_x, legend_y, 20, 15)
                g.DrawString(label, self.Font, Drawing.Brushes.Black, legend_x + 25, legend_y)
                legend_x += element_width

            # Reset transform
            g.ResetTransform()

            # Title
            title_font = Drawing.Font(self.Font.FontFamily, 10) # Drawing.FontStyle.Bold
            title = _graph_title or ""
            sz = g.MeasureString(title, title_font)
            g.DrawString(_graph_title, title_font, Drawing.Brushes.Black,
                        self.margin_left + (self.cols * self.cell_w - sz.Width) / 2.0, 10)

            # X-Axis Label
            g.DrawString("Day of Year", self.Font, Drawing.Brushes.Black,
                        self.margin_left + self.cols * self.cell_w // 2 - 30,
                        self.rows * self.cell_h + self.margin_top + 70)

            # Y-Axis Label
            g.TranslateTransform(self.cols * self.cell_w + 90,
                                 self.margin_top + self.rows * self.cell_h // 2 + 30)
            g.RotateTransform(-90)
            g.DrawString("Time of Day", self.Font, Drawing.Brushes.Black, -60, 30)
            g.ResetTransform()

            # Dispose GDI objects
            if grid_pen: grid_pen.Dispose()
            for b in bucket_brushes: b.Dispose()

        def on_mouse_move(self, sender, e):
            x, y = e.X, e.Y
            col = (x - self.margin_left) // self.cell_w
            row = (y - self.margin_top - self.title_height) // self.cell_h
            if 0 <= col < 365 and 0 <= row < 24:
                index = col * 24 + row
                val = round(self.data[index], 2)
                self.hover_label.Text = f"Day {col+1}, Hour {row}: {val}"

        def on_export_click(self, sender, args):
            dialog = WinForms.SaveFileDialog()
            dialog.Filter = "PNG Image|*.png"
            dialog.FileName = _graph_title
            if dialog.ShowDialog() == WinForms.DialogResult.OK:
                try:
                    bmp = Drawing.Bitmap(self.ClientSize.Width, self.ClientSize.Height)
                    g = Drawing.Graphics.FromImage(bmp)
                    g.Clear(self.BackColor)
                    paint_args = WinForms.PaintEventArgs(g, self.ClientRectangle)
                    self.on_paint(self, paint_args)
                    bmp.Save(dialog.FileName)
                    WinForms.MessageBox.Show("Saved successfully to:\n" + dialog.FileName)
                except Exception as e:
                    WinForms.MessageBox.Show("Export failed:\n" + str(e), "Error")

    # Show Form
    form = PARHeatmapForm(flat_data)
    form.Show()
# ---------- end python_3_script_30 ----------
python_3_script_31 = Python3Script(
    result_daily=python_3_script_25.DLI,
    graph_title="Daily Heat Map",
    range1=Slider(6, range=0..100),
    range2=Slider(12, range=0..100),
    range3=Slider(18, range=0..100),
    range4=Slider(30, range=0..100),
    name_range1="Failing",
    name_range2="Low",
    name_range3="Supplemental",
    name_range4="Acceptable",
    name_range5="Excessive",
    run=run_6,
    grid_mode=grid_mode_5,
    grid_color=ColourSwatch(SwatchColor=RGB(207, 207, 207)))  # -> out, form; inputs result_daily: list
# ---------- python_3_script_31: Python ----------
import System.Windows.Forms as WinForms
import System.Drawing as Drawing
from System.Drawing import Point, Color
from System.Drawing.Drawing2D import SmoothingMode, PixelOffsetMode

# Color Setup
def to_color(val):
    if val is None:
        return Color.LightGray
    if isinstance(val, Color):
        return val
    if isinstance(val, (tuple, list)) and len(val) == 3:
        return Color.FromArgb(int(val[0]), int(val[1]), int(val[2]))
    if isinstance(val, str):
        s = val.strip()
        if ',' in s or ' ' in s:
            s = s.replace('(', '').replace(')', '')
            parts = [p for p in s.replace(',', ' ').split(' ') if p]
            if len(parts) == 3:
                r, g, b = [int(float(p)) for p in parts]
                return Color.FromArgb(r, g, b)
        s = s.lstrip('#')
        if len(s) == 6:
            r = int(s[0:2], 16); g = int(s[2:4], 16); b = int(s[4:6], 16)
            return Color.FromArgb(r, g, b)
    raise ValueError("Unsupported color: use '#rrggbb', (r,g,b), 'r,g,b', or a GH Color.")

def hex_to_color(hex_str):
    s = hex_str.lstrip('#')
    return Drawing.Color.FromArgb(int(s[0:2], 16), int(s[2:4], 16), int(s[4:6], 16))

def as_float_or_default(x, default):
    try:
        return float(x)
    except (TypeError, ValueError):
        return default

def _safe_name(val, default):
    return val if (val is not None and str(val).strip() != "") else default

# Main
if not _run:
    ghenv.Component.Message = "Waiting for _run trigger"
else:
    # Data
    try:
        flat_data = [float(x) for x in _result_daily if x is not None]
        if len(flat_data) != 365:
            raise ValueError("Expected 365 values.")
    except:
        WinForms.MessageBox.Show("DLI_365 must contain exactly 365 float values.", "Error")
        raise

    # Thresholds
    r1 = as_float_or_default(globals().get("_range1"), 0.0)
    r2 = as_float_or_default(globals().get("_range2", globals().get("_range-2")), 10.0)
    r3 = as_float_or_default(globals().get("_range3"), 20.0)
    r4 = as_float_or_default(globals().get("_range4"), 50.0)
    thresholds = [r1, r2, r3, r4]

    # Ascending guard
    if not (thresholds[0] <= thresholds[1] <= thresholds[2] <= thresholds[3]):
        WinForms.MessageBox.Show("Ranges must be ascending (r1 ≤ r2 ≤ r3 ≤ r4).", "Invalid Ranges")
        raise ValueError("Non-ascending thresholds")

    # Grid / inset mode
    mode = int(round(float(globals().get("_grid_mode", 0)))) if globals().get("_grid_mode") is not None else 0
    mode = max(0, min(3, mode))

    INSET = 0.5
    inset_px     = INSET if mode == 1 else 0.0
    grid_enabled = (mode in (2, 3))

    # Grid color
    _grid_col_in = globals().get("_grid_color", globals().get("grid_color"))
    grid_color = to_color("#636363") if mode == 3 else (to_color(_grid_col_in) if _grid_col_in else Drawing.Color.LightGray)

    # Colors
    first_color = hex_to_color("#808080") if mode == 3 else hex_to_color("#ffffff")
    colors = [
        first_color,
        hex_to_color("#f9ebab"),
        hex_to_color("#f0be39"),
        hex_to_color("#e46828"),
        hex_to_color("#d70e17")
    ]

    # Names
    n1 = _safe_name(globals().get("_name_range1"), "Imperceptible")
    n2 = _safe_name(globals().get("_name_range2"), "Perceptible")
    n3 = _safe_name(globals().get("_name_range3"), "Disturbing")
    n4 = _safe_name(globals().get("_name_range4"), "Intolerable")
    n5 = _safe_name(globals().get("_name_range5"), "Excessive")
    range_names = [n1, n2, n3, n4, n5]

    # Classification
    def classify(v):
        if v <= thresholds[0]: return 0
        elif v <= thresholds[1]: return 1
        elif v <= thresholds[2]: return 2
        elif v <= thresholds[3]: return 3
        else: return 4

    # UI Form
    class DLIHeatmapForm(WinForms.Form):
        def __init__(self, data):
            super(DLIHeatmapForm, self).__init__()
            self.Text = "Daily Plot Heat Map"
            self.StartPosition = WinForms.FormStartPosition.CenterScreen
            self.FormBorderStyle = WinForms.FormBorderStyle.Sizable
            self.DoubleBuffered = True
            self.BackColor = Drawing.Color.Gray if mode == 3 else Drawing.Color.White

            # Expose settings
            self.mode = mode
            self.inset_px = inset_px
            self.grid_enabled = grid_enabled
            self.grid_color = grid_color
            self.colors = colors
            self.range_names = range_names

            # Geometry
            self.cell_w = 4
            self.cell_h = 20 * 12
            self.cols = 365
            self.rows = 1
            self.title_height = 25
            self.margin_top = 40
            self.margin_right = 60
            self.margin_bottom = 200
            self.margin_left = 30

            self.data = data

            self.ClientSize = Drawing.Size(
                self.margin_left + self.cols * self.cell_w + self.margin_right,
                self.rows * self.cell_h + self.margin_bottom + self.margin_top
            )

            self.Paint += self.on_paint
            self.MouseMove += self.on_mouse_move

            self.save_btn = WinForms.Button()
            self.save_btn.Text = "Export PNG"
            self.save_btn.Height = 30
            self.save_btn.Dock = WinForms.DockStyle.Bottom
            self.save_btn.Margin = WinForms.Padding(0, 10, 0, 10)
            self.save_btn.Click += self.on_export_click
            self.Controls.Add(self.save_btn)

            self.hover_label = WinForms.Label()
            self.hover_label.AutoSize = True
            self.hover_label.Location = Point(120, self.rows * self.cell_h + self.margin_top + 70)
            self.Controls.Add(self.hover_label)

        def on_paint(self, sender, e):
            g = e.Graphics
            g.SmoothingMode = SmoothingMode.Default
            g.PixelOffsetMode = PixelOffsetMode.HighSpeed

            # Shift title
            g.TranslateTransform(self.margin_left, self.margin_top + self.title_height)

            # GDI objects
            bucket_brushes = [Drawing.SolidBrush(c) for c in self.colors]
            grid_pen = Drawing.Pen(self.grid_color) if self.grid_enabled else None

            # Draw cells
            inset = float(self.inset_px)
            i = 0
            for j in range(self.cols):
                idx = j
                value = self.data[idx]
                cat = classify(value)
                brush = bucket_brushes[cat]

                x = j * self.cell_w
                y = i * self.cell_h

                # symmetric inset
                ix = x + inset
                iy = y + inset
                w  = self.cell_w  - 2 * inset
                h  = self.cell_h  - 2 * inset

                g.FillRectangle(brush, ix, iy, w, h)

                if self.grid_enabled:
                    g.DrawRectangle(grid_pen, x, y, self.cell_w, self.cell_h)

            # Month dividers + labels
            month_starts = [0, 31, 59, 90, 120, 151, 181, 212, 243, 273, 304, 334]
            month_names = ["Jan", "Feb", "Mar", "Apr", "May", "Jun",
                           "Jul", "Aug", "Sep", "Oct", "Nov", "Dec"]

            if self.mode == 2:
                month_pen = Drawing.Pen(Drawing.Color.DimGray, 4.0)
            elif self.mode == 3:
                month_pen = Drawing.Pen(Drawing.Color.Gray, 4.0)
            elif self.mode == 1:
                month_pen = Drawing.Pen(Drawing.Color.White, 5.0)
            else:
                month_pen = Drawing.Pen(Drawing.Color.Black, 1.0)

            for idx, day in enumerate(month_starts):
                x = day * self.cell_w
                g.DrawLine(month_pen, x, 0, x, self.rows * self.cell_h)
                g.DrawString(month_names[idx], self.Font, Drawing.Brushes.Black,
                             x + 50, self.rows * self.cell_h + 5)

            # Legend
            legend_counts = [0] * 5
            for val in self.data:
                legend_counts[classify(val)] += 1

            total = float(len(self.data))
            percentages = [int(round(c / total * 100)) for c in legend_counts]

            legend_labels = [
                "{}% {}".format(percentages[0], self.range_names[0]),
                "{}% {}".format(percentages[1], self.range_names[1]),
                "{}% {}".format(percentages[2], self.range_names[2]),
                "{}% {}".format(percentages[3], self.range_names[3]),
                "{}% {}".format(percentages[4], self.range_names[4])
            ]

            legend_spacing = 55
            legend_elements = []
            total_width = 0
            for i5 in range(5):
                label = legend_labels[i5]
                label_size = g.MeasureString(label, self.Font)
                element_width = 20 + 5 + int(label_size.Width) + legend_spacing
                legend_elements.append((label, element_width))
                total_width += element_width

            legend_x = (self.cols * self.cell_w - total_width) // 2
            legend_y = self.rows * self.cell_h + self.margin_top + 45

            for i5, (label, element_width) in enumerate(legend_elements):
                g.FillRectangle(bucket_brushes[i5], legend_x, legend_y, 20, 15)
                g.DrawString(label, self.Font, Drawing.Brushes.Black, legend_x + 25, legend_y)
                legend_x += element_width

            # Reset transform
            g.ResetTransform()

            # Title
            title_font = Drawing.Font(self.Font.FontFamily, 11, Drawing.FontStyle.Regular)
            title = _graph_title or ""
            sz = g.MeasureString(title, title_font)
            g.DrawString(title, title_font, Drawing.Brushes.Black,
                         self.margin_left + (self.cols * self.cell_w - sz.Width) / 2.0, 10)

            # X-Axis Label
            g.DrawString("Day of Year", self.Font, Drawing.Brushes.Black,
                         self.margin_left + self.cols * self.cell_w // 2 - 30,
                         self.rows * self.cell_h + self.margin_top + 70)

            # Y-Axis Label
            g.TranslateTransform(self.margin_left + self.cols * self.cell_w + 90,
                                 self.margin_top + self.rows * self.cell_h // 2 + 30)
            g.RotateTransform(-90)
            g.DrawString("24 Hours", self.Font, Drawing.Brushes.Black, -35, -80)
            g.ResetTransform()

            # Dispose
            if grid_pen: grid_pen.Dispose()
            month_pen.Dispose()
            for b in bucket_brushes: b.Dispose()

        def on_mouse_move(self, sender, e):
            x, y = e.X, e.Y

            col = (x - self.margin_left) // self.cell_w
            row = (y - (self.margin_top + self.title_height)) // self.cell_h
            if 0 <= col < 365 and 0 <= row < 1:
                index = int(col)
                val = round(self.data[index], 2)
                self.hover_label.Text = f"Day {index+1}: {val}"

        def on_export_click(self, sender, args):
            dialog = WinForms.SaveFileDialog()
            dialog.Filter = "PNG Image|*.png"
            dialog.FileName = _graph_title
            if dialog.ShowDialog() == WinForms.DialogResult.OK:
                try:
                    bmp = Drawing.Bitmap(self.ClientSize.Width, self.ClientSize.Height)
                    g = Drawing.Graphics.FromImage(bmp)
                    g.Clear(self.BackColor)
                    paint_args = WinForms.PaintEventArgs(g, self.ClientRectangle)
                    self.on_paint(self, paint_args)
                    bmp.Save(dialog.FileName)
                    WinForms.MessageBox.Show("Saved successfully to:\n" + dialog.FileName)
                except Exception as e:
                    WinForms.MessageBox.Show("Export failed:\n" + str(e), "Error")

    # Show form
    form = DLIHeatmapForm(flat_data)
    form.Show()
# ---------- end python_3_script_31 ----------
grid_mode_7 = Slider(1, range=0..3)
point_3 = Point(<point referenced from the Rhino model>)
grid_mode_8 = Slider(3, range=0..3)
python_3_script_32 = Python3Script(P=point_3, D=Slider(4, range=0..10))  # -> out, hemi
# ---------- python_3_script_32: Python ----------
import Rhino.Geometry as rg
import scriptcontext as sc
import System

# input
def coerce_point(x):
    if isinstance(x, rg.Point3d): return x
    if hasattr(x, "Location"):    return x.Location
    if isinstance(x, System.Guid):
        obj = sc.doc.Objects.FindId(x)
        if obj and hasattr(obj, "Geometry") and isinstance(obj.Geometry, rg.Point):
            return obj.Geometry.Location
    return None

hemi = None

C = coerce_point(P)
if C and D and D > 0:
    tol = sc.doc.ModelAbsoluteTolerance
    r   = float(D) * 0.5

    # sphere
    s_brep = rg.Brep.CreateFromSphere(rg.Sphere(C, r))

    # cutting plane
    up = Up if (Up and Up.IsValid and Up.Length > 0) else rg.Vector3d.ZAxis
    up.Unitize()
    pl = rg.Plane(C, up)

    # finite plane
    side = D * 10.0
    psrf = rg.PlaneSurface(pl, rg.Interval(-side, side), rg.Interval(-side, side))
    pbrep = psrf.ToBrep()

    # split sphere with plane-brep
    parts = s_brep.Split(pbrep, tol)
    if parts and len(parts) >= 2:
        # the piece
        def score(b):
            c = b.GetBoundingBox(True).Center
            v = c - C
            return rg.Vector3d.Multiply(up, rg.Vector3d(v))
        hemi = max(parts, key=score)
# ---------- end python_3_script_32 ----------
run_7 = Button()
run_8 = Button()
# Hourly Heat Map
python_3_script_33 = Python3Script(
    result_hourly=python_3_script_26.illuminance,
    graph_title="Hourly Heat Map",
    range1=Slider(300, range=0..100000),
    range2=Slider(10000, range=0..100000),
    range3=Slider(30000, range=0..100000),
    name_range1="Failing",
    name_range2="Supplemental",
    name_range3="Acceptable",
    name_range4="Excessive",
    run=run_7,
    grid_mode=grid_mode_7,
    grid_color=ColourSwatch(SwatchColor=RGB(207, 207, 207)))  # -> out, form; inputs result_hourly: list
# ---------- python_3_script_33: Python ----------
import System.Windows.Forms as WinForms
import System.Drawing as Drawing
from System.Drawing import Point, Color
from System.Drawing.Drawing2D import SmoothingMode, PixelOffsetMode

# Inputs
if not _run:
    ghenv.Component.Message = "Waiting for _run trigger"
else:
    try:
        flat_data = [float(x) for x in _result_hourly if x is not None]
        if len(flat_data) != 8760:
            raise ValueError("Expected 8760 values.")
    except:
        WinForms.MessageBox.Show("PAR_8760 must contain exactly 8760 float values.", "Error")
        raise

    # Thresholds: 3 cutoffs -> 4 buckets
    thresholds = [
        float(_range1) if _range1 is not None else 0,
        float(_range2) if _range2 is not None else 10,
        float(_range3) if _range3 is not None else 20
    ]

    # Ascending thresholds guard
    if not (thresholds[0] <= thresholds[1] <= thresholds[2]):
        WinForms.MessageBox.Show("Ranges must be ascending (r1 ≤ r2 ≤ r3).", "Invalid Ranges")
        raise ValueError("Non-ascending thresholds")

    # Color Setup
    def to_color(val):
        if val is None:
            return Color.LightGray
        if isinstance(val, Color):
            return val
        if isinstance(val, (tuple, list)) and len(val) == 3:
            return Color.FromArgb(int(val[0]), int(val[1]), int(val[2]))
        if isinstance(val, str):
            s = val.strip()
            if ',' in s or ' ' in s:
                s = s.replace('(', '').replace(')', '')
                parts = [p for p in s.replace(',', ' ').split(' ') if p]
                if len(parts) == 3:
                    r, g, b = [int(float(p)) for p in parts]
                    return Color.FromArgb(r, g, b)
            s = s.lstrip('#')
            if len(s) == 6:
                r = int(s[0:2], 16); g = int(s[2:4], 16); b = int(s[4:6], 16)
                return Color.FromArgb(r, g, b)
        raise ValueError("Unsupported color format: use '#rrggbb', (r,g,b), 'r,g,b', or a GH Color.")

    def hex_to_color(hex_str):
        s = hex_str.lstrip('#')
        return Drawing.Color.FromArgb(int(s[0:2], 16), int(s[2:4], 16), int(s[4:6], 16))

    # Grid / inset mode (parsed once)
    mode = int(round(float(_grid_mode))) if _grid_mode is not None else 0
    mode = max(0, min(3, mode))

    INSET = 0.5
    inset_px     = INSET if mode == 1 else 0.0
    grid_enabled = (mode in (2, 3))
    grid_color   = to_color("#636363") if mode == 3 else \
                   (to_color(_grid_color) if _grid_color else Drawing.Color.LightGray)

    # Bucket 0 color varies in mode 3
    first_color = hex_to_color("#808080") if mode == 3 else hex_to_color("#ffffff")

    # 4-bucket color scheme
    colors = [
        first_color,                 # bucket 0 (<= r1)
        hex_to_color("#f9ebab"),     # bucket 1 (<= r2)
        hex_to_color("#f0be39"),     # bucket 2 (<= r3)
        hex_to_color("#e46828")      # bucket 3 (> r3)
    ]

    # Classification (4 buckets)
    def classify(value):
        if value <= thresholds[0]: return 0
        elif value <= thresholds[1]: return 1
        elif value <= thresholds[2]: return 2
        else: return 3

    # Custom range names (4)
    def _safe_name(val, default):
        return val if (val is not None and str(val).strip() != "") else default

    n1 = _safe_name(globals().get("_name_range1"), "Imperceptible")
    n2 = _safe_name(globals().get("_name_range2"), "Perceptible")
    n3 = _safe_name(globals().get("_name_range3"), "Disturbing")
    n4 = _safe_name(globals().get("_name_range4"), "Intolerable")
    range_names = [n1, n2, n3, n4]

    
    # Heatmap Form Class
    class PARHeatmapForm(WinForms.Form):
        def __init__(self, data):
            super(PARHeatmapForm, self).__init__()
            self.Text = "Hourly Heat Map (4 ranges)"
            self.StartPosition = WinForms.FormStartPosition.CenterScreen
            self.FormBorderStyle = WinForms.FormBorderStyle.Sizable
            self.DoubleBuffered = True
            self.BackColor = Drawing.Color.Gray if mode == 3 else Drawing.Color.White


            self.mode = mode
            self.inset_px = inset_px
            self.grid_enabled = grid_enabled
            self.grid_color = grid_color
            self.colors = colors
            self.range_names = range_names

            self.cell_w = 4
            self.cell_h = 20
            self.cols = 365
            self.rows = 24
            self.title_height = 25
            self.margin_top = 40
            self.margin_right = 130
            self.margin_left = 30
            self.margin_bottom = 200
            self.data = data

            self.ClientSize = Drawing.Size(
                self.margin_left + self.cols * self.cell_w + self.margin_right,
                self.rows * self.cell_h + self.margin_bottom + self.margin_top
            )

            self.Paint += self.on_paint
            self.MouseMove += self.on_mouse_move

            self.save_btn = WinForms.Button()
            self.save_btn.Text = "Export PNG"
            self.save_btn.Height = 30
            self.save_btn.Dock = WinForms.DockStyle.Bottom
            self.save_btn.Margin = WinForms.Padding(0, 10, 0, 10)
            self.save_btn.Click += self.on_export_click
            self.Controls.Add(self.save_btn)

            self.hover_label = WinForms.Label()
            self.hover_label.AutoSize = True
            self.hover_label.Location = Point(120, self.rows * self.cell_h + self.margin_top + 70)
            self.Controls.Add(self.hover_label)

        def on_paint(self, sender, e):
            g = e.Graphics
            g.SmoothingMode = SmoothingMode.Default
            g.PixelOffsetMode = PixelOffsetMode.HighSpeed

            # Shift below title
            g.TranslateTransform(self.margin_left, self.margin_top + self.title_height)

            # Prepare GDI objects
            bucket_brushes = [Drawing.SolidBrush(c) for c in self.colors]
            grid_pen = Drawing.Pen(self.grid_color) if self.grid_enabled else None

            # Draw heatmap cells
            inset = float(self.inset_px)
            for i in range(self.rows):
                for j in range(self.cols):
                    idx = j * 24 + i
                    value = self.data[idx]
                    cat = classify(value)
                    brush = bucket_brushes[cat]

                    x = j * self.cell_w
                    y = i * self.cell_h

                    # symmetric inset on all sides
                    ix = x + inset
                    iy = y + inset
                    w  = self.cell_w  - 2 * inset
                    h  = self.cell_h  - 2 * inset

                    g.FillRectangle(brush, ix, iy, w, h)

                    if self.grid_enabled:
                        g.DrawRectangle(grid_pen, x, y, self.cell_w, self.cell_h)

            # Month dividers and labels
            month_starts = [0, 31, 59, 90, 120, 151, 181, 212, 243, 273, 304, 334]
            month_names = ["Jan", "Feb", "Mar", "Apr", "May", "Jun",
                           "Jul", "Aug", "Sep", "Oct", "Nov", "Dec"]

            if self.mode == 2:
                month_pen = Drawing.Pens.Gray
            elif self.mode == 3:
                month_pen = Drawing.Pens.Black
            else:
                month_pen = Drawing.Pens.LightGray

            for idx, day in enumerate(month_starts):
                x = day * self.cell_w
                g.DrawLine(month_pen, x, 0, x, self.rows * self.cell_h)
                g.DrawString(month_names[idx], self.Font, Drawing.Brushes.Black,
                             x + 50, self.rows * self.cell_h + 5)

            # Hour labels
            for i in [0, 6, 12, 18, 24]:
                if i <= 24:
                    label = str(i).zfill(2) + ":00"
                    y = i * self.cell_h - 20
                    g.DrawString(label, self.Font, Drawing.Brushes.Black,
                                 self.cols * self.cell_w + 5, y)

            # Legend (4 buckets)
            legend_counts = [0] * 4
            for val in self.data:
                legend_counts[classify(val)] += 1

            total = float(len(self.data))
            percentages = [int(round(c / total * 100)) for c in legend_counts]

            legend_labels = [
                "{}% {}".format(percentages[0], self.range_names[0]),
                "{}% {}".format(percentages[1], self.range_names[1]),
                "{}% {}".format(percentages[2], self.range_names[2]),
                "{}% {}".format(percentages[3], self.range_names[3])
            ]

            legend_spacing = 55
            legend_elements = []
            total_width = 0
            for i in range(4):
                label = legend_labels[i]
                label_size = g.MeasureString(label, self.Font)
                element_width = 20 + 5 + int(label_size.Width) + legend_spacing
                legend_elements.append((label, element_width))
                total_width += element_width

            legend_x = (self.cols * self.cell_w - total_width) // 2
            legend_y = self.rows * self.cell_h + self.margin_top + 45

            for i, (label, element_width) in enumerate(legend_elements):
                g.FillRectangle(bucket_brushes[i], legend_x, legend_y, 20, 15)
                g.DrawString(label, self.Font, Drawing.Brushes.Black, legend_x + 25, legend_y)
                legend_x += element_width

            # Reset transform for title and axes
            g.ResetTransform()

            # Title
            title_font = Drawing.Font(self.Font.FontFamily, 10)
            title = _graph_title or ""
            sz = g.MeasureString(title, title_font)
            g.DrawString(title, title_font, Drawing.Brushes.Black,
                         self.margin_left + (self.cols * self.cell_w - sz.Width) / 2.0, 10)

            # X-Axis Label
            g.DrawString("Day of Year", self.Font, Drawing.Brushes.Black,
                         self.margin_left + self.cols * self.cell_w // 2 - 30,
                         self.rows * self.cell_h + self.margin_top + 70)

            # Y-Axis Label
            g.TranslateTransform(self.cols * self.cell_w + 90,
                                 self.margin_top + self.rows * self.cell_h // 2 + 30)
            g.RotateTransform(-90)
            g.DrawString("Time of Day", self.Font, Drawing.Brushes.Black, -60, 30)
            g.ResetTransform()

            # Dispose GDI objects
            if grid_pen: grid_pen.Dispose()
            for b in bucket_brushes: b.Dispose()

        def on_mouse_move(self, sender, e):
            x, y = e.X, e.Y
            col = (x - self.margin_left) // self.cell_w
            row = (y - self.margin_top - self.title_height) // self.cell_h
            if 0 <= col < 365 and 0 <= row < 24:
                index = col * 24 + row
                val = round(self.data[index], 2)
                self.hover_label.Text = f"Day {col+1}, Hour {row}: {val}"

        def on_export_click(self, sender, args):
            dialog = WinForms.SaveFileDialog()
            dialog.Filter = "PNG Image|*.png"
            dialog.FileName = _graph_title
            if dialog.ShowDialog() == WinForms.DialogResult.OK:
                try:
                    bmp = Drawing.Bitmap(self.ClientSize.Width, self.ClientSize.Height)
                    g = Drawing.Graphics.FromImage(bmp)
                    g.Clear(self.BackColor)
                    paint_args = WinForms.PaintEventArgs(g, self.ClientRectangle)
                    self.on_paint(self, paint_args)
                    bmp.Save(dialog.FileName)
                    WinForms.MessageBox.Show("Saved successfully to:\n" + dialog.FileName)
                except Exception as e:
                    WinForms.MessageBox.Show("Export failed:\n" + str(e), "Error")

    # Show Form
    form = PARHeatmapForm(flat_data)
    form.Show()
# ---------- end python_3_script_33 ----------
# Daily Heat Map
python_3_script_34 = Python3Script(
    result_daily=python_3_script_25.DLI,
    graph_title="Daily Heat Map",
    range1=Slider(6, range=0..100),
    range2=Slider(18, range=0..100),
    range3=Slider(30, range=0..100),
    name_range1="Failing",
    name_range2="Supplemental",
    name_range3="Acceptable",
    name_range4="Excessive",
    run=run_8,
    grid_mode=grid_mode_8,
    grid_color=ColourSwatch(SwatchColor=RGB(207, 207, 207)))  # -> out, form; inputs result_daily: list
# ---------- python_3_script_34: Python ----------
import System.Windows.Forms as WinForms
import System.Drawing as Drawing
from System.Drawing import Point, Color
from System.Drawing.Drawing2D import SmoothingMode, PixelOffsetMode

# Color Setup
def to_color(val):
    if val is None:
        return Color.LightGray
    if isinstance(val, Color):
        return val
    if isinstance(val, (tuple, list)) and len(val) == 3:
        return Color.FromArgb(int(val[0]), int(val[1]), int(val[2]))
    if isinstance(val, str):
        s = val.strip()
        if ',' in s or ' ' in s:
            s = s.replace('(', '').replace(')', '')
            parts = [p for p in s.replace(',', ' ').split(' ') if p]
            if len(parts) == 3:
                r, g, b = [int(float(p)) for p in parts]
                return Color.FromArgb(r, g, b)
        s = s.lstrip('#')
        if len(s) == 6:
            r = int(s[0:2], 16); g = int(s[2:4], 16); b = int(s[4:6], 16)
            return Color.FromArgb(r, g, b)
    raise ValueError("Unsupported color: use '#rrggbb', (r,g,b), 'r,g,b', or a GH Color.")

def hex_to_color(hex_str):
    s = hex_str.lstrip('#')
    return Drawing.Color.FromArgb(int(s[0:2], 16), int(s[2:4], 16), int(s[4:6], 16))

def as_float_or_default(x, default):
    try:
        return float(x)
    except (TypeError, ValueError):
        return default

def _safe_name(val, default):
    return val if (val is not None and str(val).strip() != "") else default

# Main
if not _run:
    ghenv.Component.Message = "Waiting for _run trigger"
else:
    # Data
    try:
        flat_data = [float(x) for x in _result_daily if x is not None]
        if len(flat_data) != 365:
            raise ValueError("Expected 365 values.")
    except:
        WinForms.MessageBox.Show("DLI_365 must contain exactly 365 float values.", "Error")
        raise

    # Thresholds: 3 cutoffs 4 buckets
    r1 = as_float_or_default(globals().get("_range1"), 0.0)
    r2 = as_float_or_default(globals().get("_range2"), 10.0)
    r3 = as_float_or_default(globals().get("_range3"), 20.0)
    thresholds = [r1, r2, r3]

    # Ascending guard
    if not (thresholds[0] <= thresholds[1] <= thresholds[2]):
        WinForms.MessageBox.Show("Ranges must be ascending (r1 ≤ r2 ≤ r3).", "Invalid Ranges")
        raise ValueError("Non-ascending thresholds")

    # Grid / inset mode
    mode = int(round(float(globals().get("_grid_mode", 0)))) if globals().get("_grid_mode") is not None else 0
    mode = max(0, min(3, mode))

    INSET = 0.5
    inset_px     = INSET if mode == 1 else 0.0
    grid_enabled = (mode in (2, 3))

    # Grid color
    _grid_col_in = globals().get("_grid_color")
    grid_color = to_color("#636363") if mode == 3 else (to_color(_grid_col_in) if _grid_col_in else Drawing.Color.LightGray)

    # Colors (4 buckets)
    first_color = hex_to_color("#808080") if mode == 3 else hex_to_color("#ffffff")
    colors = [
        first_color,                 # bucket 0 (<= r1)
        hex_to_color("#f9ebab"),     # bucket 1 (<= r2)
        hex_to_color("#f0be39"),     # bucket 2 (<= r3)
        hex_to_color("#e46828")      # bucket 3 (> r3)
    ]

    # Names (4)
    n1 = _safe_name(globals().get("_name_range1"), "Imperceptible")
    n2 = _safe_name(globals().get("_name_range2"), "Perceptible")
    n3 = _safe_name(globals().get("_name_range3"), "Disturbing")
    n4 = _safe_name(globals().get("_name_range4"), "Intolerable")
    range_names = [n1, n2, n3, n4]

    # Classification to 4 buckets
    def classify(v):
        if v <= thresholds[0]: return 0
        elif v <= thresholds[1]: return 1
        elif v <= thresholds[2]: return 2
        else: return 3

    # UI Form
    class DLIHeatmapForm(WinForms.Form):
        def __init__(self, data):
            super(DLIHeatmapForm, self).__init__()
            self.Text = "Daily Plot Heat Map (4 ranges)"
            self.StartPosition = WinForms.FormStartPosition.CenterScreen
            self.FormBorderStyle = WinForms.FormBorderStyle.Sizable
            self.DoubleBuffered = True
            self.BackColor = Drawing.Color.Gray if mode == 3 else Drawing.Color.White

            # Expose settings
            self.mode = mode
            self.inset_px = inset_px
            self.grid_enabled = grid_enabled
            self.grid_color = grid_color
            self.colors = colors
            self.range_names = range_names

            # Geometry: 1 row
            self.cell_w = 4
            self.cell_h = 20 * 12
            self.cols = 365
            self.rows = 1
            self.title_height = 25
            self.margin_top = 40
            self.margin_right = 60
            self.margin_bottom = 200
            self.margin_left = 30

            self.data = data

            self.ClientSize = Drawing.Size(
                self.margin_left + self.cols * self.cell_w + self.margin_right,
                self.rows * self.cell_h + self.margin_bottom + self.margin_top
            )

            self.Paint += self.on_paint
            self.MouseMove += self.on_mouse_move

            self.save_btn = WinForms.Button()
            self.save_btn.Text = "Export PNG"
            self.save_btn.Height = 30
            self.save_btn.Dock = WinForms.DockStyle.Bottom
            self.save_btn.Margin = WinForms.Padding(0, 10, 0, 10)
            self.save_btn.Click += self.on_export_click
            self.Controls.Add(self.save_btn)

            self.hover_label = WinForms.Label()
            self.hover_label.AutoSize = True
            self.hover_label.Location = Point(120, self.rows * self.cell_h + self.margin_top + 70)
            self.Controls.Add(self.hover_label)

        def on_paint(self, sender, e):
            g = e.Graphics
            g.SmoothingMode = SmoothingMode.Default
            g.PixelOffsetMode = PixelOffsetMode.HighSpeed

            # Shift title + left margin
            g.TranslateTransform(self.margin_left, self.margin_top + self.title_height)

            # Prepare GDI objects
            bucket_brushes = [Drawing.SolidBrush(c) for c in self.colors]
            grid_pen = Drawing.Pen(self.grid_color) if self.grid_enabled else None

            # Draw cells: 1 row × 365 cols
            inset = float(self.inset_px)
            i = 0
            for j in range(self.cols):
                idx = j
                value = self.data[idx]
                cat = classify(value)
                brush = bucket_brushes[cat]

                x = j * self.cell_w
                y = i * self.cell_h

                ix = x + inset
                iy = y + inset
                w  = self.cell_w  - 2 * inset
                h  = self.cell_h  - 2 * inset

                g.FillRectangle(brush, ix, iy, w, h)
                if self.grid_enabled:
                    g.DrawRectangle(grid_pen, x, y, self.cell_w, self.cell_h)

            # Month dividers + labels
            month_starts = [0, 31, 59, 90, 120, 151, 181, 212, 243, 273, 304, 334]
            month_names  = ["Jan", "Feb", "Mar", "Apr", "May", "Jun",
                            "Jul", "Aug", "Sep", "Oct", "Nov", "Dec"]

            if self.mode == 2:
                month_pen = Drawing.Pen(Drawing.Color.DimGray, 4.0)
            elif self.mode == 3:
                month_pen = Drawing.Pen(Drawing.Color.Gray, 4.0)
            elif self.mode == 1:
                month_pen = Drawing.Pen(Drawing.Color.White, 5.0)
            else:
                month_pen = Drawing.Pen(Drawing.Color.Black, 1.0)

            for idx, day in enumerate(month_starts):
                x = day * self.cell_w
                g.DrawLine(month_pen, x, 0, x, self.rows * self.cell_h)
                g.DrawString(month_names[idx], self.Font, Drawing.Brushes.Black,
                             x + 50, self.rows * self.cell_h + 5)

            # Legend (4 buckets)
            legend_counts = [0] * 4
            for val in self.data:
                legend_counts[classify(val)] += 1

            total = float(len(self.data))
            percentages = [int(round(c / total * 100)) for c in legend_counts]

            legend_labels = [
                "{}% {}".format(percentages[0], self.range_names[0]),
                "{}% {}".format(percentages[1], self.range_names[1]),
                "{}% {}".format(percentages[2], self.range_names[2]),
                "{}% {}".format(percentages[3], self.range_names[3]),
            ]

            legend_spacing = 55
            legend_elements = []
            total_width = 0
            for i4 in range(4):
                label = legend_labels[i4]
                label_size = g.MeasureString(label, self.Font)
                element_width = 20 + 5 + int(label_size.Width) + legend_spacing
                legend_elements.append((label, element_width))
                total_width += element_width

            legend_x = (self.cols * self.cell_w - total_width) // 2
            legend_y = self.rows * self.cell_h + self.margin_top + 45

            for i4, (label, element_width) in enumerate(legend_elements):
                g.FillRectangle(bucket_brushes[i4], legend_x, legend_y, 20, 15)
                g.DrawString(label, self.Font, Drawing.Brushes.Black, legend_x + 25, legend_y)
                legend_x += element_width

            # Reset for title
            g.ResetTransform()

            # Title
            title_font = Drawing.Font(self.Font.FontFamily, 11, Drawing.FontStyle.Regular)
            title = _graph_title or ""
            sz = g.MeasureString(title, title_font)
            g.DrawString(title, title_font, Drawing.Brushes.Black,
                         self.margin_left + (self.cols * self.cell_w - sz.Width) / 2.0, 10)

            # X-Axis Label
            g.DrawString("Day of Year", self.Font, Drawing.Brushes.Black,
                         self.margin_left + self.cols * self.cell_w // 2 - 30,
                         self.rows * self.cell_h + self.margin_top + 70)

            # Right-side label
            g.TranslateTransform(self.margin_left + self.cols * self.cell_w + 90,
                                 self.margin_top + self.rows * self.cell_h // 2 + 30)
            g.RotateTransform(-90)
            g.DrawString("24 Hour", self.Font, Drawing.Brushes.Black, -35, -80)
            g.ResetTransform()

            # Dispose
            if grid_pen: grid_pen.Dispose()
            month_pen.Dispose()
            for b in bucket_brushes: b.Dispose()

        def on_mouse_move(self, sender, e):
            x, y = e.X, e.Y
            col = (x - self.margin_left) // self.cell_w
            row = (y - (self.margin_top + self.title_height)) // self.cell_h
            if 0 <= col < 365 and 0 <= row < 1:
                index = int(col)
                val = round(self.data[index], 2)
                self.hover_label.Text = f"Day {index+1}: {val}"

        def on_export_click(self, sender, args):
            dialog = WinForms.SaveFileDialog()
            dialog.Filter = "PNG Image|*.png"
            dialog.FileName = _graph_title
            if dialog.ShowDialog() == WinForms.DialogResult.OK:
                try:
                    bmp = Drawing.Bitmap(self.ClientSize.Width, self.ClientSize.Height)
                    g = Drawing.Graphics.FromImage(bmp)
                    g.Clear(self.BackColor)
                    paint_args = WinForms.PaintEventArgs(g, self.ClientRectangle)
                    self.on_paint(self, paint_args)
                    bmp.Save(dialog.FileName)
                    WinForms.MessageBox.Show("Saved successfully to:\n" + dialog.FileName)
                except Exception as e:
                    WinForms.MessageBox.Show("Export failed:\n" + str(e), "Error")

    # Show form
    form = DLIHeatmapForm(flat_data)
    form.Show()
# ---------- end python_3_script_34 ----------
# Marker
custom_preview_6 = CustomPreview(Geometry=python_3_script_32.hemi, Material=ColourSwatch(SwatchColor=RGBA(31, 31, 31, 92)))
custom_preview_7 = CustomPreview(Geometry=python_3_script_32.hemi, Material=ColourSwatch(SwatchColor=RGB(255, 255, 255)))

# ----
# Grasshopper Workflow
# PAR
# PAR calculation with grasshopper component
# DLI
# DLI calculation with grasshopper component
number_slider_14 = Slider(9, range=1..12)
number_slider_15 = Slider(21, range=1..31)
hour_of_year = HourOfYear(Month=Slider(1, range=1..12), Day=Slider(1, range=1..31), Hour=Slider(9, range=1..24))
analysisperiod = LBAnalysisPeriod(
    start_month=number_slider_14,
    start_day=number_slider_15,
    start_hour=Slider(0, range=0..24),
    end_month=number_slider_14,
    end_day=number_slider_15,
    end_hour=Slider(23, range=1..24))  # -> period, hoys, dates; plug-in component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
list_item = ListItem(List=xdata.values, Index=hour_of_year, Wrap=True)  # disabled
panel_83 = Panel(hour_of_year)
list_item_2 = ListItem(List=xdata.values, Index=analysisperiod.hoys, Wrap=True)  # disabled
data = Data(flatten(list_item))  # disabled
multiplication = Multiplication(A=data, B=Slider(0.0185, range=0..0.1))
mass_addition = MassAddition(Input=list_item_2)  # -> Result, PartialResults; disabled
heatmap_11 = LBSpatialHeatmap(values=multiplication)  # -> out, mesh, legend, title, colors, legend_par, vis_set; disabled; plug-in component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
multiplication_2 = Multiplication(A=mass_addition.Result, B=Slider(0.0185, range=0..0.1))
multiplication_3 = Multiplication(A=multiplication_2, B=Slider(0.0036, range=0..0.01))
data_2 = Data(flatten(multiplication_3))
heatmap_12 = LBSpatialHeatmap(values=data_2)  # -> mesh, legend, title, colors, legend_par, vis_set; disabled; plug-in component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
panel_84 = Panel(data_2)

panel_85 = Panel(list_item_2)
multiplication_4 = Multiplication(A=multiplication, B=Slider(0.0036, range=0..0.1))

panel_86 = Panel(multiplication_4)

panel_87 = Panel(mass_addition.Result)

# ==== cluster Cluster
number_slider = Slider(45, range=0..100)  # disabled
number_slider_2 = Slider(30, range=0..100)  # disabled
number_slider_3 = Slider(15, range=0..100)  # disabled
number_slider_4 = Slider(45, range=0..100)  # disabled
number_slider_5 = Slider(30, range=0..100)  # disabled
number_slider_6 = Slider(15, range=0..100)  # disabled
boolean_toggle = BooleanToggle(True)  # disabled
python_3_script = Python3Script()  # -> out, a; disabled
python_3_script_2 = Python3Script()  # -> out, a; disabled
lighting_geometry = Python3Script(rotationX=number_slider_4, rotationY=number_slider_5, rotationZ=number_slider_6)  # -> out, lighting_geometry; inputs points: list of Point3d; disabled
# ---------- lighting_geometry: Python ----------
import Rhino

try:
    from Grasshopper.Kernel.Types import GH_Point, GH_Number
except:
    GH_Point = None
    GH_Number = None

def flatten_any(x):
    # Grasshopper DataTree
    try:
        bc = getattr(x, "BranchCount", None)
        if bc is not None:
            # BranchCount
            count = x.BranchCount if isinstance(bc, int) else x.BranchCount
            count = count if isinstance(count, int) else count()
            flat = []
            for i in range(count):
                br = x.Branch(i)
                flat.extend(list(br))
            return flat
    except:
        pass
    # Plain list/tuple
    try:
        _ = len(x)
        return list(x)
    except:
        # Single item
        return [x]

def coerce_point(obj):
    if obj is None:
        return None
    if isinstance(obj, Rhino.Geometry.Point3d):
        return obj
    if GH_Point and isinstance(obj, GH_Point):
        try:
            return obj.Value
        except:
            pass
    # Tuple
    try:
        return Rhino.Geometry.Point3d(float(obj[0]), float(obj[1]), float(obj[2]))
    except:
        pass
    # Object
    try:
        return Rhino.Geometry.Point3d(float(obj.X), float(obj.Y), float(obj.Z))
    except:
        return None

def coerce_float(obj):
    if obj is None:
        return None
    if isinstance(obj, (int, float)):
        return float(obj)
    if GH_Number and isinstance(obj, GH_Number):
        try:
            return float(obj.Value)
        except:
            pass
    try:
        return float(obj)
    except:
        return None

def ensure_float_list(x, n, default=0.0):
    raw = flatten_any(x)
    raw = [r for r in raw if r is not None]
    if len(raw) == 0:
        return [default]*n
    if len(raw) == 1:
        v = coerce_float(raw[0])
        v = default if v is None else v
        return [float(v)]*n
    if len(raw) != n:
        raise ValueError("Rotation list length {} must match number of points {}."
                         .format(len(raw), n))
    out = []
    for r in raw:
        v = coerce_float(r)
        if v is None: v = default
        out.append(float(v))
    return out

out = ""
_lighting_geometry = []

try:
    # Points
    raw_pts = flatten_any(_points)
    pts = []
    for item in raw_pts:
        p = coerce_point(item)
        if p is not None:
            pts.append(p)
    n = len(pts)

    if n == 0:
        out = ("No points detected.\n"
               "Tips:\n"
               " • Plug actual Point geometry (not empty branches).\n"
               " • Optionally set _points → Type hint: Point3d, Access: List.\n"
               " • If upstream is a tree, this component still flattens it.")
    else:
        # Rotations
        rx = ensure_float_list(_rotationX, n, 0.0)
        ry = ensure_float_list(_rotationY, n, 0.0)
        rz = ensure_float_list(_rotationZ, n, 0.0)


        for i, p in enumerate(pts):
            parts = []
            if abs(rx[i]) > 1e-12: parts.append("-rx {:.6f}".format(rx[i]))
            if abs(ry[i]) > 1e-12: parts.append("-ry {:.6f}".format(ry[i]))
            if abs(rz[i]) > 1e-12: parts.append("-rz {:.6f}".format(rz[i]))
            parts.append("-t {x:.6f} {y:.6f} {z:.6f}".format(x=p.X, y=p.Y, z=p.Z))
            _lighting_geometry.append(" ".join(parts))

        example = _lighting_geometry[0] if _lighting_geometry else "(none)"
        out = "OK: {} transform string(s). Example → {}".format(len(_lighting_geometry), example)

except Exception as e:
    out = "ERROR: {}".format(e)
# ---------- end lighting_geometry ----------
lighting_geometry_2 = Python3Script()  # -> out, lighting_geometry; inputs points: list of Point3d; disabled
# ---------- lighting_geometry_2: Python ----------
import math
import Rhino
from ghpythonlib import treehelpers

def flatten_any(x):
    """Return a flat Python list for GH Item/List/Tree."""
    # GH tree
    try:
        return list(treehelpers.flatten(x))
    except:
        # Python list/tuple
        try:
            _ = len(x)
            return list(x)
        except:
            # Single item
            return [x]

def ensure_point_list(x):
    pts = []
    for p in flatten_any(x):
        if isinstance(p, Rhino.Geometry.Point3d):
            pts.append(p)
        else:
            # try
            try:
                pts.append(Rhino.Geometry.Point3d(float(p.X), float(p.Y), float(p.Z)))
            except:
                try:
                    pts.append(Rhino.Geometry.Point3d(float(p[0]), float(p[1]), float(p[2])))
                except:
                    pass
    return pts

def ensure_float_list(x, n, default=0.0):
    vals = flatten_any(x)
    if len(vals) == 0:
        return [default]*n
    if len(vals) == 1:
        return [float(vals[0])]*n
    if len(vals) != n:
        raise ValueError("Rotation list length ({}) must match points ({})".format(len(vals), n))
    return [float(v) for v in vals]

out = ""
_lighting_geometry = []

try:
    pts = ensure_point_list(_points)
    n = len(pts)
    if n == 0:
        out = "No points provided (check type hint/access, or flatten the wire)."
    else:
        rx = ensure_float_list(_rotationX, n, 0.0)
        ry = ensure_float_list(_rotationY, n, 0.0)
        rz = ensure_float_list(_rotationZ, n, 0.0)

        for i, p in enumerate(pts):
            parts = []
            if abs(rx[i]) > 1e-12: parts.append("-rx {:.6f}".format(rx[i]))
            if abs(ry[i]) > 1e-12: parts.append("-ry {:.6f}".format(ry[i]))
            if abs(rz[i]) > 1e-12: parts.append("-rz {:.6f}".format(rz[i]))
            parts.append("-t {x:.6f} {y:.6f} {z:.6f}".format(x=p.X, y=p.Y, z=p.Z))
            _lighting_geometry.append(" ".join(parts))

        out = "Built {} transform string(s).".format(len(_lighting_geometry))

except Exception as e:
    out = "ERROR: {}".format(e)
# ---------- end lighting_geometry_2 ----------
lighting_geometry_3 = Python3Script(rotationX=number_slider, rotationY=number_slider_2, rotationZ=number_slider_3)  # -> out, lighting_geometry; inputs points: list of Point3d; disabled; same code as lighting_geometry
merge = Merge(Data1=lighting_geometry.lighting_geometry, Data2=lighting_geometry_3.lighting_geometry)  # disabled

# ==== cluster Epw_illuminance_data
epw_file = ClusterInput()
hour_index = ClusterInput()
hour_index_2 = Data(hour_index)
importepw = LBImportEPW(epw_file=epw_file)  # -> location, dry_bulb_temperature, dew_point_temperature, relative_humidity, wind_speed, wind_direction, direct_normal_rad, diffuse_horizontal_rad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; plug-in component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
xdata = LBDeconstructData(data=importepw.direct_normal_ill)  # -> header, values; plug-in component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
xdata_2 = LBDeconstructData(data=importepw.diffuse_horizontal_ill)  # -> header, values; plug-in component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
xdata_3 = LBDeconstructData(data=importepw.total_sky_cover)  # -> header, values; plug-in component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
direct_normal_ill = ListItem(List=xdata.values, Index=hour_index_2, Wrap=True)
list_item = ListItem(List=xdata_2.values, Index=hour_index_2, Wrap=True)
list_item_2 = ListItem(List=xdata_3.values, Index=hour_index_2, Wrap=True)
division = Division(A=list_item_2, B=Slider(10, range=0..10))
diffuse_horizontal_ill = Data(list_item)
direct_normal_ill_2 = Data(direct_normal_ill)
total_sky_cover = Data(division)
direct_normal_ill_3 = ClusterOutput(direct_normal_ill_2)
diffuse_horizontal_ill_2 = ClusterOutput(diffuse_horizontal_ill)
total_sky_cover_2 = ClusterOutput(total_sky_cover)
